# Grasshopper definition FP-homewood - 00 - lower2.gh (Grasshopper 0.9.70)
# plug-ins: HDTReference

panel = Panel("PLBG-CW")
panel_2 = Panel("PDRAW")

# ----
# Select Data
panel_3 = Panel("Curve")
data = Data(["Floor 0", "Floor 1", "Floor 2", "Floor 3", "Floor 4"])
dpipeline = DynamicGeometryPipeline(
    LayerFilter="PLBG-LAUNDRY",
    TypeFilter=panel_3,
    NameFilter="*",
    enableFullPath=False,
    GroupByLayer=False,
    GroupByType=False,
    IncludeHidden=True,
    IncludeLocked=True)  # -> flatten(GeometryOut); disabled
# CW + LAUNDRY
dpipeline_2 = DynamicGeometryPipeline(
    LayerFilter=data,
    TypeFilter=panel_3,
    NameFilter="*",
    enableFullPath=False,
    GroupByLayer=False,
    GroupByType=False,
    IncludeHidden=True,
    IncludeLocked=True)

basement = Slider(0, range=-40..200)
level_1 = Slider(126, range=0..200)
level_roof = Slider(570.75, range=0..1000)
level_3 = Slider(423.375, range=0..1000)
level_2 = Slider(294, range=0..1000)
xy = XYPlane(Origin=Point(0, 0, 0))
pt = ConstructPoint(XCoordinate=0, YCoordinate=0, ZCoordinate=xy)

panel_4 = Panel("PLBG-LAUNDRY")

# ----
# Seperate by Floor
curvepoint = PointOnCurve(dpipeline, parameter=0.5)
incurves = PointInCurves(Point=curvepoint, Curves=simplify(dpipeline_2))  # -> Relationship, Index, Point
equals = Equality(FirstNumber=incurves.Relationship, SecondNumber=2)  # -> Equality, Inequality
crv = Curve(simplify(dpipeline))
cull = CullPattern(List=crv, CullPattern=equals.Equality)
branch = TreeBranch(Tree=cull, Path=Slider(2, range=0..10), MaintainPaths=True)  # -> flatten(Branch)
branch_2 = TreeBranch(Tree=cull, Path=Slider(3, range=0..10), MaintainPaths=True)  # -> flatten(Branch)
branch_3 = TreeBranch(Tree=cull, Path=Slider(1, range=0..10), MaintainPaths=True)  # -> flatten(Branch)
branch_4 = TreeBranch(Tree=cull, Path=Slider(0, range=0..10), MaintainPaths=True)  # -> flatten(Branch)

dpipeline_3 = DynamicGeometryPipeline(
    LayerFilter="PDRAW",
    TypeFilter="Curve",
    NameFilter="*",
    enableFullPath=False,
    GroupByLayer=False,
    GroupByType=False,
    IncludeHidden=True,
    IncludeLocked=True)  # -> flatten(GeometryOut); disabled
data_2 = Data(["Floor 0", "Floor 1", "Floor 2", "Floor 3", "Floor 4"])
dpipeline_4 = DynamicGeometryPipeline(
    LayerFilter=data_2,
    TypeFilter="Curve",
    NameFilter="*",
    enableFullPath=False,
    GroupByLayer=False,
    GroupByType=False,
    IncludeHidden=True,
    IncludeLocked=True)
curvepoint_2 = PointOnCurve(dpipeline_3, parameter=0.5)
# VENTS
translation_vector___do_not_touch = Curve(<curve referenced from the Rhino model>)

# ----
# ATTRIBUTE TEXT by INTERSECTION
panel_6 = Panel("M-ANNO-NOTE")
# ENDPOINT EXPORT
# FINISHED BLOCKS
mains = Curve([<curve referenced from the Rhino model> x6])
dpipeline_5 = DynamicGeometryPipeline(
    LayerFilter=panel_6,
    TypeFilter="text",
    NameFilter="*",
    enableFullPath=False,
    GroupByLayer=False,
    GroupByType=False,
    IncludeHidden=True,
    IncludeLocked=True)
txtobjinfo = TextObjectInfo(TextObjects=dpipeline_5)  # -> Plane, Text, Size, Alignment, VerticalAlignment
pt_2 = Point(txtobjinfo.Plane)
null = NullItem(Item=pt_2)  # -> NullFlags, InvalidFlags, Description
cull_2 = CullPattern(List=txtobjinfo.Text, CullPattern=invert(null.NullFlags))
cull_3 = CullPattern(List=pt_2, CullPattern=invert(null.NullFlags))
sph = Sphere(Base=cull_3, Radius=Slider(8.57, range=0..20))
graft = GraftTree(Tree=sph, IncludeEmptyLists=True, IncludeNullItems=True)  # -> simplify(Tree)
graft_2 = GraftTree(Tree=cull_2, IncludeEmptyLists=True, IncludeNullItems=True)  # -> simplify(Tree)
bcx = BrepCurve(Brep=graft, Curve=mains)  # -> Curves, simplify(Points)
pshift = ShiftPaths(Data=bcx.Points, Offset=-1)
cull_i = CullIndex(List=pshift, Indices=1, Wrap=True)
null_2 = NullItem(Item=cull_i)  # -> NullFlags, InvalidFlags, Description
cull_4 = CullPattern(List=graft_2, CullPattern=invert(null_2.NullFlags))  # -> flatten(List)
case = TextCase(Text=cull_4, Culture=127)  # -> UpperCase, LowerCase
split = TextSplit(Text=case.UpperCase, Separators="X")
panel_7 = Panel(split)

crv_2 = Curve([<curve referenced from the Rhino model> x8])
end = EndPoints(Curve=flatten(crv_2))  # -> Start, End
pdecon = Deconstruct(Point=end.End)  # -> XComponent, YComponent, ZComponent
pdecon_2 = Deconstruct(Point=end.Start)  # -> XComponent, YComponent, ZComponent
panel_8 = Panel(pdecon_2.XComponent)
panel_9 = Panel(pdecon_2.YComponent)
panel_10 = Panel(pdecon.XComponent)
panel_11 = Panel(pdecon.YComponent)
panel_12 = Panel(pdecon_2.ZComponent)
panel_13 = Panel(pdecon.ZComponent)

# ----
# Master Levels
basement_2 = Slider(0, range=-40..200)
level_roof_2 = Slider(570.75, range=0..1000)
level_3_2 = Slider(423.375, range=0..1000)
level_1_2 = Slider(126, range=0..200)
level_2_2 = Slider(294, range=0..1000)
xy_2 = XYPlane(Origin=Point(0, 0, 0))
pt_3 = ConstructPoint(XCoordinate=0, YCoordinate=0, ZCoordinate=xy_2)

# ----
# SORTING_4
# (Riser VS Drop)
curve_circular = Curve()
cls = Closed(Curve=curve_circular)  # -> Closed, Periodic
cull_5 = CullPattern(List=curve_circular, CullPattern=invert(cls.Closed))
cull_6 = CullPattern(List=curve_circular, CullPattern=cls.Closed)
cp = ControlPoints(Curve=cull_5)  # -> Points, Weights, Knots
cp_2 = ControlPoints(Curve=cull_6)  # -> Points, Weights, Knots
pline = PolyLine(Vertices=cp.Points, Closed=invert(False))
pline_2 = PolyLine(Vertices=cp_2.Points, Closed=invert(False))
pcen = PolygonCenter(Polyline=pline_2)  # -> CenterV, CenterE
pcen_2 = PolygonCenter(Polyline=pline)  # -> CenterV, CenterE
pt_4 = Point(pcen.CenterE)
pt_5 = Point(pcen_2.CenterE)
risers_points = Data(pt_4)
drops_points = Data(pt_5)
risers_curves = Data(cull_6)
drops_curves = Data(cull_5)

# ----
# SINGLE SLOPE
crv_3 = Curve()
explode = Explode(Curve=crv_3, Recursive=True)  # -> Segments, Vertices
shift = ShiftList(List=explode.Vertices, Shift=1, Wrap=invert(True))
dist = Distance(PointA=explode.Vertices, PointB=shift)  # -> simplify(Distance)
lng = ListLength(List=dist)
series = Series(Start=0, Step=1, Count=lng)  # -> simplify(Series)
series_2 = Series(Start=0, Step=1, Count=series)  # -> simplify(Series)
item = ListItem(List=dist, Index=series_2, Wrap=True)  # -> simplify(Item)
ma = MassAddition(Input=item)  # -> flatten(Result), PartialResults
division = Division(A=ma.Result, B=Slider(12, range=0..12))
division_2 = Division(A=division, B=Slider(4, range=0..8))
line = LineSDL(Start=Point(0, 0, 0), Direction=Vector(0, 0, 1), Length=division_2)
move = Move(Geometry=explode.Vertices, Motion=line)  # -> Geometry, Transform
shift_2 = ShiftList(List=move.Geometry, Shift=1, Wrap=invert(True))
ln = Line(StartPoint=shift_2, EndPoint=move.Geometry)  # -> flatten(Line)

# ----
# SORTING_3
# Curve or Line (run vs symbol)
curve = Curve()
explode_2 = Explode(Curve=curve, Recursive=True)  # -> Segments, Vertices
cp_3 = ControlPoints(Curve=explode_2.Segments)  # -> Points, Weights, Knots
lng_2 = ListLength(List=cp_3.Points)  # -> flatten(Length)
equals_2 = Equality(FirstNumber=lng_2, SecondNumber=9)  # -> Equality, Inequality
cull_7 = CullPattern(List=flatten(explode_2.Segments), CullPattern=equals_2.Equality)
cull_8 = CullPattern(List=flatten(explode_2.Segments), CullPattern=invert(equals_2.Equality))
circle_symbols = Data(cull_7)
line_symbols = Data(cull_8)

# ----
# Mass Crv Intersect
risers = Curve([<curve referenced from the Rhino model> x936])
crv_4 = Curve([<curve referenced from the Rhino model> x952])
graft_3 = GraftTree(Tree=risers, IncludeEmptyLists=True, IncludeNullItems=True)  # -> simplify(Tree)
ccx = CurveCurve(CurveA=graft_3, CurveB=crv_4)  # -> Points, ParamsA, ParamsB
pshift_2 = ShiftPaths(Data=ccx.Points, Offset=-1)
null_3 = NullItem(Item=pshift_2)  # -> NullFlags, InvalidFlags, Description
cull_9 = CullPattern(List=graft_3, CullPattern=invert(null_3.NullFlags))  # -> flatten(List)

incurves_2 = PointInCurves(Point=curvepoint_2, Curves=simplify(dpipeline_4))  # -> Relationship, Index, Point
equals_3 = Equality(FirstNumber=incurves_2.Relationship, SecondNumber=2)  # -> Equality, Inequality
crv_5 = Curve(simplify(dpipeline_3))
translation_vector___do_not_touch_2 = Curve(<curve referenced from the Rhino model>)
cull_10 = CullPattern(List=crv_5, CullPattern=equals_3.Equality)
viewer = ParamViewer(cull_10)

# ----
# EXTENTION INTERSECTION
# (are two curves the same pipe?)
crv_6 = Curve()

branch_5 = TreeBranch(Tree=cull_10, Path=Slider(1, range=0..10), MaintainPaths=True)  # -> flatten(Branch)

crv_7 = Curve()
cp_4 = ControlPoints(Curve=crv_7)  # -> Points, Weights, Knots
pline_3 = PolyLine(Vertices=cp_4.Points, Closed=invert(False))
pcen_3 = PolygonCenter(Polyline=pline_3)  # -> CenterV, CenterE
pt_6 = Point(pcen_3.CenterE)

line_2 = LineSDL(Start=pt, Direction=Vector(0, 0, 1), Length=level_1)
move_2 = Move(Geometry=xy, Motion=line_2)  # -> Geometry, Transform
# LEVEL 1
movetoplane = MoveToPlane(Geometry=branch_5, Plane=move_2.Geometry, Above=True, Below=True)  # -> Geometry, Transform

# ----
# Complex Mass Curve Intersect
risers_2 = Curve([<curve referenced from the Rhino model> x936])
crv_8 = Curve([<curve referenced from the Rhino model> x952])
graft_4 = GraftTree(Tree=risers_2, IncludeEmptyLists=True, IncludeNullItems=True)  # -> simplify(Tree)
end_2 = EndPoints(Curve=graft_4)  # -> Start, End
end_3 = EndPoints(Curve=crv_8)  # -> Start, End
ccx_2 = CurveCurve(CurveA=graft_4, CurveB=crv_8)  # -> Points, ParamsA, ParamsB
equals_4 = Equality(FirstNumber=end_2.End, SecondNumber=end_3.End)  # -> Equality, Inequality
equals_5 = Equality(FirstNumber=end_2.Start, SecondNumber=end_3.Start)  # -> Equality, Inequality
pshift_3 = ShiftPaths(Data=ccx_2.Points, Offset=-1)
and = GateAnd(A=equals_5.Inequality, B=equals_4.Inequality)
null_4 = NullItem(Item=pshift_3)  # -> NullFlags, InvalidFlags, Description
cull_11 = CullPattern(List=graft_4, CullPattern=and)
cull_12 = CullPattern(List=graft_4, CullPattern=invert(null_4.NullFlags))  # -> flatten(List)

line_3 = LineSDL(Start=pt_3, Direction=Vector(0, 0, 1), Length=level_2_2)
move_3 = Move(Geometry=xy_2, Motion=line_3)  # -> Geometry, Transform
# LEVEL 2
movetoplane_2 = MoveToPlane(Geometry=branch, Plane=move_3.Geometry, Above=True, Below=True)  # -> Geometry, Transform

line_4 = LineSDL(Start=pt_3, Direction=Vector(0, 0, 1), Length=level_1_2)
move_4 = Move(Geometry=xy_2, Motion=line_4)  # -> Geometry, Transform
# LEVEL 1
movetoplane_3 = MoveToPlane(Geometry=branch_3, Plane=move_4.Geometry, Above=True, Below=True)  # -> Geometry, Transform

line_5 = LineSDL(Start=pt_3, Direction=Vector(0, 0, 1), Length=basement_2)
move_5 = Move(Geometry=xy_2, Motion=line_5)  # -> Geometry, Transform
# LEVEL 0
movetoplane_4 = MoveToPlane(Geometry=branch_4, Plane=move_5.Geometry, Above=True, Below=True)  # -> Geometry, Transform

# ----
# SORTING_3
# Curve or Line (run vs symbol)
explode_3 = Explode(Curve=movetoplane_2.Geometry, Recursive=True)  # -> Segments, Vertices
cp_5 = ControlPoints(Curve=explode_3.Segments)  # -> Points, Weights, Knots
lng_3 = ListLength(List=cp_5.Points)  # -> flatten(Length)
equals_6 = Equality(FirstNumber=lng_3, SecondNumber=9)  # -> Equality, Inequality
cull_13 = CullPattern(List=flatten(explode_3.Segments), CullPattern=equals_6.Equality)
# LEVEL 3
cull_14 = CullPattern(List=flatten(explode_3.Segments), CullPattern=invert(equals_6.Equality))
circle_symbols_2 = Data(cull_13)
line_symbols_2 = Data(cull_14)

# ----
# If pipes are in line, Intersect
extension = Slider(3.692, range=0..10)
crv_9 = Curve([<curve referenced from the Rhino model> x8])
ext = ExtendCurve(Curve=crv_9, Type=0, Start=extension, End=extension)  # -> reparameterize(Curve)
mcx = MultipleCurves(Curves=reparameterize(ext))  # -> Points, IndexA, IndexB, ParamA, ParamB
item_2 = ListItem(List=ext, Index=mcx.IndexA, Wrap=True)
item_3 = ListItem(List=ext, Index=mcx.IndexB, Wrap=True)
ccx_3 = CurveCurve(CurveA=item_2, CurveB=item_3)  # -> Points, ParamsA, ParamsB
item_4 = ListItem(List=crv_9, Index=mcx.IndexB, Wrap=True)
item_5 = ListItem(List=crv_9, Index=mcx.IndexA, Wrap=True)
lng_4 = ListLength(List=ccx_3.ParamsA)  # -> flatten(Length)
equals_7 = Equality(FirstNumber=lng_4, SecondNumber=2)  # -> Equality, Inequality
cull_15 = CullPattern(List=item_4, CullPattern=equals_7.Equality)
cull_16 = CullPattern(List=item_5, CullPattern=equals_7.Equality)
cull_17 = CullPattern(List=cull_15, CullPattern=[False, True])
cull_18 = CullPattern(List=cull_16, CullPattern=[False, True])
end_4 = EndPoints(Curve=simplify(graft(cull_18)))  # -> Start, End
end_5 = EndPoints(Curve=simplify(graft(cull_17)))  # -> Start, End
ln_2 = Line(StartPoint=end_4.Start, EndPoint=end_5.End)
ln_3 = Line(StartPoint=end_4.End, EndPoint=end_5.Start)
ln_4 = Line(StartPoint=end_4.End, EndPoint=end_5.End)
ln_5 = Line(StartPoint=end_4.Start, EndPoint=end_5.Start)
len = Length(Curve=ln_5)
len_2 = Length(Curve=ln_2)
len_3 = Length(Curve=ln_4)
len_4 = Length(Curve=ln_3)
data_3 = Data([ln_2, ln_5, ln_3, ln_4])
data_4 = Data([len_2, len, len_4, len_3])
sort = SortList(Keys=data_4, ValuesA=data_3)  # -> Keys, ValuesA
crv_10 = Curve(ext)
item_6 = ListItem(List=sort.ValuesA, Index=3, Wrap=True)
crv_11 = Curve(flatten(item_6))
ccx_4 = CurveCurve(CurveA=graft(crv_10), CurveB=crv_11)  # -> simplify(Points), ParamsA, ParamsB
lng_5 = ListLength(List=ccx_4.Points)
equals_8 = Equality(FirstNumber=lng_5, SecondNumber=2)  # -> Equality, Inequality
cull_19 = CullPattern(List=ccx_4.Points, CullPattern=equals_8.Equality)
pshift_4 = ShiftPaths(Data=cull_19, Offset=-1)
item_7 = ListItem(List=pshift_4, Index=0, Wrap=True)
null_5 = NullItem(Item=item_7)  # -> flatten(NullFlags), InvalidFlags, Description
crv_12 = Curve(crv_11)
cull_20 = CullPattern(List=[crv_10, crv_9], CullPattern=null_5.NullFlags)
crv_13 = Curve([crv_12, cull_20])

# ----
# Shatter at Intersections
crv_14 = Curve(reparameterize(flatten([<curve referenced from the Rhino model> x3])))
crv_15 = Curve(simplify(graft(crv_14)))
ccx_5 = CurveCurve(CurveA=crv_14, CurveB=crv_15)  # -> Points, ParamsA, ParamsB
pshift_5 = ShiftPaths(Data=ccx_5.ParamsB, Offset=-1)
sort_2 = SortList(Keys=pshift_5)  # -> Keys, ValuesA
shatter = Shatter(Curve=crv_15, Parameters=sort_2.Keys)
crv_16 = Curve(flatten(shatter))

# ----
# SORTING_3
# Curve or Line (run vs symbol)
explode_4 = Explode(Curve=movetoplane_3.Geometry, Recursive=True)  # -> Segments, Vertices
cp_6 = ControlPoints(Curve=explode_4.Segments)  # -> Points, Weights, Knots
lng_6 = ListLength(List=cp_6.Points)  # -> flatten(Length)
equals_9 = Equality(FirstNumber=lng_6, SecondNumber=9)  # -> Equality, Inequality
cull_21 = CullPattern(List=flatten(explode_4.Segments), CullPattern=equals_9.Equality)
cull_22 = CullPattern(List=flatten(explode_4.Segments), CullPattern=invert(equals_9.Equality))
circle_symbols_3 = Data(cull_21)
line_symbols_3 = Data(cull_22)

# ----
# SORTING_3
# Curve or Line (run vs symbol)
explode_5 = Explode(Curve=movetoplane_4.Geometry, Recursive=True)  # -> Segments, Vertices
cp_7 = ControlPoints(Curve=explode_5.Segments)  # -> Points, Weights, Knots
lng_7 = ListLength(List=cp_7.Points)  # -> flatten(Length)
equals_10 = Equality(FirstNumber=lng_7, SecondNumber=9)  # -> Equality, Inequality
cull_23 = CullPattern(List=flatten(explode_5.Segments), CullPattern=equals_10.Equality)
cull_24 = CullPattern(List=flatten(explode_5.Segments), CullPattern=invert(equals_10.Equality))
circle_symbols_4 = Data(cull_23)
line_symbols_4 = Data(cull_24)

# ----
# SORTING_4
# (Riser VS Drop)
cls_2 = Closed(Curve=movetoplane.Geometry)  # -> Closed, Periodic
cull_25 = CullPattern(List=movetoplane.Geometry, CullPattern=invert(cls_2.Closed))
cull_26 = CullPattern(List=movetoplane.Geometry, CullPattern=cls_2.Closed)
cp_8 = ControlPoints(Curve=cull_25)  # -> Points, Weights, Knots
cp_9 = ControlPoints(Curve=cull_26)  # -> Points, Weights, Knots
pline_4 = PolyLine(Vertices=cp_8.Points, Closed=invert(False))
pline_5 = PolyLine(Vertices=cp_9.Points, Closed=invert(False))
pcen_4 = PolygonCenter(Polyline=pline_4)  # -> CenterV, CenterE
risers_curves_2 = Data(cull_26)
pcen_5 = PolygonCenter(Polyline=pline_5)  # -> CenterV, CenterE
drops_curves_2 = Data(cull_25)
pt_7 = Point(pcen_4.CenterE)
pt_8 = Point(pcen_5.CenterE)
drops_points_2 = Data(pt_7)
risers_points_2 = Data(pt_8)

# ----
# SORTING_4
# (Riser VS Drop)
cls_3 = Closed(Curve=circle_symbols_2)  # -> Closed, Periodic
cull_27 = CullPattern(List=circle_symbols_2, CullPattern=invert(cls_3.Closed))
cull_28 = CullPattern(List=circle_symbols_2, CullPattern=cls_3.Closed)
cp_10 = ControlPoints(Curve=cull_27)  # -> Points, Weights, Knots
cp_11 = ControlPoints(Curve=cull_28)  # -> Points, Weights, Knots
pline_6 = PolyLine(Vertices=cp_10.Points, Closed=invert(False))
pline_7 = PolyLine(Vertices=cp_11.Points, Closed=invert(False))
pcen_6 = PolygonCenter(Polyline=pline_6)  # -> CenterV, CenterE
risers_curves_3 = Data(cull_28)
pcen_7 = PolygonCenter(Polyline=pline_7)  # -> CenterV, CenterE
drops_curves_3 = Data(cull_27)
pt_9 = Point(pcen_6.CenterE)
pt_10 = Point(pcen_7.CenterE)
drops_points_3 = Data(pt_9)
risers_points_3 = Data(pt_10)

# ----
# SORTING_4
# (Riser VS Drop)
cls_4 = Closed(Curve=circle_symbols_3)  # -> Closed, Periodic
cull_29 = CullPattern(List=circle_symbols_3, CullPattern=invert(cls_4.Closed))
cull_30 = CullPattern(List=circle_symbols_3, CullPattern=cls_4.Closed)
cp_12 = ControlPoints(Curve=cull_29)  # -> Points, Weights, Knots
cp_13 = ControlPoints(Curve=cull_30)  # -> Points, Weights, Knots
pline_8 = PolyLine(Vertices=cp_12.Points, Closed=invert(False))
pline_9 = PolyLine(Vertices=cp_13.Points, Closed=invert(False))
pcen_8 = PolygonCenter(Polyline=pline_8)  # -> CenterV, CenterE
risers_curves_4 = Data(cull_30)
pcen_9 = PolygonCenter(Polyline=pline_9)  # -> CenterV, CenterE
drops_curves_4 = Data(cull_29)
pt_11 = Point(pcen_8.CenterE)
pt_12 = Point(pcen_9.CenterE)
drops_points_4 = Data(pt_11)
risers_points_4 = Data(pt_12)

# ----
# SORTING_4
# (Riser VS Drop)
cls_5 = Closed(Curve=circle_symbols_4)  # -> Closed, Periodic
cull_31 = CullPattern(List=circle_symbols_4, CullPattern=invert(cls_5.Closed))
cull_32 = CullPattern(List=circle_symbols_4, CullPattern=cls_5.Closed)
cp_14 = ControlPoints(Curve=cull_31)  # -> Points, Weights, Knots
cp_15 = ControlPoints(Curve=cull_32)  # -> Points, Weights, Knots
pline_10 = PolyLine(Vertices=cp_14.Points, Closed=invert(False))
pline_11 = PolyLine(Vertices=cp_15.Points, Closed=invert(False))
pcen_10 = PolygonCenter(Polyline=pline_10)  # -> CenterV, CenterE
risers_curves_5 = Data(cull_32)
pcen_11 = PolygonCenter(Polyline=pline_11)  # -> CenterV, CenterE
drops_curves_5 = Data(cull_31)
pt_13 = Point(pcen_10.CenterE)
pt_14 = Point(pcen_11.CenterE)
drops_points_5 = Data(pt_13)
risers_points_5 = Data(pt_14)

# ----
# ATTRIBUTE TEXT by DISTANCE
panel_14 = Panel("text")
dpipeline_6 = DynamicGeometryPipeline(
    LayerFilter="FP-TEXT",
    TypeFilter=panel_14,
    NameFilter="*",
    enableFullPath=False,
    GroupByLayer=False,
    GroupByType=False,
    IncludeHidden=True,
    IncludeLocked=True)
txtobjinfo_2 = TextObjectInfo(TextObjects=dpipeline_6)  # -> Plane, Text, Size, Alignment, VerticalAlignment
pt_15 = Point(txtobjinfo_2.Plane)
crv_cp = CurveClosestPoint()  # -> Point, Parameter, Distance

# ----
# Offset from Level
offset = Slider(468, range=0..500)
geo = Geometry(risers_points_2)
pt_16 = ConstructPoint(XCoordinate=0, YCoordinate=0, ZCoordinate=0)
Z = UnitZ(Factor=1)
line_6 = LineSDL(Start=pt_16, Direction=Z, Length=offset)
move_6 = Move(Geometry=geo, Motion=line_6)  # -> Geometry, Transform
geo_2 = Geometry(move_6.Geometry)

# ----
# Offset from Level
offset_2 = Slider(-15, range=-50..200)
geo_3 = Geometry(risers_points_2)
pt_17 = ConstructPoint(XCoordinate=0, YCoordinate=0, ZCoordinate=0)
Z_2 = UnitZ(Factor=1)
line_7 = LineSDL(Start=pt_17, Direction=Z_2, Length=offset_2)
move_7 = Move(Geometry=geo_3, Motion=line_7)  # -> Geometry, Transform
geo_4 = Geometry(move_7.Geometry)

# ----
# Offset from Level
offset_3 = Slider(114, range=0..200)
geo_5 = Geometry(line_symbols_2)
pt_18 = ConstructPoint(XCoordinate=0, YCoordinate=0, ZCoordinate=0)
Z_3 = UnitZ(Factor=1)
line_8 = LineSDL(Start=pt_18, Direction=Z_3, Length=offset_3)
move_8 = Move(Geometry=geo_5, Motion=line_8)  # -> Geometry, Transform
geo_6 = Geometry(move_8.Geometry)

# ----
# Offset from Level
offset_4 = Slider(114, range=0..200)
geo_7 = Geometry(drops_points_3)
pt_19 = ConstructPoint(XCoordinate=0, YCoordinate=0, ZCoordinate=0)
Z_4 = UnitZ(Factor=1)
line_9 = LineSDL(Start=pt_19, Direction=Z_4, Length=offset_4)
move_9 = Move(Geometry=geo_7, Motion=line_9)  # -> Geometry, Transform
geo_8 = Geometry(move_9.Geometry)

# ----
# Offset from Level
offset_5 = Slider(129, range=0..200)
geo_9 = Geometry(line_symbols_3)
pt_20 = ConstructPoint(XCoordinate=0, YCoordinate=0, ZCoordinate=0)
Z_5 = UnitZ(Factor=1)
line_10 = LineSDL(Start=pt_20, Direction=Z_5, Length=offset_5)
move_10 = Move(Geometry=geo_9, Motion=line_10)  # -> Geometry, Transform
geo_10 = Geometry(move_10.Geometry)

# ----
# Offset from Level
offset_6 = Slider(111, range=0..200)
geo_11 = Geometry(line_symbols_4)
pt_21 = ConstructPoint(XCoordinate=0, YCoordinate=0, ZCoordinate=0)
Z_6 = UnitZ(Factor=1)
line_11 = LineSDL(Start=pt_21, Direction=Z_6, Length=offset_6)
move_11 = Move(Geometry=geo_11, Motion=line_11)  # -> Geometry, Transform
geo_12 = Geometry(move_11.Geometry)

# ----
# Offset from Level
offset_7 = Slider(129, range=0..200)
geo_13 = Geometry(drops_points_4)
pt_22 = ConstructPoint(XCoordinate=0, YCoordinate=0, ZCoordinate=0)
Z_7 = UnitZ(Factor=1)
line_12 = LineSDL(Start=pt_22, Direction=Z_7, Length=offset_7)
move_12 = Move(Geometry=geo_13, Motion=line_12)  # -> Geometry, Transform
geo_14 = Geometry(move_12.Geometry)

# ----
# Offset from Level
offset_8 = Slider(111, range=0..200)
geo_15 = Geometry(drops_points_5)
pt_23 = ConstructPoint(XCoordinate=0, YCoordinate=0, ZCoordinate=0)
Z_8 = UnitZ(Factor=1)
line_13 = LineSDL(Start=pt_23, Direction=Z_8, Length=offset_8)
move_13 = Move(Geometry=geo_15, Motion=line_13)  # -> Geometry, Transform
geo_16 = Geometry(move_13.Geometry)

# ----
# Offset from Level
offset_9 = Slider(260, range=0..300)
geo_17 = Geometry(risers_points_3)
pt_24 = ConstructPoint(XCoordinate=0, YCoordinate=0, ZCoordinate=0)
Z_9 = UnitZ(Factor=1)
line_14 = LineSDL(Start=pt_24, Direction=Z_9, Length=offset_9)
move_14 = Move(Geometry=geo_17, Motion=line_14)  # -> Geometry, Transform
geo_18 = Geometry(move_14.Geometry)

# ----
# Offset from Level
offset_10 = Slider(126, range=0..200)
geo_19 = Geometry(risers_points_5)
pt_25 = ConstructPoint(XCoordinate=0, YCoordinate=0, ZCoordinate=0)
Z_10 = UnitZ(Factor=1)
line_15 = LineSDL(Start=pt_25, Direction=Z_10, Length=offset_10)
move_15 = Move(Geometry=geo_19, Motion=line_15)  # -> Geometry, Transform
geo_20 = Geometry(move_15.Geometry)

# ----
# Offset from Level
offset_11 = Slider(168, range=0..200)
geo_21 = Geometry(risers_points_4)
pt_26 = ConstructPoint(XCoordinate=0, YCoordinate=0, ZCoordinate=0)
Z_11 = UnitZ(Factor=1)
line_16 = LineSDL(Start=pt_26, Direction=Z_11, Length=offset_11)
move_16 = Move(Geometry=geo_21, Motion=line_16)  # -> Geometry, Transform
geo_22 = Geometry(move_16.Geometry)

# ----
# Shatter at Intersections
crv_17 = Curve(reparameterize(geo_6))
mcx_2 = MultipleCurves(Curves=reparameterize(crv_17))  # -> Points, IndexA, IndexB, ParamA, ParamB
lng_8 = ListLength(List=crv_17)
series_3 = Series(Start=0, Step=1, Count=lng_8)
cset = CreateSet(List=series_3)  # -> Set, Map
item_8 = ListItem(List=crv_17, Index=mcx_2.IndexB, Wrap=True)
item_9 = ListItem(List=crv_17, Index=mcx_2.IndexA, Wrap=True)
cset_2 = CreateSet(List=[mcx_2.IndexA, mcx_2.IndexB])  # -> Set, Map
int = Integer(cset.Set)
difference = SetDifference(SetA=int, SetB=cset_2.Set)
shatter_2 = Shatter(Curve=graft(item_8), Parameters=graft(mcx_2.ParamB))
shatter_3 = Shatter(Curve=graft(item_9), Parameters=graft(mcx_2.ParamA))
item_10 = ListItem(List=crv_17, Index=difference, Wrap=True)
crv_18 = Curve(flatten([shatter_3, shatter_2, item_10]))

# ----
# Shatter at Intersections
crv_19 = Curve(reparameterize(geo_10))
mcx_3 = MultipleCurves(Curves=reparameterize(crv_19))  # -> Points, IndexA, IndexB, ParamA, ParamB
lng_9 = ListLength(List=crv_19)
series_4 = Series(Start=0, Step=1, Count=lng_9)
cset_3 = CreateSet(List=series_4)  # -> Set, Map
item_11 = ListItem(List=crv_19, Index=mcx_3.IndexB, Wrap=True)
item_12 = ListItem(List=crv_19, Index=mcx_3.IndexA, Wrap=True)
cset_4 = CreateSet(List=[mcx_3.IndexA, mcx_3.IndexB])  # -> Set, Map
int_2 = Integer(cset_3.Set)
difference_2 = SetDifference(SetA=int_2, SetB=cset_4.Set)
shatter_4 = Shatter(Curve=graft(item_11), Parameters=graft(mcx_3.ParamB))
shatter_5 = Shatter(Curve=graft(item_12), Parameters=graft(mcx_3.ParamA))
item_13 = ListItem(List=crv_19, Index=difference_2, Wrap=True)
crv_20 = Curve(flatten([shatter_5, shatter_4, item_13]))

pt_27 = Point(geo_14)

# ----
# Shatter at Intersections
crv_21 = Curve(reparameterize(geo_12))
mcx_4 = MultipleCurves(Curves=reparameterize(crv_21))  # -> Points, IndexA, IndexB, ParamA, ParamB
lng_10 = ListLength(List=crv_21)
series_5 = Series(Start=0, Step=1, Count=lng_10)
cset_5 = CreateSet(List=series_5)  # -> Set, Map
item_14 = ListItem(List=crv_21, Index=mcx_4.IndexB, Wrap=True)
item_15 = ListItem(List=crv_21, Index=mcx_4.IndexA, Wrap=True)
cset_6 = CreateSet(List=[mcx_4.IndexA, mcx_4.IndexB])  # -> Set, Map
int_3 = Integer(cset_5.Set)
difference_3 = SetDifference(SetA=int_3, SetB=cset_6.Set)
shatter_6 = Shatter(Curve=graft(item_14), Parameters=graft(mcx_4.ParamB))
shatter_7 = Shatter(Curve=graft(item_15), Parameters=graft(mcx_4.ParamA))
item_16 = ListItem(List=crv_21, Index=difference_3, Wrap=True)
crv_22 = Curve(flatten([shatter_7, shatter_6, item_16]))

pt_28 = Point(geo_16)
pt_29 = Point(geo_8)
ln_6 = Line(StartPoint=geo_4, EndPoint=geo_2)
ln_7 = Line(StartPoint=drops_points_3, EndPoint=pt_29)
ln_8 = Line(StartPoint=risers_points_3, EndPoint=geo_18)
ln_9 = Line(StartPoint=drops_points_4, EndPoint=pt_27)
ln_10 = Line(StartPoint=drops_points_5, EndPoint=pt_28)
ln_11 = Line(StartPoint=risers_points_4, EndPoint=geo_22)
ln_12 = Line(StartPoint=risers_points_5, EndPoint=geo_20)
crv_23 = Curve(ln_6)

geo_23 = Geometry(crv_23)
crv_24 = Curve(<curve referenced from the Rhino model>)
pt_30 = ConstructPoint(XCoordinate=0, YCoordinate=0, ZCoordinate=0)
Y = UnitY(Factor=1)
len_5 = Length(Curve=crv_24)
multiplication = Multiplication(A=len_5, B=Slider(1, range=0..10))
neg = Negative(Value=multiplication)
line_17 = LineSDL(Start=pt_30, Direction=Y, Length=neg)
move_17 = Move(Geometry=geo_23, Motion=line_17)  # -> Geometry, Transform
geo_24 = Geometry(move_17.Geometry)

crv_25 = Curve([ln_7, ln_8, crv_18])
crv_26 = Curve([ln_9, ln_11, crv_20])
crv_27 = Curve([ln_10, ln_12, crv_22])

geo_25 = Geometry(crv_25)
crv_28 = Curve(<curve referenced from the Rhino model>)
pt_31 = ConstructPoint(XCoordinate=0, YCoordinate=0, ZCoordinate=0)
Y_2 = UnitY(Factor=1)
len_6 = Length(Curve=crv_28)
multiplication_2 = Multiplication(A=len_6, B=Slider(2, range=0..10))
neg_2 = Negative(Value=multiplication_2)
line_18 = LineSDL(Start=pt_31, Direction=Y_2, Length=neg_2)
move_18 = Move(Geometry=geo_25, Motion=line_18)  # -> Geometry, Transform
geo_26 = Geometry(move_18.Geometry)

# ----
# Translate to final position by curve
geo_27 = Geometry(crv_26)
crv_29 = Curve(<curve referenced from the Rhino model>)
pt_32 = ConstructPoint(XCoordinate=0, YCoordinate=0, ZCoordinate=0)
Y_3 = UnitY(Factor=1)
len_7 = Length(Curve=crv_29)
multiplication_3 = Multiplication(A=len_7, B=Slider(1, range=0..10))
neg_3 = Negative(Value=multiplication_3)
line_19 = LineSDL(Start=pt_32, Direction=Y_3, Length=neg_3)
move_19 = Move(Geometry=geo_27, Motion=line_19)  # -> Geometry, Transform
geo_28 = Geometry(move_19.Geometry)

geo_29 = Geometry(crv_27)
crv_30 = Curve(<curve referenced from the Rhino model>)
pt_33 = ConstructPoint(XCoordinate=0, YCoordinate=0, ZCoordinate=0)
Y_4 = UnitY(Factor=1)
len_8 = Length(Curve=crv_30)
multiplication_4 = Multiplication(A=len_8, B=Slider(0, range=0..10))
neg_4 = Negative(Value=multiplication_4)
line_20 = LineSDL(Start=pt_33, Direction=Y_4, Length=neg_4)
move_20 = Move(Geometry=geo_29, Motion=line_20)  # -> Geometry, Transform
geo_30 = Geometry(move_20.Geometry)

data_5 = Data(flatten(geo_24))
null_6 = NullItem(Item=data_5)  # -> NullFlags, InvalidFlags, Description
cull_33 = CullPattern(List=data_5, CullPattern=invert(null_6.NullFlags))
data_6 = Data(flatten([geo_30, geo_28, geo_26]))

# ----
# SPRINKLER HEADS
# 
# Semi-Recessed
panel_15 = Panel("Curve")
panel_16 = Panel("FP-CONHD")
data_7 = Data(["Floor 0", "Floor 1", "Floor 2", "Floor 3", "Floor 4"])
dpipeline_7 = DynamicGeometryPipeline(
    LayerFilter="FP-PENHD-SR",
    TypeFilter=panel_15,
    NameFilter="*",
    enableFullPath=False,
    GroupByLayer=False,
    GroupByType=False,
    IncludeHidden=True,
    IncludeLocked=True)  # -> flatten(GeometryOut)
dpipeline_8 = DynamicGeometryPipeline(
    LayerFilter=data_7,
    TypeFilter=panel_15,
    NameFilter="*",
    enableFullPath=False,
    GroupByLayer=False,
    GroupByType=False,
    IncludeHidden=True,
    IncludeLocked=True)

# ----
# ENDPOINT EXPORT
end_6 = EndPoints(Curve=translation_vector___do_not_touch)  # -> Start, End
end_7 = EndPoints(Curve=flatten(cull_33))  # -> Start, End
vec2pt = Vector2Pt(PointA=end_6.Start, PointB=end_6.End, Unitize=False)  # -> Vector, Length
move_21 = Move(Geometry=end_7.End, Motion=vec2pt.Vector)  # -> Geometry, Transform
move_22 = Move(Geometry=end_7.Start, Motion=vec2pt.Vector)  # -> Geometry, Transform
pdecon_3 = Deconstruct(Point=move_22.Geometry)  # -> XComponent, YComponent, ZComponent
pdecon_4 = Deconstruct(Point=move_21.Geometry)  # -> XComponent, YComponent, ZComponent
panel_17 = Panel(pdecon_3.XComponent)
panel_18 = Panel(pdecon_3.ZComponent)
panel_19 = Panel(pdecon_4.XComponent)
panel_20 = Panel(pdecon_3.YComponent)
panel_21 = Panel(pdecon_4.YComponent)
panel_22 = Panel(pdecon_4.ZComponent)

# ----
# SPRINKLER HEADS
# 
# PENDANT
panel_23 = Panel("Curve")
# Select Data
panel_24 = Panel("Floor 0")
data_8 = Data([panel_24, "Floor 1", "Floor 2", "Floor 3", "Floor 4"])
dpipeline_9 = DynamicGeometryPipeline(
    LayerFilter="FP-CONHD",
    TypeFilter=panel_23,
    NameFilter="*",
    enableFullPath=False,
    GroupByLayer=False,
    GroupByType=False,
    IncludeHidden=True,
    IncludeLocked=True)  # -> flatten(GeometryOut)
dpipeline_10 = DynamicGeometryPipeline(
    LayerFilter=data_8,
    TypeFilter=panel_23,
    NameFilter="*",
    enableFullPath=False,
    GroupByLayer=False,
    GroupByType=False,
    IncludeHidden=True,
    IncludeLocked=True)

null_7 = NullItem(Item=data_6)  # -> NullFlags, InvalidFlags, Description
panel_25 = Panel("FP-PENHD-SR")
cull_34 = CullPattern(List=data_6, CullPattern=invert(null_7.NullFlags))

# ----
# ENDPOINT EXPORT
end_8 = EndPoints(Curve=translation_vector___do_not_touch_2)  # -> Start, End
end_9 = EndPoints(Curve=flatten(cull_34))  # -> Start, End
vec2pt_2 = Vector2Pt(PointA=end_8.Start, PointB=end_8.End, Unitize=False)  # -> Vector, Length
move_23 = Move(Geometry=end_9.End, Motion=vec2pt_2.Vector)  # -> Geometry, Transform
move_24 = Move(Geometry=end_9.Start, Motion=vec2pt_2.Vector)  # -> Geometry, Transform
pdecon_5 = Deconstruct(Point=move_24.Geometry)  # -> XComponent, YComponent, ZComponent
pdecon_6 = Deconstruct(Point=move_23.Geometry)  # -> XComponent, YComponent, ZComponent
panel_26 = Panel(pdecon_5.ZComponent)
panel_27 = Panel(pdecon_5.YComponent)
panel_28 = Panel(pdecon_6.XComponent)
panel_29 = Panel(pdecon_6.YComponent)
panel_30 = Panel(pdecon_6.ZComponent)
panel_31 = Panel(pdecon_5.XComponent)

curvepoint_3 = PointOnCurve(dpipeline_7, parameter=0.5)
incurves_3 = PointInCurves(Point=curvepoint_3, Curves=simplify(dpipeline_8))  # -> Relationship, Index, Point
equals_11 = Equality(FirstNumber=incurves_3.Relationship, SecondNumber=2)  # -> Equality, Inequality
crv_31 = Curve(simplify(dpipeline_7))
cull_35 = CullPattern(List=crv_31, CullPattern=equals_11.Equality)
branch_6 = TreeBranch(Tree=cull_35, Path=Slider(2, range=0..10), MaintainPaths=True)  # -> flatten(Branch)
branch_7 = TreeBranch(Tree=cull_35, Path=Slider(3, range=0..10), MaintainPaths=True)  # -> flatten(Branch)
branch_8 = TreeBranch(Tree=cull_35, Path=Slider(1, range=0..10), MaintainPaths=True)  # -> flatten(Branch)
branch_9 = TreeBranch(Tree=cull_35, Path=Slider(0, range=0..10), MaintainPaths=True)  # -> flatten(Branch)

curvepoint_4 = PointOnCurve(parameter=0.5)
incurves_4 = PointInCurves(Point=curvepoint_4, Curves=simplify(dpipeline_10))  # -> Relationship, Index, Point
equals_12 = Equality(FirstNumber=incurves_4.Relationship, SecondNumber=2)  # -> Equality, Inequality
# Seperate by Floor
crv_32 = Curve()
cull_36 = CullPattern(List=crv_32, CullPattern=equals_12.Equality)
branch_10 = TreeBranch(Tree=cull_36, Path=Slider(2, range=0..10), MaintainPaths=True)  # -> flatten(Branch)
branch_11 = TreeBranch(Tree=cull_36, Path=Slider(3, range=0..10), MaintainPaths=True)  # -> flatten(Branch)
branch_12 = TreeBranch(Tree=cull_36, Path=Slider(1, range=0..10), MaintainPaths=True)  # -> flatten(Branch)
branch_13 = TreeBranch(Tree=cull_36, Path=Slider(0, range=0..10), MaintainPaths=True)  # -> flatten(Branch)

dpipeline_11 = DynamicGeometryPipeline(
    LayerFilter="mfp-heads",
    TypeFilter="curve",
    NameFilter="*",
    enableFullPath=False,
    GroupByLayer=False,
    GroupByType=False,
    IncludeHidden=True,
    IncludeLocked=True)  # -> flatten(GeometryOut)
# SPRINKLER HEADS
# 
# SIDEWALL
panel_32 = Panel("Floor 0")

# ----
# SORTING_3
# Curve or Line (run vs symbol)
explode_6 = Explode(Curve=dpipeline_11, Recursive=True)  # -> Segments, Vertices
cp_16 = ControlPoints(Curve=explode_6.Segments)  # -> Points, Weights, Knots
lng_11 = ListLength(List=cp_16.Points)  # -> flatten(Length)
equals_13 = Equality(FirstNumber=lng_11, SecondNumber=9)  # -> Equality, Inequality
cull_37 = CullPattern(List=flatten(explode_6.Segments), CullPattern=equals_13.Equality)
circle_symbols_5 = Data(cull_37)

level_3_3 = Slider(410, range=0..1000)
level_5 = Slider(648, range=0..1000)
level_2_3 = Slider(290, range=0..1000)
level_1_3 = Slider(170, range=0..200)
level_0 = Slider(0, range=-40..200)
xy_3 = XYPlane(Origin=Point(0, 0, 0))
pt_34 = ConstructPoint(XCoordinate=0, YCoordinate=0, ZCoordinate=xy_3)

level_4 = Slider(530, range=0..1000)
all_offset = Slider(6, range=0..200)

# ----
# Master Levels
basement_3 = Slider(0, range=-40..200)
level_roof_3 = Slider(570.75, range=0..1000)
level_1_4 = Slider(126, range=0..200)
level_3_4 = Slider(423.375, range=0..1000)
level_2_4 = Slider(294, range=0..1000)
xy_4 = XYPlane(Origin=Point(0, 0, 0))
pt_35 = ConstructPoint(XCoordinate=0, YCoordinate=0, ZCoordinate=xy_4)

data_9 = Data([panel_32, "Floor 1", "Floor 2", "Floor 3", "Floor 4"])

# ----
# Master Levels
basement_4 = Slider(0, range=-40..200)
level_roof_4 = Slider(570.75, range=0..1000)
level_3_5 = Slider(423.375, range=0..1000)
level_1_5 = Slider(126, range=0..200)
level_2_5 = Slider(294, range=0..1000)
xy_5 = XYPlane(Origin=Point(0, 0, 0))
pt_36 = ConstructPoint(XCoordinate=0, YCoordinate=0, ZCoordinate=xy_5)

dpipeline_12 = DynamicGeometryPipeline(
    LayerFilter=data_9,
    TypeFilter="Curve",
    NameFilter="*",
    enableFullPath=False,
    GroupByLayer=False,
    GroupByType=False,
    IncludeHidden=True,
    IncludeLocked=True)
translation_vector___do_not_touch_3 = Curve(<curve referenced from the Rhino model>)
translation_vector___do_not_touch_4 = Curve(<curve referenced from the Rhino model>)
viewer_2 = ParamViewer(cull_35)
viewer_3 = ParamViewer(cull_36)
curvepoint_5 = PointOnCurve(circle_symbols_5, parameter=0.5)
incurves_5 = PointInCurves(Point=curvepoint_5, Curves=simplify(dpipeline_12))  # -> Relationship, Index, Point
equals_14 = Equality(FirstNumber=incurves_5.Relationship, SecondNumber=2)  # -> Equality, Inequality
crv_33 = Curve(simplify(circle_symbols_5))
cull_38 = CullPattern(List=crv_33, CullPattern=equals_14.Equality)
# PIPES FP_DRY
level_4_2 = Slider(530, range=0..1000)
# SPRINKLER HEADS
# 
# RECESSED
data_10 = Data()
level_4_3 = Slider(530, range=0..1000)
branch_14 = TreeBranch(Tree=cull_38, Path=Slider(2, range=0..10), MaintainPaths=True)  # -> flatten(Branch)
branch_15 = TreeBranch(Tree=cull_38, Path=Slider(1, range=0..10), MaintainPaths=True)  # -> flatten(Branch)
viewer_4 = ParamViewer(cull_38)
branch_16 = TreeBranch(Tree=cull_38, Path=Slider(3, range=0..10), MaintainPaths=True)  # -> flatten(Branch)
branch_17 = TreeBranch(Tree=cull_38, Path=Slider(0, range=0..10), MaintainPaths=True)  # -> flatten(Branch)
branch_18 = TreeBranch(Tree=cull_38, Path=Slider(4, range=0..10), MaintainPaths=True)  # -> flatten(Branch)

line_21 = LineSDL(Start=pt_35, Direction=Vector(0, 0, 1), Length=level_1_4)
move_25 = Move(Geometry=xy_4, Motion=line_21)  # -> Geometry, Transform
# LEVEL 1
movetoplane_5 = MoveToPlane(Geometry=branch_8, Plane=move_25.Geometry, Above=True, Below=True)  # -> Geometry, Transform

line_22 = LineSDL(Start=pt_36, Direction=Vector(0, 0, 1), Length=level_1_5)
move_26 = Move(Geometry=xy_5, Motion=line_22)  # -> Geometry, Transform
# LEVEL 1
movetoplane_6 = MoveToPlane(Geometry=branch_13, Plane=move_26.Geometry, Above=True, Below=True)  # -> Geometry, Transform

dpipeline_13 = DynamicGeometryPipeline(
    LayerFilter="FP-TEXT",
    TypeFilter="Annotation",
    NameFilter="*",
    enableFullPath=False,
    GroupByLayer=False,
    GroupByType=False,
    IncludeHidden=True,
    IncludeLocked=True)
data_leader = Data(dpipeline_13)
ps__get_leader_endpoints = CSharpScript(x=data_leader)  # -> out, Pointer, Origin; inputs x: list
# ---------- ps__get_leader_endpoints: C# ----------
    //
    List<Point3d> p = new List<Point3d>();
    List<Point3d> p2 = new List<Point3d>();
    
    foreach(System.Object z in x)
    {
      try
      {
        Rhino.DocObjects.AnnotationObjectBase b = z as Rhino.DocObjects.AnnotationObjectBase;
        Rhino.Geometry.Leader l = b.Geometry as  Rhino.Geometry.Leader;

        BoundingBox bbx = l.GetBoundingBox(false);
        p.Add(l.Plane.Origin);
        Point3d pz = bbx.FurthestPoint(l.Plane.Origin);
        p2.Add(pz);
      }
      catch(Exception){}
    }
    
    
    Origin = p;
    Pointer = p2;
# ---------- end ps__get_leader_endpoints ----------
pt_37 = Point(ps__get_leader_endpoints.Pointer)
pt_38 = Point(ps__get_leader_endpoints.Origin)
ln_13 = Line(StartPoint=pt_37, EndPoint=pt_38)

dpipeline_14 = DynamicGeometryPipeline(
    LayerFilter="FP-TEXT",
    TypeFilter="text",
    NameFilter="*",
    enableFullPath=False,
    GroupByLayer=False,
    GroupByType=False,
    IncludeHidden=True,
    IncludeLocked=True)
data_text = Data(dpipeline_14)
txtobjinfo_3 = TextObjectInfo(TextObjects=data_text)  # -> Plane, Text, Size, Alignment, VerticalAlignment
null_8 = NullItem(Item=txtobjinfo_3.Plane)  # -> NullFlags, InvalidFlags, Description
cull_39 = CullPattern(List=txtobjinfo_3.Plane, CullPattern=invert(null_8.NullFlags))
cull_40 = CullPattern(List=txtobjinfo_3.Text, CullPattern=invert(null_8.NullFlags))

basement_5 = Slider(0, range=-40..200)
level_roof_5 = Slider(570.75, range=0..1000)
level_1_6 = Slider(126, range=0..200)
level_3_6 = Slider(423.375, range=0..1000)
level_2_6 = Slider(294, range=0..1000)
xy_6 = XYPlane(Origin=Point(0, 0, 0))
pt_39 = ConstructPoint(XCoordinate=0, YCoordinate=0, ZCoordinate=xy_6)

dpipeline_15 = DynamicGeometryPipeline(
    LayerFilter="pipemn",
    TypeFilter="Curve",
    NameFilter="*",
    enableFullPath=False,
    GroupByLayer=False,
    GroupByType=False,
    IncludeHidden=True,
    IncludeLocked=True)  # -> flatten(GeometryOut)

dpipeline_16 = DynamicGeometryPipeline(
    LayerFilter="PIPESPC",
    TypeFilter="text",
    NameFilter="*",
    enableFullPath=False,
    GroupByLayer=False,
    GroupByType=False,
    IncludeHidden=True,
    IncludeLocked=True)
data_text_2 = Data(dpipeline_16)
txtobjinfo_4 = TextObjectInfo(TextObjects=data_text_2)  # -> Plane, Text, Size, Alignment, VerticalAlignment
null_9 = NullItem(Item=txtobjinfo_4.Plane)  # -> NullFlags, InvalidFlags, Description
cull_41 = CullPattern(List=txtobjinfo_4.Plane, CullPattern=invert(null_9.NullFlags))
cull_42 = CullPattern(List=txtobjinfo_4.Text, CullPattern=invert(null_9.NullFlags))

translation_vector___do_not_touch_5 = Curve(<curve referenced from the Rhino model>)

line_23 = LineSDL(Start=pt_34, Direction=Vector(0, 0, 1), Length=level_3_3)
move_27 = Move(Geometry=xy_3, Motion=line_23)  # -> Geometry, Transform
# LEVEL 3
movetoplane_7 = MoveToPlane(Geometry=branch_16, Plane=move_27.Geometry, Above=True, Below=True)  # -> Geometry, Transform

dpipeline_17 = DynamicGeometryPipeline(
    LayerFilter="PIPESPC",
    TypeFilter="text",
    NameFilter="*",
    enableFullPath=False,
    GroupByLayer=False,
    GroupByType=False,
    IncludeHidden=True,
    IncludeLocked=True)
data_text_3 = Data(dpipeline_17)
txtobjinfo_5 = TextObjectInfo(TextObjects=data_text_3)  # -> Plane, Text, Size, Alignment, VerticalAlignment
null_10 = NullItem(Item=txtobjinfo_5.Plane)  # -> NullFlags, InvalidFlags, Description
cull_43 = CullPattern(List=txtobjinfo_5.Plane, CullPattern=invert(null_10.NullFlags))
cull_44 = CullPattern(List=txtobjinfo_5.Text, CullPattern=invert(null_10.NullFlags))

line_24 = LineSDL(Start=pt_34, Direction=Vector(0, 0, 1), Length=level_2_3)
move_28 = Move(Geometry=xy_3, Motion=line_24)  # -> Geometry, Transform
movetoplane_8 = MoveToPlane(Geometry=branch_14, Plane=move_28.Geometry, Above=True, Below=True)  # -> Geometry, Transform

line_25 = LineSDL(Start=pt_34, Direction=Vector(0, 0, 1), Length=level_1_3)
move_29 = Move(Geometry=xy_3, Motion=line_25)  # -> Geometry, Transform
# LEVEL 1
movetoplane_9 = MoveToPlane(Geometry=branch_15, Plane=move_29.Geometry, Above=True, Below=True)  # -> Geometry, Transform

# ----
# LEVEL 2
line_26 = LineSDL(Start=pt_35, Direction=Vector(0, 0, 1), Length=level_2_4)
move_30 = Move(Geometry=xy_4, Motion=line_26)  # -> Geometry, Transform
movetoplane_10 = MoveToPlane(Geometry=branch_6, Plane=move_30.Geometry, Above=True, Below=True)  # -> Geometry, Transform

# ----
# LEVEL 3
line_27 = LineSDL(Start=pt_35, Direction=Vector(0, 0, 1), Length=level_3_4)
move_31 = Move(Geometry=xy_4, Motion=line_27)  # -> Geometry, Transform
movetoplane_11 = MoveToPlane(Geometry=branch_7, Plane=move_31.Geometry, Above=True, Below=True)  # -> Geometry, Transform

line_28 = LineSDL(Start=pt_34, Direction=Vector(0, 0, 1), Length=level_0)
move_32 = Move(Geometry=xy_3, Motion=line_28)  # -> Geometry, Transform
# LEVEL 0
movetoplane_12 = MoveToPlane(Geometry=branch_17, Plane=move_32.Geometry, Above=True, Below=True)  # -> Geometry, Transform

crv_34 = Curve(simplify(dpipeline_15))

# ----
# LEVEL 2
line_29 = LineSDL(Start=pt_36, Direction=Vector(0, 0, 1), Length=level_2_5)
move_33 = Move(Geometry=xy_5, Motion=line_29)  # -> Geometry, Transform
movetoplane_13 = MoveToPlane(Geometry=branch_10, Plane=move_33.Geometry, Above=True, Below=True)  # -> Geometry, Transform

# ----
# LEVEL 3
line_30 = LineSDL(Start=pt_36, Direction=Vector(0, 0, 1), Length=level_3_5)
move_34 = Move(Geometry=xy_5, Motion=line_30)  # -> Geometry, Transform
movetoplane_14 = MoveToPlane(Geometry=branch_11, Plane=move_34.Geometry, Above=True, Below=True)  # -> Geometry, Transform

dpipeline_18 = DynamicGeometryPipeline(
    LayerFilter=["F-DRYP-N", "FP WET Line"],
    TypeFilter="Curve",
    NameFilter="*",
    enableFullPath=False,
    GroupByLayer=False,
    GroupByType=False,
    IncludeHidden=True,
    IncludeLocked=True)  # -> flatten(GeometryOut)
dpipeline_19 = DynamicGeometryPipeline(
    LayerFilter="PIPEBL",
    TypeFilter="Curve",
    NameFilter="*",
    enableFullPath=False,
    GroupByLayer=False,
    GroupByType=False,
    IncludeHidden=True,
    IncludeLocked=True)  # -> flatten(GeometryOut)
data_11 = Data(["Floor 0", "Floor 1", "Floor 2", "Floor 3", "Floor 4"])
dpipeline_20 = DynamicGeometryPipeline(
    LayerFilter=data_11,
    TypeFilter="Curve",
    NameFilter="*",
    enableFullPath=False,
    GroupByLayer=False,
    GroupByType=False,
    IncludeHidden=True,
    IncludeLocked=True)

# ----
# SORTING_3
# Curve or Line (run vs symbol)
explode_7 = Explode(Curve=crv_34, Recursive=True)  # -> Segments, Vertices
cp_17 = ControlPoints(Curve=explode_7.Segments)  # -> Points, Weights, Knots
lng_12 = ListLength(List=cp_17.Points)  # -> flatten(Length)
equals_15 = Equality(FirstNumber=lng_12, SecondNumber=9)  # -> Equality, Inequality
cull_45 = CullPattern(List=flatten(explode_7.Segments), CullPattern=equals_15.Equality)
cull_46 = CullPattern(List=flatten(explode_7.Segments), CullPattern=invert(equals_15.Equality))
circle_symbols_6 = Data(cull_45)
line_symbols_5 = Data(cull_46)

crv_35 = Curve(simplify(dpipeline_19))
explode_8 = Explode(Curve=crv_35, Recursive=True)  # -> Segments, Vertices
dpipeline_21 = DynamicGeometryPipeline(
    LayerFilter="headdn",
    TypeFilter="block",
    NameFilter="*",
    enableFullPath=False,
    GroupByLayer=False,
    GroupByType=False,
    IncludeHidden=True,
    IncludeLocked=True)  # -> flatten(GeometryOut)
dpipeline_22 = DynamicGeometryPipeline(
    LayerFilter="HEADUP",
    TypeFilter="block",
    NameFilter="*",
    enableFullPath=False,
    GroupByLayer=False,
    GroupByType=False,
    IncludeHidden=True,
    IncludeLocked=True)  # -> flatten(GeometryOut)
cp_18 = ControlPoints(Curve=explode_8.Segments)  # -> Points, Weights, Knots
all_offset_2 = Slider(0, range=0..200)

# ----
# SORTING_4
# (Riser VS Drop)
cls_6 = Closed(Curve=movetoplane_5.Geometry)  # -> Closed, Periodic
cull_47 = CullPattern(List=movetoplane_5.Geometry, CullPattern=invert(cls_6.Closed))
cull_48 = CullPattern(List=movetoplane_5.Geometry, CullPattern=cls_6.Closed)
cp_19 = ControlPoints(Curve=cull_47)  # -> Points, Weights, Knots
cp_20 = ControlPoints(Curve=cull_48)  # -> Points, Weights, Knots
pline_12 = PolyLine(Vertices=cp_19.Points, Closed=invert(False))
pline_13 = PolyLine(Vertices=cp_20.Points, Closed=invert(False))
pcen_12 = PolygonCenter(Polyline=pline_12)  # -> CenterV, CenterE
pcen_13 = PolygonCenter(Polyline=pline_13)  # -> CenterV, CenterE
risers_curves_6 = Data(cull_48)
drops_curves_6 = Data(cull_47)
pt_40 = Point(pcen_12.CenterE)
pt_41 = Point(pcen_13.CenterE)
drops_points_6 = Data(pt_40)
risers_points_6 = Data(pt_41)

all_offset_3 = Slider(0, range=0..200)

# ----
# SORTING_4
# (Riser VS Drop)
cls_7 = Closed(Curve=movetoplane_6.Geometry)  # -> Closed, Periodic
cull_49 = CullPattern(List=movetoplane_6.Geometry, CullPattern=invert(cls_7.Closed))
cull_50 = CullPattern(List=movetoplane_6.Geometry, CullPattern=cls_7.Closed)
cp_21 = ControlPoints(Curve=cull_49)  # -> Points, Weights, Knots
cp_22 = ControlPoints(Curve=cull_50)  # -> Points, Weights, Knots
pline_14 = PolyLine(Vertices=cp_21.Points, Closed=invert(False))
pline_15 = PolyLine(Vertices=cp_22.Points, Closed=invert(False))
pcen_14 = PolygonCenter(Polyline=pline_14)  # -> CenterV, CenterE
pcen_15 = PolygonCenter(Polyline=pline_15)  # -> CenterV, CenterE
risers_curves_7 = Data(cull_50)
drops_curves_7 = Data(cull_49)
pt_42 = Point(pcen_14.CenterE)
pt_43 = Point(pcen_15.CenterE)
drops_points_7 = Data(pt_42)
risers_points_7 = Data(pt_43)

pt_44 = Point(cull_39)
lng_13 = ListLength(List=cp_18.Points)  # -> flatten(Length)
blockexplode = ExplodeBlocks(BlockObjects=dpipeline_21, explodeGeom=True)  # -> Geometry, Attributes, BlockName, BoundingBox, BlockTransform
blockexplode_2 = ExplodeBlocks(BlockObjects=dpipeline_22, explodeGeom=True)  # -> Geometry, Attributes, BlockName, BoundingBox, BlockTransform
equals_16 = Equality(FirstNumber=lng_13, SecondNumber=9)  # -> Equality, Inequality
cull_51 = CullPattern(List=flatten(explode_8.Segments), CullPattern=equals_16.Equality)
cull_52 = CullPattern(List=flatten(explode_8.Segments), CullPattern=invert(equals_16.Equality))
item_17 = ListItem(List=simplify(blockexplode.Geometry), Index=all_offset_2, Wrap=True)
item_18 = ListItem(List=simplify(blockexplode_2.Geometry), Index=all_offset_3, Wrap=True)

pt_45 = Point(cull_41)

curvepoint_6 = PointOnCurve(ln_13, parameter=0.5)
incurves_6 = PointInCurves(Point=curvepoint_6, Curves=simplify(dpipeline_20))  # -> Relationship, Index, Point
crv_36 = Curve(simplify(ln_13))
equals_17 = Equality(FirstNumber=incurves_6.Relationship, SecondNumber=2)  # -> Equality, Inequality
cull_53 = CullPattern(List=crv_36, CullPattern=equals_17.Equality)  # -> simplify(List)
viewer_5 = ParamViewer(cull_53)
branch_19 = TreeBranch(Tree=cull_53, Path=Slider(3, range=0..10), MaintainPaths=True)  # -> flatten(Branch)
branch_20 = TreeBranch(Tree=cull_53, Path=Slider(2, range=0..10), MaintainPaths=True)  # -> flatten(Branch)
branch_21 = TreeBranch(Tree=cull_53, Path=Slider(1, range=0..10), MaintainPaths=True)  # -> flatten(Branch)

pt_46 = Point(cull_43)

# ----
# SORTING_4
# (Riser VS Drop)
cls_8 = Closed(Curve=movetoplane_10.Geometry)  # -> Closed, Periodic
cull_54 = CullPattern(List=movetoplane_10.Geometry, CullPattern=invert(cls_8.Closed))
cull_55 = CullPattern(List=movetoplane_10.Geometry, CullPattern=cls_8.Closed)
cp_23 = ControlPoints(Curve=cull_54)  # -> Points, Weights, Knots
cp_24 = ControlPoints(Curve=cull_55)  # -> Points, Weights, Knots
pline_16 = PolyLine(Vertices=cp_23.Points, Closed=invert(False))
pline_17 = PolyLine(Vertices=cp_24.Points, Closed=invert(False))
pcen_16 = PolygonCenter(Polyline=pline_16)  # -> CenterV, CenterE
pcen_17 = PolygonCenter(Polyline=pline_17)  # -> CenterV, CenterE
risers_curves_8 = Data(cull_55)
drops_curves_8 = Data(cull_54)
pt_47 = Point(pcen_16.CenterE)
pt_48 = Point(pcen_17.CenterE)
drops_points_8 = Data(pt_47)
risers_points_8 = Data(pt_48)

# ----
# SORTING_4
# (Riser VS Drop)
cls_9 = Closed(Curve=movetoplane_11.Geometry)  # -> Closed, Periodic
cull_56 = CullPattern(List=movetoplane_11.Geometry, CullPattern=invert(cls_9.Closed))
cull_57 = CullPattern(List=movetoplane_11.Geometry, CullPattern=cls_9.Closed)
cp_25 = ControlPoints(Curve=cull_56)  # -> Points, Weights, Knots
cp_26 = ControlPoints(Curve=cull_57)  # -> Points, Weights, Knots
pline_18 = PolyLine(Vertices=cp_25.Points, Closed=invert(False))
pline_19 = PolyLine(Vertices=cp_26.Points, Closed=invert(False))
pcen_18 = PolygonCenter(Polyline=pline_18)  # -> CenterV, CenterE
pcen_19 = PolygonCenter(Polyline=pline_19)  # -> CenterV, CenterE
risers_curves_9 = Data(cull_57)
drops_curves_9 = Data(cull_56)
pt_49 = Point(pcen_18.CenterE)
pt_50 = Point(pcen_19.CenterE)
drops_points_9 = Data(pt_49)
risers_points_9 = Data(pt_50)

crv_37 = Curve(movetoplane_12.Geometry)
cp_27 = ControlPoints(Curve=crv_37)  # -> Points, Weights, Knots
pline_20 = PolyLine(Vertices=cp_27.Points, Closed=invert(False))
pcen_20 = PolygonCenter(Polyline=pline_20)  # -> CenterV, CenterE
pt_51 = Point(pcen_20.CenterE)

ps__convert_number = CSharpScript(x=cull_40)  # -> out, A; inputs x: list of String
# ---------- ps__convert_number: C# ----------
    List<double> dists = new List<double>();

    foreach(string s in x)
    {
      string n = "";
      for(int i = 0; i <= s.Length - 1; i++)
      {
        if(Char.IsDigit(s, i))
        {
          n += s[i];
        }
      }

      char [] split = n.ToCharArray();

      if(split.Length == 0)
      {
        Print("fail");
        double d = 2.0;
        dists.Add(d);
      }
      else
      {

        double d = (double) Char.GetNumericValue(split[0]);

        if(split.Length == 3)
        {
          d = d + (double) Char.GetNumericValue(split[1])
            / (double) Char.GetNumericValue(split[2]);
        }

        dists.Add(d);
      }


      //   Print(d.ToString());
    }

    A = dists;
# ---------- end ps__convert_number ----------

incurves_7 = PointInCurves(Point=pt_44, Curves=simplify(dpipeline_20))  # -> Relationship, Index, Point
equals_18 = Equality(FirstNumber=incurves_7.Relationship, SecondNumber=2)  # -> Equality, Inequality
cull_58 = CullPattern(List=pt_44, CullPattern=equals_18.Equality)  # -> simplify(List)
cull_59 = CullPattern(List=ps__convert_number.A, CullPattern=equals_18.Equality)  # -> simplify(List)
viewer_6 = ParamViewer(cull_59)
number_slider = Slider(3, range=0..10)
number_slider_2 = Slider(2, range=0..10)
number_slider_3 = Slider(1, range=0..10)
branch_22 = TreeBranch(Tree=cull_58, Path=number_slider, MaintainPaths=True)  # -> flatten(Branch)
branch_23 = TreeBranch(Tree=cull_59, Path=number_slider_2, MaintainPaths=True)  # -> flatten(Branch)
branch_24 = TreeBranch(Tree=cull_59, Path=number_slider, MaintainPaths=True)  # -> flatten(Branch)
branch_25 = TreeBranch(Tree=cull_58, Path=number_slider_3, MaintainPaths=True)  # -> flatten(Branch)
branch_26 = TreeBranch(Tree=cull_58, Path=number_slider_2, MaintainPaths=True)  # -> flatten(Branch)
branch_27 = TreeBranch(Tree=cull_59, Path=number_slider_3, MaintainPaths=True)  # -> flatten(Branch)

circle_symbols_7 = Data(cull_51)
ps__convert_number_2 = CSharpScript(x=cull_42)  # -> out, A; inputs x: list of String; same code as ps__convert_number

# ----
# SORTING_4
# (Riser VS Drop)
cls_10 = Closed(Curve=movetoplane_13.Geometry)  # -> Closed, Periodic
cull_60 = CullPattern(List=movetoplane_13.Geometry, CullPattern=invert(cls_10.Closed))
cull_61 = CullPattern(List=movetoplane_13.Geometry, CullPattern=cls_10.Closed)
cp_28 = ControlPoints(Curve=cull_60)  # -> Points, Weights, Knots
cp_29 = ControlPoints(Curve=cull_61)  # -> Points, Weights, Knots
pline_21 = PolyLine(Vertices=cp_28.Points, Closed=invert(False))
pline_22 = PolyLine(Vertices=cp_29.Points, Closed=invert(False))
pcen_21 = PolygonCenter(Polyline=pline_21)  # -> CenterV, CenterE
pcen_22 = PolygonCenter(Polyline=pline_22)  # -> CenterV, CenterE
risers_curves_10 = Data(cull_61)
drops_curves_10 = Data(cull_60)
pt_52 = Point(pcen_21.CenterE)
pt_53 = Point(pcen_22.CenterE)
drops_points_10 = Data(pt_52)
risers_points_10 = Data(pt_53)

# ----
# SORTING_4
# (Riser VS Drop)
cls_11 = Closed(Curve=movetoplane_14.Geometry)  # -> Closed, Periodic
cull_62 = CullPattern(List=movetoplane_14.Geometry, CullPattern=invert(cls_11.Closed))
cull_63 = CullPattern(List=movetoplane_14.Geometry, CullPattern=cls_11.Closed)
cp_30 = ControlPoints(Curve=cull_62)  # -> Points, Weights, Knots
cp_31 = ControlPoints(Curve=cull_63)  # -> Points, Weights, Knots
pline_23 = PolyLine(Vertices=cp_30.Points, Closed=invert(False))
pline_24 = PolyLine(Vertices=cp_31.Points, Closed=invert(False))
pcen_23 = PolygonCenter(Polyline=pline_23)  # -> CenterV, CenterE
pcen_24 = PolygonCenter(Polyline=pline_24)  # -> CenterV, CenterE
risers_curves_11 = Data(cull_63)
drops_curves_11 = Data(cull_62)
pt_54 = Point(pcen_23.CenterE)
pt_55 = Point(pcen_24.CenterE)
drops_points_11 = Data(pt_54)
risers_points_11 = Data(pt_55)

line_symbols_6 = Data(cull_52)

crv_38 = Curve(movetoplane_7.Geometry)
cp_32 = ControlPoints(Curve=crv_38)  # -> Points, Weights, Knots
pline_25 = PolyLine(Vertices=cp_32.Points, Closed=invert(False))
pcen_25 = PolygonCenter(Polyline=pline_25)  # -> CenterV, CenterE
pt_56 = Point(pcen_25.CenterE)

ps__convert_number_3 = CSharpScript(x=cull_44)  # -> out, A; inputs x: list of String; same code as ps__convert_number
crv_39 = Curve(flatten(item_17))
crv_40 = Curve(flatten(item_18))

crv_41 = Curve(movetoplane_9.Geometry)
cp_33 = ControlPoints(Curve=crv_41)  # -> Points, Weights, Knots
pline_26 = PolyLine(Vertices=cp_33.Points, Closed=invert(False))
pcen_26 = PolygonCenter(Polyline=pline_26)  # -> CenterV, CenterE
pt_57 = Point(pcen_26.CenterE)

crv_42 = Curve(movetoplane_8.Geometry)
cp_34 = ControlPoints(Curve=crv_42)  # -> Points, Weights, Knots
pline_27 = PolyLine(Vertices=cp_34.Points, Closed=invert(False))
pcen_27 = PolygonCenter(Polyline=pline_27)  # -> CenterV, CenterE
pt_58 = Point(pcen_27.CenterE)

preview = CustomPreview(
    Geometry=item_17,
    Shader={ambient=RGB(0, 0, 0), diffuse=RGB(255, 105, 180), emission=RGB(76, 32, 54), shine=0.5, specular=RGB(255, 255, 255), transparency=0})
preview_2 = CustomPreview(
    Geometry=item_18,
    Shader={ambient=RGB(0, 0, 0), diffuse=RGB(255, 105, 180), emission=RGB(76, 32, 54), shine=0.5, specular=RGB(255, 255, 255), transparency=0})
darc = DeconstructArc(Arc=crv_39)  # -> BasePlane, Radius, Angle
darc_2 = DeconstructArc(Arc=crv_40)  # -> BasePlane, Radius, Angle

# ----
# SORTING_4
# (Riser VS Drop)
cls_12 = Closed(Curve=circle_symbols_7)  # -> Closed, Periodic
cull_64 = CullPattern(List=circle_symbols_7, CullPattern=invert(cls_12.Closed))
cull_65 = CullPattern(List=circle_symbols_7, CullPattern=cls_12.Closed)
cp_35 = ControlPoints(Curve=cull_64)  # -> Points, Weights, Knots
cp_36 = ControlPoints(Curve=cull_65)  # -> Points, Weights, Knots
pline_28 = PolyLine(Vertices=cp_35.Points, Closed=invert(False))
pline_29 = PolyLine(Vertices=cp_36.Points, Closed=invert(False))
pcen_28 = PolygonCenter(Polyline=pline_28)  # -> CenterV, CenterE
risers_curves_12 = Data(cull_65)
pcen_29 = PolygonCenter(Polyline=pline_29)  # -> CenterV, CenterE
drops_curves_12 = Data(cull_64)
pt_59 = Point(pcen_28.CenterE)
pt_60 = Point(pcen_29.CenterE)
drops_points_12 = Data(pt_59)
risers_points_12 = Data(pt_60)

# ----
# SORTING_4
# (Riser VS Drop)
cls_13 = Closed(Curve=circle_symbols_6)  # -> Closed, Periodic
cull_66 = CullPattern(List=circle_symbols_6, CullPattern=invert(cls_13.Closed))
cull_67 = CullPattern(List=circle_symbols_6, CullPattern=cls_13.Closed)
cp_37 = ControlPoints(Curve=cull_66)  # -> Points, Weights, Knots
cp_38 = ControlPoints(Curve=cull_67)  # -> Points, Weights, Knots
pline_30 = PolyLine(Vertices=cp_37.Points, Closed=invert(False))
pline_31 = PolyLine(Vertices=cp_38.Points, Closed=invert(False))
pcen_30 = PolygonCenter(Polyline=pline_30)  # -> CenterV, CenterE
pcen_31 = PolygonCenter(Polyline=pline_31)  # -> CenterV, CenterE
risers_curves_13 = Data(cull_67)
drops_curves_13 = Data(cull_66)
pt_61 = Point(pcen_30.CenterE)
pt_62 = Point(pcen_31.CenterE)
drops_points_13 = Data(pt_61)
risers_points_13 = Data(pt_62)

null_11 = NullItem(Item=darc.BasePlane)  # -> NullFlags, InvalidFlags, Description
panel_33 = Panel(ps__convert_number_2.A)
null_12 = NullItem(Item=darc_2.BasePlane)  # -> NullFlags, InvalidFlags, Description
panel_34 = Panel(ps__convert_number_3.A)
# PIPES FP_WET
curvepoint_7 = PointOnCurve(dpipeline_18, parameter=0.5)
offset_12 = Slider(140, range=0..200)
cull_68 = CullPattern(List=darc.BasePlane, CullPattern=invert(null_11.NullFlags))
cull_69 = CullPattern(List=darc_2.BasePlane, CullPattern=invert(null_12.NullFlags))

# ----
# Offset from Level
offset_13 = Slider(149, range=0..200)
geo_31 = Geometry(risers_points_6)
pt_63 = ConstructPoint(XCoordinate=0, YCoordinate=0, ZCoordinate=0)
Z_12 = UnitZ(Factor=1)
line_31 = LineSDL(Start=pt_63, Direction=Z_12, Length=offset_13)
move_35 = Move(Geometry=geo_31, Motion=line_31)  # -> Geometry, Transform
geo_32 = Geometry(move_35.Geometry)

pt_64 = Point(cull_68)

# ----
# Offset from Level
offset_14 = Slider(123, range=0..200)
geo_33 = Geometry(risers_points_6)
pt_65 = ConstructPoint(XCoordinate=0, YCoordinate=0, ZCoordinate=0)
Z_13 = UnitZ(Factor=1)
line_32 = LineSDL(Start=pt_65, Direction=Z_13, Length=offset_14)
move_36 = Move(Geometry=geo_33, Motion=line_32)  # -> Geometry, Transform
geo_34 = Geometry(move_36.Geometry)

pt_66 = Point(cull_69)
incurves_8 = PointInCurves(Point=curvepoint_7, Curves=simplify(dpipeline_20))  # -> Relationship, Index, Point

# ----
# Offset from Level
offset_15 = Slider(149, range=0..200)
geo_35 = Geometry(risers_points_7)
pt_67 = ConstructPoint(XCoordinate=0, YCoordinate=0, ZCoordinate=0)
Z_14 = UnitZ(Factor=1)
line_33 = LineSDL(Start=pt_67, Direction=Z_14, Length=offset_15)
move_37 = Move(Geometry=geo_35, Motion=line_33)  # -> Geometry, Transform
geo_36 = Geometry(move_37.Geometry)

# ----
# Offset from Level
offset_16 = Slider(123, range=0..200)
geo_37 = Geometry(risers_points_7)
pt_68 = ConstructPoint(XCoordinate=0, YCoordinate=0, ZCoordinate=0)
Z_15 = UnitZ(Factor=1)
line_34 = LineSDL(Start=pt_68, Direction=Z_15, Length=offset_16)
move_38 = Move(Geometry=geo_37, Motion=line_34)  # -> Geometry, Transform
geo_38 = Geometry(move_38.Geometry)

offset_17 = Slider(104, range=0..200)
equals_19 = Equality(FirstNumber=incurves_8.Relationship, SecondNumber=2)  # -> Equality, Inequality
crv_43 = Curve(simplify(dpipeline_18))
data_12 = Data(branch_26)

# ----
# Offset from Level
geo_39 = Geometry(pt_51)
pt_69 = ConstructPoint(XCoordinate=0, YCoordinate=0, ZCoordinate=0)
Z_16 = UnitZ(Factor=1)
line_35 = LineSDL(Start=pt_69, Direction=Z_16, Length=offset_12)
move_39 = Move(Geometry=geo_39, Motion=line_35)  # -> Geometry, Transform
geo_40 = Geometry(move_39.Geometry)

# ----
# Offset from Level
offset_18 = Slider(134, range=0..200)
geo_41 = Geometry(pt_64)
pt_70 = ConstructPoint(XCoordinate=0, YCoordinate=0, ZCoordinate=0)
Z_17 = UnitZ(Factor=1)
line_36 = LineSDL(Start=pt_70, Direction=Z_17, Length=offset_18)
move_40 = Move(Geometry=geo_41, Motion=line_36)  # -> Geometry, Transform
geo_42 = Geometry(move_40.Geometry)

# ----
# Offset from Level
offset_19 = Slider(134, range=0..200)
geo_43 = Geometry(pt_66)
pt_71 = ConstructPoint(XCoordinate=0, YCoordinate=0, ZCoordinate=0)
Z_18 = UnitZ(Factor=1)
line_37 = LineSDL(Start=pt_71, Direction=Z_18, Length=offset_19)
move_41 = Move(Geometry=geo_43, Motion=line_37)  # -> Geometry, Transform
geo_44 = Geometry(move_41.Geometry)

# ----
# Offset from Level
offset_20 = Slider(140, range=0..200)
geo_45 = Geometry(pt_64)
pt_72 = ConstructPoint(XCoordinate=0, YCoordinate=0, ZCoordinate=0)
Z_19 = UnitZ(Factor=1)
line_38 = LineSDL(Start=pt_72, Direction=Z_19, Length=offset_20)
move_42 = Move(Geometry=geo_45, Motion=line_38)  # -> Geometry, Transform
geo_46 = Geometry(move_42.Geometry)

# ----
# Offset from Level
offset_21 = Slider(140, range=0..200)
geo_47 = Geometry(pt_66)
pt_73 = ConstructPoint(XCoordinate=0, YCoordinate=0, ZCoordinate=0)
Z_20 = UnitZ(Factor=1)
line_39 = LineSDL(Start=pt_73, Direction=Z_20, Length=offset_21)
move_43 = Move(Geometry=geo_47, Motion=line_39)  # -> Geometry, Transform
geo_48 = Geometry(move_43.Geometry)

# ----
# Offset from Level
geo_49 = Geometry(pt_57)
pt_74 = ConstructPoint(XCoordinate=0, YCoordinate=0, ZCoordinate=0)
Z_21 = UnitZ(Factor=1)
line_40 = LineSDL(Start=pt_74, Direction=Z_21, Length=offset_17)
move_44 = Move(Geometry=geo_49, Motion=line_40)  # -> Geometry, Transform
geo_50 = Geometry(move_44.Geometry)

# ----
# Offset from Level
offset_22 = Slider(118, range=0..300)
geo_51 = Geometry(risers_points_8)
pt_75 = ConstructPoint(XCoordinate=0, YCoordinate=0, ZCoordinate=0)
Z_22 = UnitZ(Factor=1)
line_41 = LineSDL(Start=pt_75, Direction=Z_22, Length=offset_22)
move_45 = Move(Geometry=geo_51, Motion=line_41)  # -> Geometry, Transform
geo_52 = Geometry(move_45.Geometry)

# ----
# Offset from Level
geo_53 = Geometry(pt_56)
pt_76 = ConstructPoint(XCoordinate=0, YCoordinate=0, ZCoordinate=0)
Z_23 = UnitZ(Factor=1)
line_42 = LineSDL(Start=pt_76, Direction=Z_23, Length=offset_17)
move_46 = Move(Geometry=geo_53, Motion=line_42)  # -> Geometry, Transform
geo_54 = Geometry(move_46.Geometry)

# ----
# Offset from Level
offset_23 = Slider(111, range=0..300)
geo_55 = Geometry(risers_points_8)
pt_77 = ConstructPoint(XCoordinate=0, YCoordinate=0, ZCoordinate=0)
Z_24 = UnitZ(Factor=1)
line_43 = LineSDL(Start=pt_77, Direction=Z_24, Length=offset_23)
move_47 = Move(Geometry=geo_55, Motion=line_43)  # -> Geometry, Transform
geo_56 = Geometry(move_47.Geometry)

# ----
# Offset from Level
geo_57 = Geometry(pt_58)
pt_78 = ConstructPoint(XCoordinate=0, YCoordinate=0, ZCoordinate=0)
Z_25 = UnitZ(Factor=1)
line_44 = LineSDL(Start=pt_78, Direction=Z_25, Length=offset_17)
move_48 = Move(Geometry=geo_57, Motion=line_44)  # -> Geometry, Transform
geo_58 = Geometry(move_48.Geometry)

# ----
# Offset from Level
geo_59 = Geometry(risers_points_9)
pt_79 = ConstructPoint(XCoordinate=0, YCoordinate=0, ZCoordinate=0)
Z_26 = UnitZ(Factor=1)
line_45 = LineSDL(Start=pt_79, Direction=Z_26, Length=offset_22)
move_49 = Move(Geometry=geo_59, Motion=line_45)  # -> Geometry, Transform
geo_60 = Geometry(move_49.Geometry)

cull_70 = CullPattern(List=crv_43, CullPattern=equals_19.Equality)

# ----
# Offset from Level
geo_61 = Geometry(risers_points_9)
pt_80 = ConstructPoint(XCoordinate=0, YCoordinate=0, ZCoordinate=0)
Z_27 = UnitZ(Factor=1)
line_46 = LineSDL(Start=pt_80, Direction=Z_27, Length=offset_23)
move_50 = Move(Geometry=geo_61, Motion=line_46)  # -> Geometry, Transform
geo_62 = Geometry(move_50.Geometry)

# ----
# Offset from Level
offset_24 = Slider(118, range=0..300)
geo_63 = Geometry(risers_points_10)
pt_81 = ConstructPoint(XCoordinate=0, YCoordinate=0, ZCoordinate=0)
Z_28 = UnitZ(Factor=1)
line_47 = LineSDL(Start=pt_81, Direction=Z_28, Length=offset_24)
move_51 = Move(Geometry=geo_63, Motion=line_47)  # -> Geometry, Transform
geo_64 = Geometry(move_51.Geometry)

# ----
# Offset from Level
offset_25 = Slider(111, range=0..300)
geo_65 = Geometry(risers_points_10)
pt_82 = ConstructPoint(XCoordinate=0, YCoordinate=0, ZCoordinate=0)
Z_29 = UnitZ(Factor=1)
line_48 = LineSDL(Start=pt_82, Direction=Z_29, Length=offset_25)
move_52 = Move(Geometry=geo_65, Motion=line_48)  # -> Geometry, Transform
geo_66 = Geometry(move_52.Geometry)

# ----
# Offset from Level
geo_67 = Geometry(risers_points_11)
pt_83 = ConstructPoint(XCoordinate=0, YCoordinate=0, ZCoordinate=0)
Z_30 = UnitZ(Factor=1)
line_49 = LineSDL(Start=pt_83, Direction=Z_30, Length=offset_24)
move_53 = Move(Geometry=geo_67, Motion=line_49)  # -> Geometry, Transform
geo_68 = Geometry(move_53.Geometry)

# ----
# Offset from Level
geo_69 = Geometry(risers_points_11)
pt_84 = ConstructPoint(XCoordinate=0, YCoordinate=0, ZCoordinate=0)
Z_31 = UnitZ(Factor=1)
line_50 = LineSDL(Start=pt_84, Direction=Z_31, Length=offset_25)
move_54 = Move(Geometry=geo_69, Motion=line_50)  # -> Geometry, Transform
geo_70 = Geometry(move_54.Geometry)

viewer_7 = ParamViewer(cull_70)

# ----
# Offset from Level
offset_26 = Slider(170, range=0..200)
geo_71 = Geometry(risers_points_12)
pt_85 = ConstructPoint(XCoordinate=0, YCoordinate=0, ZCoordinate=0)
Z_32 = UnitZ(Factor=1)
line_51 = LineSDL(Start=pt_85, Direction=Z_32, Length=offset_26)
move_55 = Move(Geometry=geo_71, Motion=line_51)  # -> Geometry, Transform
geo_72 = Geometry(move_55.Geometry)

# ----
# Offset from Level
offset_27 = Slider(140, range=0..200)
geo_73 = Geometry(risers_points_12)
pt_86 = ConstructPoint(XCoordinate=0, YCoordinate=0, ZCoordinate=0)
Z_33 = UnitZ(Factor=1)
line_52 = LineSDL(Start=pt_86, Direction=Z_33, Length=offset_27)
move_56 = Move(Geometry=geo_73, Motion=line_52)  # -> Geometry, Transform
geo_74 = Geometry(move_56.Geometry)

# ----
# Offset from Level
offset_28 = Slider(106, range=0..200)
geo_75 = Geometry(line_symbols_6)
pt_87 = ConstructPoint(XCoordinate=0, YCoordinate=0, ZCoordinate=0)
Z_34 = UnitZ(Factor=1)
addition = Addition(A=offset_27)
line_53 = LineSDL(Start=pt_87, Direction=Z_34, Length=addition)
move_57 = Move(Geometry=geo_75, Motion=line_53)  # -> Geometry, Transform
geo_76 = Geometry(move_57.Geometry)

branch_28 = TreeBranch(Tree=cull_70, Path=Slider(2, range=0..10), MaintainPaths=True)  # -> flatten(Branch)
branch_29 = TreeBranch(Tree=cull_70, Path=Slider(3, range=0..10), MaintainPaths=True)  # -> flatten(Branch)
branch_30 = TreeBranch(Tree=cull_70, Path=Slider(1, range=0..10), MaintainPaths=True)  # -> flatten(Branch)

# ----
# Offset from Level
offset_29 = Slider(170, range=0..200)
geo_77 = Geometry(risers_points_13)
pt_88 = ConstructPoint(XCoordinate=0, YCoordinate=0, ZCoordinate=0)
Z_35 = UnitZ(Factor=1)
line_54 = LineSDL(Start=pt_88, Direction=Z_35, Length=offset_29)
move_58 = Move(Geometry=geo_77, Motion=line_54)  # -> Geometry, Transform
geo_78 = Geometry(move_58.Geometry)

# ----
# Offset from Level
offset_30 = Slider(140, range=0..200)
geo_79 = Geometry(risers_points_13)
pt_89 = ConstructPoint(XCoordinate=0, YCoordinate=0, ZCoordinate=0)
Z_36 = UnitZ(Factor=1)
line_55 = LineSDL(Start=pt_89, Direction=Z_36, Length=offset_30)
move_59 = Move(Geometry=geo_79, Motion=line_55)  # -> Geometry, Transform
geo_80 = Geometry(move_59.Geometry)

# ----
# Offset from Level
offset_31 = Slider(106, range=0..200)
geo_81 = Geometry(line_symbols_5)
pt_90 = ConstructPoint(XCoordinate=0, YCoordinate=0, ZCoordinate=0)
Z_37 = UnitZ(Factor=1)
addition_2 = Addition(A=offset_30)
line_56 = LineSDL(Start=pt_90, Direction=Z_37, Length=addition_2)
move_60 = Move(Geometry=geo_81, Motion=line_56)  # -> Geometry, Transform
geo_82 = Geometry(move_60.Geometry)

line_57 = LineSDL(Start=pt_39, Direction=Vector(0, 0, 1), Length=level_3_6)
move_61 = Move(Geometry=xy_6, Motion=line_57)  # -> Geometry, Transform
movetoplane_15 = MoveToPlane(Geometry=branch_29, Plane=move_61.Geometry, Above=True, Below=True)  # -> Geometry, Transform

ln_14 = Line(StartPoint=geo_32, EndPoint=geo_34)
pt_91 = Point(geo_34)
addition_3 = Addition(A=offset_27)

# ----
# Offset from Level
geo_83 = Geometry(drops_points_12)
pt_92 = ConstructPoint(XCoordinate=0, YCoordinate=0, ZCoordinate=0)
Z_38 = UnitZ(Factor=1)
line_58 = LineSDL(Start=pt_92, Direction=Z_38, Length=addition_3)
move_62 = Move(Geometry=geo_83, Motion=line_58)  # -> Geometry, Transform
geo_84 = Geometry(move_62.Geometry)

line_59 = LineSDL(Start=pt_39, Direction=Vector(0, 0, 1), Length=level_2_6)
move_63 = Move(Geometry=xy_6, Motion=line_59)  # -> Geometry, Transform
# LEVEL 2
movetoplane_16 = MoveToPlane(Geometry=branch_28, Plane=move_63.Geometry, Above=True, Below=True)  # -> Geometry, Transform

ln_15 = Line(StartPoint=geo_36, EndPoint=geo_38)
pt_93 = Point(geo_38)
addition_4 = Addition(A=offset_30)

# ----
# Offset from Level
geo_85 = Geometry(drops_points_13)
pt_94 = ConstructPoint(XCoordinate=0, YCoordinate=0, ZCoordinate=0)
Z_39 = UnitZ(Factor=1)
line_60 = LineSDL(Start=pt_94, Direction=Z_39, Length=addition_4)
move_64 = Move(Geometry=geo_85, Motion=line_60)  # -> Geometry, Transform
geo_86 = Geometry(move_64.Geometry)

pt_95 = Point(geo_40)
pt_96 = Point(geo_54)

line_61 = LineSDL(Start=pt_39, Direction=Vector(0, 0, 1), Length=level_1_6)
move_65 = Move(Geometry=xy_6, Motion=line_61)  # -> Geometry, Transform
# LEVEL 1
movetoplane_17 = MoveToPlane(Geometry=branch_30, Plane=move_65.Geometry, Above=True, Below=True)  # -> Geometry, Transform

pt_97 = Point(geo_58)
pt_98 = Point(geo_50)
ln_16 = Line(StartPoint=geo_46, EndPoint=geo_42)
ln_17 = Line(StartPoint=geo_48, EndPoint=geo_44)
pt_99 = Point(geo_42)
pt_100 = Point(geo_44)
crv_44 = Curve(ln_16)
crv_45 = Curve(ln_17)

# ----
# SORTING_3
# Curve or Line (run vs symbol)
explode_9 = Explode(Curve=movetoplane_15.Geometry, Recursive=True)  # -> Segments, Vertices
cp_39 = ControlPoints(Curve=explode_9.Segments)  # -> Points, Weights, Knots
lng_14 = ListLength(List=cp_39.Points)  # -> flatten(Length)
equals_20 = Equality(FirstNumber=lng_14, SecondNumber=9)  # -> Equality, Inequality
cull_71 = CullPattern(List=flatten(explode_9.Segments), CullPattern=equals_20.Equality)
# LEVEL 3
cull_72 = CullPattern(List=flatten(explode_9.Segments), CullPattern=invert(equals_20.Equality))
circle_symbols_8 = Data(cull_71)
line_symbols_7 = Data(cull_72)

pt_101 = Point(geo_56)
pt_102 = Point(geo_62)

# ----
# SORTING_3
# Curve or Line (run vs symbol)
explode_10 = Explode(Curve=movetoplane_16.Geometry, Recursive=True)  # -> Segments, Vertices
cp_40 = ControlPoints(Curve=explode_10.Segments)  # -> Points, Weights, Knots
lng_15 = ListLength(List=cp_40.Points)  # -> flatten(Length)
equals_21 = Equality(FirstNumber=lng_15, SecondNumber=9)  # -> Equality, Inequality
cull_73 = CullPattern(List=flatten(explode_10.Segments), CullPattern=equals_21.Equality)
cull_74 = CullPattern(List=flatten(explode_10.Segments), CullPattern=invert(equals_21.Equality))
circle_symbols_9 = Data(cull_73)
line_symbols_8 = Data(cull_74)

pt_103 = Point(geo_66)
pt_104 = Point(geo_70)
ln_18 = Line(StartPoint=geo_52, EndPoint=geo_56)
ln_19 = Line(StartPoint=geo_60, EndPoint=geo_62)

# ----
# SORTING_3
# Curve or Line (run vs symbol)
explode_11 = Explode(Curve=crv_43, Recursive=True)  # -> Segments, Vertices
cp_41 = ControlPoints(Curve=explode_11.Segments)  # -> Points, Weights, Knots
lng_16 = ListLength(List=cp_41.Points)  # -> flatten(Length)
equals_22 = Equality(FirstNumber=lng_16, SecondNumber=9)  # -> Equality, Inequality
cull_75 = CullPattern(List=flatten(explode_11.Segments), CullPattern=equals_22.Equality)
cull_76 = CullPattern(List=flatten(explode_11.Segments), CullPattern=invert(equals_22.Equality))
circle_symbols_10 = Data(cull_75)
line_symbols_9 = Data(cull_76)

geo_87 = Geometry(pt_99)
crv_46 = Curve(<curve referenced from the Rhino model>)
pt_105 = ConstructPoint(XCoordinate=0, YCoordinate=0, ZCoordinate=0)
Y_5 = UnitY(Factor=1)
len_9 = Length(Curve=crv_46)
multiplication_5 = Multiplication(A=len_9, B=Slider(0, range=0..10))
neg_5 = Negative(Value=multiplication_5)
line_62 = LineSDL(Start=pt_105, Direction=Y_5, Length=neg_5)
move_66 = Move(Geometry=geo_87, Motion=line_62)  # -> Geometry, Transform
geo_88 = Geometry(move_66.Geometry)

geo_89 = Geometry(pt_100)
crv_47 = Curve(<curve referenced from the Rhino model>)
pt_106 = ConstructPoint(XCoordinate=0, YCoordinate=0, ZCoordinate=0)
Y_6 = UnitY(Factor=1)
len_10 = Length(Curve=crv_47)
multiplication_6 = Multiplication(A=len_10, B=Slider(0, range=0..10))
neg_6 = Negative(Value=multiplication_6)
line_63 = LineSDL(Start=pt_106, Direction=Y_6, Length=neg_6)
move_67 = Move(Geometry=geo_89, Motion=line_63)  # -> Geometry, Transform
geo_90 = Geometry(move_67.Geometry)

geo_91 = Geometry(crv_44)
crv_48 = Curve(<curve referenced from the Rhino model>)
pt_107 = ConstructPoint(XCoordinate=0, YCoordinate=0, ZCoordinate=0)
Y_7 = UnitY(Factor=1)
len_11 = Length(Curve=crv_48)
multiplication_7 = Multiplication(A=len_11, B=Slider(0, range=0..10))
neg_7 = Negative(Value=multiplication_7)
line_64 = LineSDL(Start=pt_107, Direction=Y_7, Length=neg_7)
move_68 = Move(Geometry=geo_91, Motion=line_64)  # -> Geometry, Transform
geo_92 = Geometry(move_68.Geometry)

geo_93 = Geometry(crv_45)
crv_49 = Curve(<curve referenced from the Rhino model>)
pt_108 = ConstructPoint(XCoordinate=0, YCoordinate=0, ZCoordinate=0)
Y_8 = UnitY(Factor=1)
len_12 = Length(Curve=crv_49)
multiplication_8 = Multiplication(A=len_12, B=Slider(0, range=0..10))
neg_8 = Negative(Value=multiplication_8)
line_65 = LineSDL(Start=pt_108, Direction=Y_8, Length=neg_8)
move_69 = Move(Geometry=geo_93, Motion=line_65)  # -> Geometry, Transform
geo_94 = Geometry(move_69.Geometry)

ln_20 = Line(StartPoint=geo_64, EndPoint=geo_66)
ln_21 = Line(StartPoint=geo_68, EndPoint=geo_70)
pt_109 = Point(pt_95)
ln_22 = Line(StartPoint=geo_72, EndPoint=geo_74)
ln_23 = Line(StartPoint=geo_78, EndPoint=geo_80)
data_13 = Data(pt_46)
data_14 = Data(ps__convert_number_3.A)
data_15 = Data(pt_45)
data_16 = Data(ps__convert_number_2.A)
crv_50 = Curve(ln_18)
crv_51 = Curve(ln_19)
crv_52 = Curve(ln_14)
crv_53 = Curve(ln_20)
crv_54 = Curve(ln_21)
crv_55 = Curve(ln_15)

# ----
# SORTING_4
# (Riser VS Drop)
cls_14 = Closed(Curve=circle_symbols_8)  # -> Closed, Periodic
cull_77 = CullPattern(List=circle_symbols_8, CullPattern=invert(cls_14.Closed))
cull_78 = CullPattern(List=circle_symbols_8, CullPattern=cls_14.Closed)
cp_42 = ControlPoints(Curve=cull_77)  # -> Points, Weights, Knots
cp_43 = ControlPoints(Curve=cull_78)  # -> Points, Weights, Knots
pline_32 = PolyLine(Vertices=cp_42.Points, Closed=invert(False))
pline_33 = PolyLine(Vertices=cp_43.Points, Closed=invert(False))
pcen_32 = PolygonCenter(Polyline=pline_32)  # -> CenterV, CenterE
pcen_33 = PolygonCenter(Polyline=pline_33)  # -> CenterV, CenterE
risers_curves_14 = Data(cull_78)
drops_curves_14 = Data(cull_77)
pt_110 = Point(pcen_32.CenterE)
pt_111 = Point(pcen_33.CenterE)
drops_points_14 = Data(pt_110)
risers_points_14 = Data(pt_111)

# ----
# SORTING_4
# (Riser VS Drop)
cls_15 = Closed(Curve=circle_symbols_9)  # -> Closed, Periodic
cull_79 = CullPattern(List=circle_symbols_9, CullPattern=invert(cls_15.Closed))
cull_80 = CullPattern(List=circle_symbols_9, CullPattern=cls_15.Closed)
cp_44 = ControlPoints(Curve=cull_79)  # -> Points, Weights, Knots
cp_45 = ControlPoints(Curve=cull_80)  # -> Points, Weights, Knots
pline_34 = PolyLine(Vertices=cp_44.Points, Closed=invert(False))
pline_35 = PolyLine(Vertices=cp_45.Points, Closed=invert(False))
pcen_34 = PolygonCenter(Polyline=pline_34)  # -> CenterV, CenterE
risers_curves_15 = Data(cull_80)
pcen_35 = PolygonCenter(Polyline=pline_35)  # -> CenterV, CenterE
drops_curves_15 = Data(cull_79)
pt_112 = Point(pcen_34.CenterE)
pt_113 = Point(pcen_35.CenterE)
drops_points_15 = Data(pt_112)
risers_points_15 = Data(pt_113)

geo_95 = Geometry(crv_50)
crv_56 = Curve(<curve referenced from the Rhino model>)
number_slider_4 = Slider(2, range=0..10)
pt_114 = ConstructPoint(XCoordinate=0, YCoordinate=0, ZCoordinate=0)
Y_9 = UnitY(Factor=1)
len_13 = Length(Curve=crv_56)
multiplication_9 = Multiplication(A=len_13, B=number_slider_4)
neg_9 = Negative(Value=multiplication_9)
line_66 = LineSDL(Start=pt_114, Direction=Y_9, Length=neg_9)
move_70 = Move(Geometry=geo_95, Motion=line_66)  # -> Geometry, Transform
geo_96 = Geometry(move_70.Geometry)

geo_97 = Geometry(crv_51)
crv_57 = Curve(<curve referenced from the Rhino model>)
number_slider_5 = Slider(3, range=0..10)
pt_115 = ConstructPoint(XCoordinate=0, YCoordinate=0, ZCoordinate=0)
Y_10 = UnitY(Factor=1)
len_14 = Length(Curve=crv_57)
multiplication_10 = Multiplication(A=len_14, B=number_slider_5)
neg_10 = Negative(Value=multiplication_10)
line_67 = LineSDL(Start=pt_115, Direction=Y_10, Length=neg_10)
move_71 = Move(Geometry=geo_97, Motion=line_67)  # -> Geometry, Transform
geo_98 = Geometry(move_71.Geometry)

geo_99 = Geometry(pt_102)
crv_58 = Curve(<curve referenced from the Rhino model>)
pt_116 = ConstructPoint(XCoordinate=0, YCoordinate=0, ZCoordinate=0)
Y_11 = UnitY(Factor=1)
len_15 = Length(Curve=crv_58)
multiplication_11 = Multiplication(A=len_15, B=number_slider_5)
neg_11 = Negative(Value=multiplication_11)
line_68 = LineSDL(Start=pt_116, Direction=Y_11, Length=neg_11)
move_72 = Move(Geometry=geo_99, Motion=line_68)  # -> Geometry, Transform
geo_100 = Geometry(move_72.Geometry)

geo_101 = Geometry(pt_101)
crv_59 = Curve(<curve referenced from the Rhino model>)
number_slider_6 = Slider(4, range=0..10)
pt_117 = ConstructPoint(XCoordinate=0, YCoordinate=0, ZCoordinate=0)
Y_12 = UnitY(Factor=1)
len_16 = Length(Curve=crv_59)
multiplication_12 = Multiplication(A=len_16, B=number_slider_4)
neg_12 = Negative(Value=multiplication_12)
line_69 = LineSDL(Start=pt_117, Direction=Y_12, Length=neg_12)
move_73 = Move(Geometry=geo_101, Motion=line_69)  # -> Geometry, Transform
geo_102 = Geometry(move_73.Geometry)

# ----
# SORTING_4
# (Riser VS Drop)
cls_16 = Closed(Curve=circle_symbols_10)  # -> Closed, Periodic
cull_81 = CullPattern(List=circle_symbols_10, CullPattern=invert(cls_16.Closed))
cull_82 = CullPattern(List=circle_symbols_10, CullPattern=cls_16.Closed)
cp_46 = ControlPoints(Curve=cull_81)  # -> Points, Weights, Knots
cp_47 = ControlPoints(Curve=cull_82)  # -> Points, Weights, Knots
pline_36 = PolyLine(Vertices=cp_46.Points, Closed=invert(False))
pline_37 = PolyLine(Vertices=cp_47.Points, Closed=invert(False))
pcen_36 = PolygonCenter(Polyline=pline_36)  # -> CenterV, CenterE
risers_curves_16 = Data(cull_82)
drops_curves_16 = Data(cull_81)
pcen_37 = PolygonCenter(Polyline=pline_37)  # -> CenterV, CenterE
pt_118 = Point(pcen_36.CenterE)
pt_119 = Point(pcen_37.CenterE)
drops_points_16 = Data(pt_118)
risers_points_16 = Data(pt_119)

geo_103 = Geometry(crv_53)
crv_60 = Curve(<curve referenced from the Rhino model>)
number_slider_7 = Slider(2, range=0..10)
pt_120 = ConstructPoint(XCoordinate=0, YCoordinate=0, ZCoordinate=0)
Y_13 = UnitY(Factor=1)
len_17 = Length(Curve=crv_60)
multiplication_13 = Multiplication(A=len_17, B=number_slider_7)
neg_13 = Negative(Value=multiplication_13)
line_70 = LineSDL(Start=pt_120, Direction=Y_13, Length=neg_13)
move_74 = Move(Geometry=geo_103, Motion=line_70)  # -> Geometry, Transform
geo_104 = Geometry(move_74.Geometry)

geo_105 = Geometry(crv_54)
crv_61 = Curve(<curve referenced from the Rhino model>)
number_slider_8 = Slider(3, range=0..10)
pt_121 = ConstructPoint(XCoordinate=0, YCoordinate=0, ZCoordinate=0)
Y_14 = UnitY(Factor=1)
len_18 = Length(Curve=crv_61)
multiplication_14 = Multiplication(A=len_18, B=number_slider_8)
neg_14 = Negative(Value=multiplication_14)
line_71 = LineSDL(Start=pt_121, Direction=Y_14, Length=neg_14)
move_75 = Move(Geometry=geo_105, Motion=line_71)  # -> Geometry, Transform
geo_106 = Geometry(move_75.Geometry)

geo_107 = Geometry(pt_104)
crv_62 = Curve(<curve referenced from the Rhino model>)
pt_122 = ConstructPoint(XCoordinate=0, YCoordinate=0, ZCoordinate=0)
Y_15 = UnitY(Factor=1)
len_19 = Length(Curve=crv_62)
multiplication_15 = Multiplication(A=len_19, B=number_slider_8)
neg_15 = Negative(Value=multiplication_15)
line_72 = LineSDL(Start=pt_122, Direction=Y_15, Length=neg_15)
move_76 = Move(Geometry=geo_107, Motion=line_72)  # -> Geometry, Transform
geo_108 = Geometry(move_76.Geometry)

geo_109 = Geometry(pt_103)
crv_63 = Curve(<curve referenced from the Rhino model>)
number_slider_9 = Slider(4, range=0..10)
pt_123 = ConstructPoint(XCoordinate=0, YCoordinate=0, ZCoordinate=0)
Y_16 = UnitY(Factor=1)
len_20 = Length(Curve=crv_63)
multiplication_16 = Multiplication(A=len_20, B=number_slider_7)
neg_16 = Negative(Value=multiplication_16)
line_73 = LineSDL(Start=pt_123, Direction=Y_16, Length=neg_16)
move_77 = Move(Geometry=geo_109, Motion=line_73)  # -> Geometry, Transform
geo_110 = Geometry(move_77.Geometry)

# ----
# Translate to final position by curve
geo_111 = Geometry(crv_52)
crv_64 = Curve(<curve referenced from the Rhino model>)
number_slider_10 = Slider(1, range=0..10)
pt_124 = ConstructPoint(XCoordinate=0, YCoordinate=0, ZCoordinate=0)
Y_17 = UnitY(Factor=1)
len_21 = Length(Curve=crv_64)
multiplication_17 = Multiplication(A=len_21, B=number_slider_10)
neg_17 = Negative(Value=multiplication_17)
line_74 = LineSDL(Start=pt_124, Direction=Y_17, Length=neg_17)
move_78 = Move(Geometry=geo_111, Motion=line_74)  # -> Geometry, Transform
geo_112 = Geometry(move_78.Geometry)

geo_113 = Geometry(pt_91)
crv_65 = Curve(<curve referenced from the Rhino model>)
number_slider_11 = Slider(4, range=0..10)
pt_125 = ConstructPoint(XCoordinate=0, YCoordinate=0, ZCoordinate=0)
Y_18 = UnitY(Factor=1)
len_22 = Length(Curve=crv_65)
multiplication_18 = Multiplication(A=len_22, B=number_slider_10)
neg_18 = Negative(Value=multiplication_18)
line_75 = LineSDL(Start=pt_125, Direction=Y_18, Length=neg_18)
move_79 = Move(Geometry=geo_113, Motion=line_75)  # -> Geometry, Transform
geo_114 = Geometry(move_79.Geometry)

# ----
# Translate to final position by curve
geo_115 = Geometry(crv_55)
crv_66 = Curve(<curve referenced from the Rhino model>)
number_slider_12 = Slider(1, range=0..10)
pt_126 = ConstructPoint(XCoordinate=0, YCoordinate=0, ZCoordinate=0)
Y_19 = UnitY(Factor=1)
len_23 = Length(Curve=crv_66)
multiplication_19 = Multiplication(A=len_23, B=number_slider_12)
neg_19 = Negative(Value=multiplication_19)
line_76 = LineSDL(Start=pt_126, Direction=Y_19, Length=neg_19)
move_80 = Move(Geometry=geo_115, Motion=line_76)  # -> Geometry, Transform
geo_116 = Geometry(move_80.Geometry)

geo_117 = Geometry(pt_93)
crv_67 = Curve(<curve referenced from the Rhino model>)
number_slider_13 = Slider(4, range=0..10)
pt_127 = ConstructPoint(XCoordinate=0, YCoordinate=0, ZCoordinate=0)
Y_20 = UnitY(Factor=1)
len_24 = Length(Curve=crv_67)
multiplication_20 = Multiplication(A=len_24, B=number_slider_12)
neg_20 = Negative(Value=multiplication_20)
line_77 = LineSDL(Start=pt_127, Direction=Y_20, Length=neg_20)
move_81 = Move(Geometry=geo_117, Motion=line_77)  # -> Geometry, Transform
geo_118 = Geometry(move_81.Geometry)

data_17 = Data(flatten(geo_88))
data_18 = Data(flatten(geo_92))
data_19 = Data(flatten(geo_90))
data_20 = Data(flatten(geo_94))
null_13 = NullItem(Item=data_18)  # -> NullFlags, InvalidFlags, Description
null_14 = NullItem(Item=data_20)  # -> NullFlags, InvalidFlags, Description
null_15 = NullItem(Item=data_17)  # -> NullFlags, InvalidFlags, Description
null_16 = NullItem(Item=data_19)  # -> NullFlags, InvalidFlags, Description
cull_83 = CullPattern(List=data_18, CullPattern=invert(null_13.NullFlags))
cull_84 = CullPattern(List=data_20, CullPattern=invert(null_14.NullFlags))
cull_85 = CullPattern(List=data_17, CullPattern=invert(null_15.NullFlags))
cull_86 = CullPattern(List=data_19, CullPattern=invert(null_16.NullFlags))

# ----
# ENDPOINT EXPORT
end_10 = EndPoints(Curve=flatten(cull_83))  # -> Start, End
pdecon_7 = Deconstruct(Point=end_10.Start)  # -> XComponent, YComponent, ZComponent
pdecon_8 = Deconstruct(Point=end_10.End)  # -> XComponent, YComponent, ZComponent
panel_35 = Panel(pdecon_7.ZComponent)
panel_36 = Panel(pdecon_7.XComponent)
panel_37 = Panel(pdecon_8.XComponent)
panel_38 = Panel(pdecon_7.YComponent)
panel_39 = Panel(pdecon_8.YComponent)
panel_40 = Panel(pdecon_8.ZComponent)

# ----
# Offset from Level
offset_32 = Slider(166, range=0..300)
geo_119 = Geometry(risers_points_14)
pt_128 = ConstructPoint(XCoordinate=0, YCoordinate=0, ZCoordinate=0)
Z_40 = UnitZ(Factor=1)
line_78 = LineSDL(Start=pt_128, Direction=Z_40, Length=offset_32)
move_82 = Move(Geometry=geo_119, Motion=line_78)  # -> Geometry, Transform
geo_120 = Geometry(move_82.Geometry)

# ----
# ENDPOINT EXPORT
end_11 = EndPoints(Curve=flatten(cull_84))  # -> Start, End
pdecon_9 = Deconstruct(Point=end_11.Start)  # -> XComponent, YComponent, ZComponent
pdecon_10 = Deconstruct(Point=end_11.End)  # -> XComponent, YComponent, ZComponent
panel_41 = Panel(pdecon_9.ZComponent)
panel_42 = Panel(pdecon_9.XComponent)
panel_43 = Panel(pdecon_9.YComponent)
panel_44 = Panel(pdecon_10.XComponent)
panel_45 = Panel(pdecon_10.YComponent)
panel_46 = Panel(pdecon_10.ZComponent)

# ----
# Offset from Level
offset_33 = Slider(129, range=0..300)
geo_121 = Geometry(risers_points_15)
pt_129 = ConstructPoint(XCoordinate=0, YCoordinate=0, ZCoordinate=0)
Z_41 = UnitZ(Factor=1)
line_79 = LineSDL(Start=pt_129, Direction=Z_41, Length=offset_33)
move_83 = Move(Geometry=geo_121, Motion=line_79)  # -> Geometry, Transform
geo_122 = Geometry(move_83.Geometry)

# ----
# Offset from Level
offset_34 = Slider(168, range=0..200)
geo_123 = Geometry(risers_points_16)
pt_130 = ConstructPoint(XCoordinate=0, YCoordinate=0, ZCoordinate=0)
Z_42 = UnitZ(Factor=1)
line_80 = LineSDL(Start=pt_130, Direction=Z_42, Length=offset_34)
move_84 = Move(Geometry=geo_123, Motion=line_80)  # -> Geometry, Transform
geo_124 = Geometry(move_84.Geometry)

# ----
# SINGLE POINT EXPORT
pdecon_11 = Deconstruct(Point=data_17)  # -> XComponent, YComponent, ZComponent
panel_47 = Panel(pdecon_11.YComponent)
panel_48 = Panel(pdecon_11.ZComponent)
panel_49 = Panel(pdecon_11.XComponent)

# ----
# SINGLE POINT EXPORT
pdecon_12 = Deconstruct(Point=data_19)  # -> XComponent, YComponent, ZComponent
panel_50 = Panel(pdecon_12.YComponent)
panel_51 = Panel(pdecon_12.ZComponent)
panel_52 = Panel(pdecon_12.XComponent)

data_21 = Data(branch_24)
data_22 = Data(branch_22)
data_23 = Data(branch_19)
data_24 = Data(branch_26)
data_25 = Data(branch_23)
data_26 = Data(branch_20)

data_27 = Data(data_26)
data_28 = Data(data_25)
data_29 = Data(data_24)
end_12 = EndPoints(Curve=data_27)  # -> Start, End

data_30 = Data(data_23)
data_31 = Data(data_21)
data_32 = Data(data_22)
end_13 = EndPoints(Curve=data_30)  # -> Start, End

data_33 = Data(flatten([geo_114, geo_100, geo_102]))
data_34 = Data(flatten([geo_112, geo_96, geo_98]))
data_35 = Data(flatten([geo_118, geo_108, geo_110]))
data_36 = Data(flatten([geo_116, geo_104, geo_106]))
null_17 = NullItem(Item=data_33)  # -> NullFlags, InvalidFlags, Description
null_18 = NullItem(Item=data_34)  # -> NullFlags, InvalidFlags, Description
null_19 = NullItem(Item=data_35)  # -> NullFlags, InvalidFlags, Description
null_20 = NullItem(Item=data_36)  # -> NullFlags, InvalidFlags, Description

pt_131 = Point(end_13.Start)
# ATTRIBUTE TEXT by LEADER
pt_132 = Point(end_13.End)

cull_87 = CullPattern(List=data_34, CullPattern=invert(null_18.NullFlags))
cull_88 = CullPattern(List=data_36, CullPattern=invert(null_20.NullFlags))

pt_133 = Point(end_13.Start)
# ATTRIBUTE TEXT by LEADER
pt_134 = Point(end_13.End)

data_37 = Data(branch_21)
data_38 = Data(branch_27)
data_39 = Data(branch_25)

pt_135 = Point(end_12.Start)
# ATTRIBUTE TEXT by LEADER
pt_136 = Point(end_12.End)

pt_137 = Point(graft(data_32))
data_40 = Data(flatten(data_31))
dist_2 = Distance(PointA=pt_131, PointB=simplify(pt_137))
sort_3 = SortList(Keys=dist_2, ValuesA=pt_131, ValuesB=pt_132)  # -> Keys, simplify(ValuesA), simplify(ValuesB)
item_19 = ListItem(List=sort_3.ValuesB, Index=0, Wrap=True)  # -> flatten(Item)

# ----
# ENDPOINT EXPORT
end_14 = EndPoints(Curve=flatten(cull_87))  # -> Start, End
pdecon_13 = Deconstruct(Point=end_14.Start)  # -> XComponent, YComponent, ZComponent
pdecon_14 = Deconstruct(Point=end_14.End)  # -> XComponent, YComponent, ZComponent
panel_53 = Panel(pdecon_13.ZComponent)
panel_54 = Panel(pdecon_14.XComponent)
panel_55 = Panel(pdecon_13.YComponent)
panel_56 = Panel(pdecon_14.YComponent)
panel_57 = Panel(pdecon_14.ZComponent)
panel_58 = Panel(pdecon_13.XComponent)

ln_24 = Line(StartPoint=risers_points_15, EndPoint=geo_122)

# ----
# ENDPOINT EXPORT
end_15 = EndPoints(Curve=flatten(cull_88))  # -> Start, End
pdecon_15 = Deconstruct(Point=end_15.Start)  # -> XComponent, YComponent, ZComponent
pdecon_16 = Deconstruct(Point=end_15.End)  # -> XComponent, YComponent, ZComponent
panel_59 = Panel(pdecon_15.ZComponent)
panel_60 = Panel(pdecon_15.YComponent)
panel_61 = Panel(pdecon_16.XComponent)
panel_62 = Panel(pdecon_16.YComponent)
panel_63 = Panel(pdecon_16.ZComponent)
panel_64 = Panel(pdecon_15.XComponent)

ln_25 = Line(StartPoint=risers_points_16, EndPoint=geo_124)

data_41 = Data(data_37)
data_42 = Data(data_38)
data_43 = Data(data_39)
end_16 = EndPoints(Curve=data_41)  # -> Start, End

pt_138 = Point(graft(data_32))
data_44 = Data(flatten(data_31))
dist_3 = Distance(PointA=pt_133, PointB=simplify(pt_138))
sort_4 = SortList(Keys=dist_3, ValuesA=pt_133, ValuesB=pt_134)  # -> Keys, simplify(ValuesA), simplify(ValuesB)
item_20 = ListItem(List=sort_4.ValuesB, Index=0, Wrap=True)  # -> flatten(Item)

pt_139 = Point(graft(data_24))
data_45 = Data(flatten(data_25))
dist_4 = Distance(PointA=pt_135, PointB=simplify(pt_139))
sort_5 = SortList(Keys=dist_4, ValuesA=pt_135, ValuesB=pt_136)  # -> Keys, simplify(ValuesA), simplify(ValuesB)
item_21 = ListItem(List=sort_5.ValuesB, Index=0, Wrap=True)  # -> flatten(Item)

# ----
# SINGLE POINT EXPORT
pdecon_17 = Deconstruct(Point=data_33)  # -> XComponent, YComponent, ZComponent
panel_65 = Panel(pdecon_17.XComponent)
panel_66 = Panel(pdecon_17.ZComponent)
panel_67 = Panel(pdecon_17.YComponent)

# ----
# SINGLE POINT EXPORT
pdecon_18 = Deconstruct(Point=data_35)  # -> XComponent, YComponent, ZComponent
panel_68 = Panel(pdecon_18.XComponent)
panel_69 = Panel(pdecon_18.YComponent)
panel_70 = Panel(pdecon_18.ZComponent)

pt_140 = Point(end_16.Start)
# ATTRIBUTE TEXT by LEADER
pt_141 = Point(end_16.End)

pt_142 = Point(graft(data_43))
data_46 = Data(flatten(data_42))
dist_5 = Distance(PointA=pt_140, PointB=simplify(pt_142))
sort_6 = SortList(Keys=dist_5, ValuesA=pt_140, ValuesB=pt_141)  # -> Keys, simplify(ValuesA), simplify(ValuesB)
item_22 = ListItem(List=sort_6.ValuesB, Index=0, Wrap=True)  # -> flatten(Item)

panel_71 = Panel("mfp-heads")
dpipeline_23 = DynamicGeometryPipeline(
    LayerFilter="mfp-heads",
    TypeFilter="block",
    NameFilter="*",
    enableFullPath=False,
    GroupByLayer=False,
    GroupByType=False,
    IncludeHidden=True,
    IncludeLocked=True)  # -> flatten(GeometryOut)
dpipeline_24 = DynamicGeometryPipeline(
    LayerFilter="MFP-TEXT",
    TypeFilter="block",
    NameFilter="*",
    enableFullPath=False,
    GroupByLayer=False,
    GroupByType=False,
    IncludeHidden=True,
    IncludeLocked=True)  # -> flatten(GeometryOut)
blockexplode_3 = ExplodeBlocks(BlockObjects=dpipeline_24, explodeGeom=True)  # -> Geometry, Attributes, BlockName, BoundingBox, BlockTransform
blockexplode_4 = ExplodeBlocks(BlockObjects=dpipeline_23, explodeGeom=True)  # -> simplify(Geometry), Attributes, flatten(BlockName), BoundingBox, BlockTransform
c_script = CSharpScript()  # -> Out, A
crv_68 = Curve(blockexplode_3.Geometry)
null_21 = NullItem(Item=crv_68)  # -> NullFlags, InvalidFlags, Description
crv_69 = Curve(blockexplode_4.Geometry)
tstat = TreeStatistics(Tree=blockexplode_4.Geometry)  # -> Paths, Length, Count
cull_89 = CullPattern(List=crv_68, CullPattern=invert(null_21.NullFlags))
panel_72 = Panel(blockexplode_4.Geometry)
tsort = SortText(Keys=blockexplode_4.BlockName, Values=tstat.Paths, Culture=127)  # -> Keys, Values
item_23 = ListItem(List=cull_89, Index=1, Wrap=True)
branch_31 = TreeBranch(Tree=blockexplode_4.Geometry, Path=tsort.Values, MaintainPaths=True)
len_25 = TextLength(Text=tsort.Keys)

level_3_7 = Slider(410, range=0..1000)
level_5_2 = Slider(648, range=0..1000)
level_2_7 = Slider(290, range=0..1000)
level_1_7 = Slider(170, range=0..200)
level_0_2 = Slider(0, range=-40..200)
xy_7 = XYPlane(Origin=Point(0, 0, 0))
pt_143 = ConstructPoint(XCoordinate=0, YCoordinate=0, ZCoordinate=xy_7)

level_4_4 = Slider(530, range=0..1000)
all_offset_4 = Slider(6, range=0..200)

# ----
# SORTING_3
# Curve or Line (run vs symbol)
explode_12 = Explode(Curve=item_23, Recursive=True)  # -> Segments, Vertices
cp_48 = ControlPoints(Curve=explode_12.Segments)  # -> Points, Weights, Knots
lng_17 = ListLength(List=cp_48.Points)  # -> flatten(Length)
equals_23 = Equality(FirstNumber=lng_17, SecondNumber=9)  # -> Equality, Inequality
cull_90 = CullPattern(List=flatten(explode_12.Segments), CullPattern=equals_23.Equality)
circle_symbols_11 = Data(cull_90)

null_22 = NullItem(Item=crv_69)  # -> NullFlags, InvalidFlags, Description
panel_73 = Panel(tsort.Keys)
data_47 = Data(["Floor 0", "Floor 1", "Floor 2", "Floor 3", "Floor 4"])
# SPRINKLER HEADS
# 
# UPRIGHT
dpipeline_25 = DynamicGeometryPipeline(
    LayerFilter=data_47,
    TypeFilter="Curve",
    NameFilter="*",
    enableFullPath=False,
    GroupByLayer=False,
    GroupByType=False,
    IncludeHidden=True,
    IncludeLocked=True)
cull_91 = CullPattern(List=crv_69, CullPattern=invert(null_22.NullFlags))
# SPRINKLER HEADS
# 
# RECESSED
panel_74 = Panel("Floor 0")
item_24 = ListItem(List=cull_91, Index=0, Wrap=True)

level_3_8 = Slider(410, range=0..1000)
level_5_3 = Slider(648, range=0..1000)
level_2_8 = Slider(290, range=0..1000)
level_1_8 = Slider(170, range=0..200)
level_0_3 = Slider(0, range=-40..200)
xy_8 = XYPlane(Origin=Point(0, 0, 0))
pt_144 = ConstructPoint(XCoordinate=0, YCoordinate=0, ZCoordinate=xy_8)

level_4_5 = Slider(530, range=0..1000)
all_offset_5 = Slider(6, range=0..200)

# ----
# SORTING_3
# Curve or Line (run vs symbol)
explode_13 = Explode(Curve=item_24, Recursive=True)  # -> Segments, Vertices
cp_49 = ControlPoints(Curve=explode_13.Segments)  # -> Points, Weights, Knots
lng_18 = ListLength(List=cp_49.Points)  # -> flatten(Length)
equals_24 = Equality(FirstNumber=lng_18, SecondNumber=9)  # -> Equality, Inequality
cull_92 = CullPattern(List=flatten(explode_13.Segments), CullPattern=equals_24.Equality)
circle_symbols_12 = Data(cull_92)

data_48 = Data([panel_74, "Floor 1", "Floor 2", "Floor 3", "Floor 4"])
curvepoint_8 = PointOnCurve(circle_symbols_11, parameter=0.5)
dpipeline_26 = DynamicGeometryPipeline(
    LayerFilter=data_48,
    TypeFilter="Curve",
    NameFilter="*",
    enableFullPath=False,
    GroupByLayer=False,
    GroupByType=False,
    IncludeHidden=True,
    IncludeLocked=True)
incurves_9 = PointInCurves(Point=curvepoint_8, Curves=simplify(dpipeline_25))  # -> Relationship, Index, Point
equals_25 = Equality(FirstNumber=incurves_9.Relationship, SecondNumber=2)  # -> Equality, Inequality
crv_70 = Curve(simplify(circle_symbols_11))
curvepoint_9 = PointOnCurve(circle_symbols_12, parameter=0.5)
cull_93 = CullPattern(List=crv_70, CullPattern=equals_25.Equality)

dpipeline_27 = DynamicGeometryPipeline(
    LayerFilter="FP-TEXT",
    TypeFilter="Annotation",
    NameFilter="*",
    enableFullPath=False,
    GroupByLayer=False,
    GroupByType=False,
    IncludeHidden=True,
    IncludeLocked=True)
data_leader_2 = Data(dpipeline_27)
ps__get_leader_endpoints_2 = CSharpScript(x=data_leader_2)  # -> out, Pointer, Origin; inputs x: list; same code as ps__get_leader_endpoints
pt_145 = Point(ps__get_leader_endpoints_2.Pointer)
pt_146 = Point(ps__get_leader_endpoints_2.Origin)
ln_26 = Line(StartPoint=pt_145, EndPoint=pt_146)

dpipeline_28 = DynamicGeometryPipeline(
    LayerFilter="FP-TEXT",
    TypeFilter="text",
    NameFilter="*",
    enableFullPath=False,
    GroupByLayer=False,
    GroupByType=False,
    IncludeHidden=True,
    IncludeLocked=True)
data_text_4 = Data(dpipeline_28)
txtobjinfo_6 = TextObjectInfo(TextObjects=data_text_4)  # -> Plane, Text, Size, Alignment, VerticalAlignment
null_23 = NullItem(Item=txtobjinfo_6.Plane)  # -> NullFlags, InvalidFlags, Description
cull_94 = CullPattern(List=txtobjinfo_6.Plane, CullPattern=invert(null_23.NullFlags))
cull_95 = CullPattern(List=txtobjinfo_6.Text, CullPattern=invert(null_23.NullFlags))

incurves_10 = PointInCurves(Point=curvepoint_9, Curves=simplify(dpipeline_26))  # -> Relationship, Index, Point

basement_6 = Slider(0, range=-40..200)
level_roof_6 = Slider(570.75, range=0..1000)
level_3_9 = Slider(423.375, range=0..1000)
level_1_9 = Slider(126, range=0..200)
level_2_9 = Slider(294, range=0..1000)
xy_9 = XYPlane(Origin=Point(0, 0, 0))
pt_147 = ConstructPoint(XCoordinate=0, YCoordinate=0, ZCoordinate=xy_9)

equals_26 = Equality(FirstNumber=incurves_10.Relationship, SecondNumber=2)  # -> Equality, Inequality
crv_71 = Curve(simplify(circle_symbols_12))
branch_32 = TreeBranch(Tree=cull_93, Path=Slider(2, range=0..10), MaintainPaths=True)  # -> flatten(Branch)
branch_33 = TreeBranch(Tree=cull_93, Path=Slider(1, range=0..10), MaintainPaths=True)  # -> flatten(Branch)
viewer_8 = ParamViewer(cull_93)
branch_34 = TreeBranch(Tree=cull_93, Path=Slider(3, range=0..10), MaintainPaths=True)  # -> flatten(Branch)
branch_35 = TreeBranch(Tree=cull_93, Path=Slider(0, range=0..10), MaintainPaths=True)  # -> flatten(Branch)
translation_vector___do_not_touch_6 = Curve(<curve referenced from the Rhino model>)
branch_36 = TreeBranch(Tree=cull_93, Path=Slider(4, range=0..10), MaintainPaths=True)  # -> flatten(Branch)
cull_96 = CullPattern(List=crv_71, CullPattern=equals_26.Equality)
branch_37 = TreeBranch(Tree=cull_96, Path=Slider(2, range=0..10), MaintainPaths=True)  # -> flatten(Branch)
branch_38 = TreeBranch(Tree=cull_96, Path=Slider(1, range=0..10), MaintainPaths=True)  # -> flatten(Branch)
viewer_9 = ParamViewer(cull_96)
branch_39 = TreeBranch(Tree=cull_96, Path=Slider(3, range=0..10), MaintainPaths=True)  # -> flatten(Branch)
branch_40 = TreeBranch(Tree=cull_96, Path=Slider(0, range=0..10), MaintainPaths=True)  # -> flatten(Branch)
branch_41 = TreeBranch(Tree=cull_96, Path=Slider(4, range=0..10), MaintainPaths=True)  # -> flatten(Branch)

line_81 = LineSDL(Start=pt_143, Direction=Vector(0, 0, 1), Length=level_0_2)
move_85 = Move(Geometry=xy_7, Motion=line_81)  # -> Geometry, Transform
# LEVEL 0
movetoplane_18 = MoveToPlane(Geometry=branch_35, Plane=move_85.Geometry, Above=True, Below=True)  # -> Geometry, Transform

pt_148 = Point(cull_94)
# PIPES FP_WET
data_49 = Data(["Floor 0", "Floor 1", "Floor 2", "Floor 3", "Floor 4"])

line_82 = LineSDL(Start=pt_144, Direction=Vector(0, 0, 1), Length=level_3_8)
move_86 = Move(Geometry=xy_8, Motion=line_82)  # -> Geometry, Transform
movetoplane_19 = MoveToPlane(Geometry=branch_39, Plane=move_86.Geometry, Above=True, Below=True)  # -> Geometry, Transform

line_83 = LineSDL(Start=pt_144, Direction=Vector(0, 0, 1), Length=level_2_8)
move_87 = Move(Geometry=xy_8, Motion=line_83)  # -> Geometry, Transform
# LEVEL 2
movetoplane_20 = MoveToPlane(Geometry=branch_37, Plane=move_87.Geometry, Above=True, Below=True)  # -> Geometry, Transform

line_84 = LineSDL(Start=pt_144, Direction=Vector(0, 0, 1), Length=level_4_5)
move_88 = Move(Geometry=xy_8, Motion=line_84)  # -> Geometry, Transform
movetoplane_21 = MoveToPlane(Geometry=branch_41, Plane=move_88.Geometry, Above=True, Below=True)  # -> Geometry, Transform

line_85 = LineSDL(Start=pt_144, Direction=Vector(0, 0, 1), Length=level_1_8)
move_89 = Move(Geometry=xy_8, Motion=line_85)  # -> Geometry, Transform
# LEVEL 1
movetoplane_22 = MoveToPlane(Geometry=branch_38, Plane=move_89.Geometry, Above=True, Below=True)  # -> Geometry, Transform

dpipeline_29 = DynamicGeometryPipeline(
    LayerFilter=data_49,
    TypeFilter="Curve",
    NameFilter="*",
    enableFullPath=False,
    GroupByLayer=False,
    GroupByType=False,
    IncludeHidden=True,
    IncludeLocked=True)

curvepoint_10 = PointOnCurve(ln_26, parameter=0.5)
incurves_11 = PointInCurves(Point=curvepoint_10, Curves=simplify(dpipeline_29))  # -> Relationship, Index, Point
crv_72 = Curve(simplify(ln_26))
equals_27 = Equality(FirstNumber=incurves_11.Relationship, SecondNumber=2)  # -> Equality, Inequality
cull_97 = CullPattern(List=crv_72, CullPattern=equals_27.Equality)  # -> simplify(List)
viewer_10 = ParamViewer(cull_97)
branch_42 = TreeBranch(Tree=cull_97, Path=Slider(3, range=0..10), MaintainPaths=True)  # -> flatten(Branch)
branch_43 = TreeBranch(Tree=cull_97, Path=Slider(2, range=0..10), MaintainPaths=True)  # -> flatten(Branch)
branch_44 = TreeBranch(Tree=cull_97, Path=Slider(1, range=0..10), MaintainPaths=True)  # -> flatten(Branch)

ps__convert_number_4 = CSharpScript(x=cull_95)  # -> out, A; inputs x: list of String; same code as ps__convert_number

incurves_12 = PointInCurves(Point=pt_148, Curves=simplify(dpipeline_29))  # -> Relationship, Index, Point
equals_28 = Equality(FirstNumber=incurves_12.Relationship, SecondNumber=2)  # -> Equality, Inequality
cull_98 = CullPattern(List=pt_148, CullPattern=equals_28.Equality)  # -> simplify(List)
cull_99 = CullPattern(List=ps__convert_number_4.A, CullPattern=equals_28.Equality)  # -> simplify(List)
viewer_11 = ParamViewer(cull_99)
number_slider_14 = Slider(3, range=0..10)
number_slider_15 = Slider(2, range=0..10)
number_slider_16 = Slider(1, range=0..10)
branch_45 = TreeBranch(Tree=cull_98, Path=number_slider_14, MaintainPaths=True)  # -> flatten(Branch)
branch_46 = TreeBranch(Tree=cull_99, Path=number_slider_15, MaintainPaths=True)  # -> flatten(Branch)
branch_47 = TreeBranch(Tree=cull_99, Path=number_slider_14, MaintainPaths=True)  # -> flatten(Branch)
branch_48 = TreeBranch(Tree=cull_98, Path=number_slider_16, MaintainPaths=True)  # -> flatten(Branch)
branch_49 = TreeBranch(Tree=cull_98, Path=number_slider_15, MaintainPaths=True)  # -> flatten(Branch)
branch_50 = TreeBranch(Tree=cull_99, Path=number_slider_16, MaintainPaths=True)  # -> flatten(Branch)

line_86 = LineSDL(Start=pt_144, Direction=Vector(0, 0, 1), Length=level_0_3)
move_90 = Move(Geometry=xy_8, Motion=line_86)  # -> Geometry, Transform
# LEVEL 0
movetoplane_23 = MoveToPlane(Geometry=branch_40, Plane=move_90.Geometry, Above=True, Below=True)  # -> Geometry, Transform

# ----
# SORTING_3
# Curve or Line (run vs symbol)
explode_14 = Explode(Curve=movetoplane_19.Geometry, Recursive=True)  # -> Segments, Vertices
cp_50 = ControlPoints(Curve=explode_14.Segments)  # -> Points, Weights, Knots
lng_19 = ListLength(List=cp_50.Points)  # -> flatten(Length)
equals_29 = Equality(FirstNumber=lng_19, SecondNumber=9)  # -> Equality, Inequality
cull_100 = CullPattern(List=flatten(explode_14.Segments), CullPattern=equals_29.Equality)
cull_101 = CullPattern(List=flatten(explode_14.Segments), CullPattern=invert(equals_29.Equality))
circle_symbols_13 = Data(cull_100)
line_symbols_10 = Data(cull_101)

# ----
# SORTING_3
# Curve or Line (run vs symbol)
explode_15 = Explode(Curve=movetoplane_20.Geometry, Recursive=True)  # -> Segments, Vertices
cp_51 = ControlPoints(Curve=explode_15.Segments)  # -> Points, Weights, Knots
lng_20 = ListLength(List=cp_51.Points)  # -> flatten(Length)
equals_30 = Equality(FirstNumber=lng_20, SecondNumber=9)  # -> Equality, Inequality
cull_102 = CullPattern(List=flatten(explode_15.Segments), CullPattern=equals_30.Equality)
cull_103 = CullPattern(List=flatten(explode_15.Segments), CullPattern=invert(equals_30.Equality))
circle_symbols_14 = Data(cull_102)
line_symbols_11 = Data(cull_103)

# ----
# SORTING_3
# Curve or Line (run vs symbol)
# LEVEL 4
explode_16 = Explode(Curve=movetoplane_21.Geometry, Recursive=True)  # -> Segments, Vertices
# LEVEL 3
cp_52 = ControlPoints(Curve=explode_16.Segments)  # -> Points, Weights, Knots
lng_21 = ListLength(List=cp_52.Points)  # -> flatten(Length)
equals_31 = Equality(FirstNumber=lng_21, SecondNumber=9)  # -> Equality, Inequality
cull_104 = CullPattern(List=flatten(explode_16.Segments), CullPattern=equals_31.Equality)
cull_105 = CullPattern(List=flatten(explode_16.Segments), CullPattern=invert(equals_31.Equality))
circle_symbols_15 = Data(cull_104)
line_symbols_12 = Data(cull_105)

data_50 = Data(branch_49)

crv_73 = Curve(movetoplane_18.Geometry)
cp_53 = ControlPoints(Curve=crv_73)  # -> Points, Weights, Knots
pline_38 = PolyLine(Vertices=cp_53.Points, Closed=invert(False))
pcen_38 = PolygonCenter(Polyline=pline_38)  # -> CenterV, CenterE
pt_149 = Point(pcen_38.CenterE)

# ----
# SORTING_4
# (Riser VS Drop)
cls_17 = Closed(Curve=circle_symbols_13)  # -> Closed, Periodic
cull_106 = CullPattern(List=circle_symbols_13, CullPattern=invert(cls_17.Closed))
cull_107 = CullPattern(List=circle_symbols_13, CullPattern=cls_17.Closed)
cp_54 = ControlPoints(Curve=cull_106)  # -> Points, Weights, Knots
cp_55 = ControlPoints(Curve=cull_107)  # -> Points, Weights, Knots
pline_39 = PolyLine(Vertices=cp_54.Points, Closed=invert(False))
pline_40 = PolyLine(Vertices=cp_55.Points, Closed=invert(False))
pcen_39 = PolygonCenter(Polyline=pline_39)  # -> CenterV, CenterE
pcen_40 = PolygonCenter(Polyline=pline_40)  # -> CenterV, CenterE
risers_curves_17 = Data(cull_107)
drops_curves_17 = Data(cull_106)
pt_150 = Point(pcen_39.CenterE)
pt_151 = Point(pcen_40.CenterE)
drops_points_17 = Data(pt_150)
risers_points_17 = Data(pt_151)

# ----
# SORTING_4
# (Riser VS Drop)
cls_18 = Closed(Curve=circle_symbols_14)  # -> Closed, Periodic
cull_108 = CullPattern(List=circle_symbols_14, CullPattern=invert(cls_18.Closed))
cull_109 = CullPattern(List=circle_symbols_14, CullPattern=cls_18.Closed)
cp_56 = ControlPoints(Curve=cull_108)  # -> Points, Weights, Knots
cp_57 = ControlPoints(Curve=cull_109)  # -> Points, Weights, Knots
pline_41 = PolyLine(Vertices=cp_56.Points, Closed=invert(False))
pline_42 = PolyLine(Vertices=cp_57.Points, Closed=invert(False))
pcen_41 = PolygonCenter(Polyline=pline_41)  # -> CenterV, CenterE
pcen_42 = PolygonCenter(Polyline=pline_42)  # -> CenterV, CenterE
risers_curves_18 = Data(cull_109)
drops_curves_18 = Data(cull_108)
pt_152 = Point(pcen_41.CenterE)
pt_153 = Point(pcen_42.CenterE)
drops_points_18 = Data(pt_152)
risers_points_18 = Data(pt_153)

# ----
# SORTING_4
# (Riser VS Drop)
cls_19 = Closed(Curve=circle_symbols_15)  # -> Closed, Periodic
cull_110 = CullPattern(List=circle_symbols_15, CullPattern=invert(cls_19.Closed))
cull_111 = CullPattern(List=circle_symbols_15, CullPattern=cls_19.Closed)
cp_58 = ControlPoints(Curve=cull_110)  # -> Points, Weights, Knots
cp_59 = ControlPoints(Curve=cull_111)  # -> Points, Weights, Knots
pline_43 = PolyLine(Vertices=cp_58.Points, Closed=invert(False))
pline_44 = PolyLine(Vertices=cp_59.Points, Closed=invert(False))
pcen_43 = PolygonCenter(Polyline=pline_43)  # -> CenterV, CenterE
pcen_44 = PolygonCenter(Polyline=pline_44)  # -> CenterV, CenterE
risers_curves_19 = Data(cull_111)
drops_curves_19 = Data(cull_110)
pt_154 = Point(pcen_43.CenterE)
pt_155 = Point(pcen_44.CenterE)
drops_points_19 = Data(pt_154)
risers_points_19 = Data(pt_155)

crv_74 = Curve(movetoplane_23.Geometry)
cp_60 = ControlPoints(Curve=crv_74)  # -> Points, Weights, Knots
pline_45 = PolyLine(Vertices=cp_60.Points, Closed=invert(False))
pcen_45 = PolygonCenter(Polyline=pline_45)  # -> CenterV, CenterE
pt_156 = Point(pcen_45.CenterE)

crv_75 = Curve(movetoplane_22.Geometry)
cp_61 = ControlPoints(Curve=crv_75)  # -> Points, Weights, Knots
pline_46 = PolyLine(Vertices=cp_61.Points, Closed=invert(False))
pcen_46 = PolygonCenter(Polyline=pline_46)  # -> CenterV, CenterE
pt_157 = Point(pcen_46.CenterE)

# ----
# Offset from Level
offset_35 = Slider(144, range=0..200)
geo_125 = Geometry(pt_149)
pt_158 = ConstructPoint(XCoordinate=0, YCoordinate=0, ZCoordinate=0)
Z_43 = UnitZ(Factor=1)
line_87 = LineSDL(Start=pt_158, Direction=Z_43, Length=offset_35)
move_91 = Move(Geometry=geo_125, Motion=line_87)  # -> Geometry, Transform
geo_126 = Geometry(move_91.Geometry)

# ----
# Offset from Level
offset_36 = Slider(140, range=0..200)
geo_127 = Geometry(pt_149)
pt_159 = ConstructPoint(XCoordinate=0, YCoordinate=0, ZCoordinate=0)
Z_44 = UnitZ(Factor=1)
line_88 = LineSDL(Start=pt_159, Direction=Z_44, Length=offset_36)
move_92 = Move(Geometry=geo_127, Motion=line_88)  # -> Geometry, Transform
geo_128 = Geometry(move_92.Geometry)

# ----
# Offset from Level
offset_37 = Slider(134, range=0..200)
geo_129 = Geometry(pt_156)
pt_160 = ConstructPoint(XCoordinate=0, YCoordinate=0, ZCoordinate=0)
Z_45 = UnitZ(Factor=1)
line_89 = LineSDL(Start=pt_160, Direction=Z_45, Length=offset_37)
move_93 = Move(Geometry=geo_129, Motion=line_89)  # -> Geometry, Transform
geo_130 = Geometry(move_93.Geometry)

# ----
# Offset from Level
offset_38 = Slider(140, range=0..200)
geo_131 = Geometry(pt_156)
pt_161 = ConstructPoint(XCoordinate=0, YCoordinate=0, ZCoordinate=0)
Z_46 = UnitZ(Factor=1)
line_90 = LineSDL(Start=pt_161, Direction=Z_46, Length=offset_38)
move_94 = Move(Geometry=geo_131, Motion=line_90)  # -> Geometry, Transform
geo_132 = Geometry(move_94.Geometry)

# ----
# Offset from Level
offset_39 = Slider(104, range=0..200)
geo_133 = Geometry(pt_157)
pt_162 = ConstructPoint(XCoordinate=0, YCoordinate=0, ZCoordinate=0)
Z_47 = UnitZ(Factor=1)
line_91 = LineSDL(Start=pt_162, Direction=Z_47, Length=offset_39)
move_95 = Move(Geometry=geo_133, Motion=line_91)  # -> Geometry, Transform
geo_134 = Geometry(move_95.Geometry)

# ----
# Offset from Level
geo_135 = Geometry(risers_points_17)
pt_163 = ConstructPoint(XCoordinate=0, YCoordinate=0, ZCoordinate=0)
Z_48 = UnitZ(Factor=1)
line_92 = LineSDL(Start=pt_163, Direction=Z_48, Length=offset_39)
move_96 = Move(Geometry=geo_135, Motion=line_92)  # -> Geometry, Transform
geo_136 = Geometry(move_96.Geometry)

# ----
# Offset from Level
offset_40 = Slider(100, range=0..200)
geo_137 = Geometry(pt_157)
Z_49 = UnitZ(Factor=1)
pt_164 = ConstructPoint(XCoordinate=0, YCoordinate=0, ZCoordinate=0)
line_93 = LineSDL(Start=pt_164, Direction=Z_49, Length=offset_40)
move_97 = Move(Geometry=geo_137, Motion=line_93)  # -> Geometry, Transform
geo_138 = Geometry(move_97.Geometry)

# ----
# Offset from Level
geo_139 = Geometry(risers_points_17)
pt_165 = ConstructPoint(XCoordinate=0, YCoordinate=0, ZCoordinate=0)
Z_50 = UnitZ(Factor=1)
line_94 = LineSDL(Start=pt_165, Direction=Z_50, Length=offset_40)
move_98 = Move(Geometry=geo_139, Motion=line_94)  # -> Geometry, Transform
geo_140 = Geometry(move_98.Geometry)

# ----
# Offset from Level
geo_141 = Geometry(risers_points_18)
pt_166 = ConstructPoint(XCoordinate=0, YCoordinate=0, ZCoordinate=0)
Z_51 = UnitZ(Factor=1)
line_95 = LineSDL(Start=pt_166, Direction=Z_51, Length=offset_39)
move_99 = Move(Geometry=geo_141, Motion=line_95)  # -> Geometry, Transform
geo_142 = Geometry(move_99.Geometry)

# ----
# Offset from Level
geo_143 = Geometry(risers_points_19)
pt_167 = ConstructPoint(XCoordinate=0, YCoordinate=0, ZCoordinate=0)
Z_52 = UnitZ(Factor=1)
line_96 = LineSDL(Start=pt_167, Direction=Z_52, Length=offset_39)
move_100 = Move(Geometry=geo_143, Motion=line_96)  # -> Geometry, Transform
geo_144 = Geometry(move_100.Geometry)

# ----
# Offset from Level
geo_145 = Geometry(risers_points_18)
pt_168 = ConstructPoint(XCoordinate=0, YCoordinate=0, ZCoordinate=0)
Z_53 = UnitZ(Factor=1)
line_97 = LineSDL(Start=pt_168, Direction=Z_53, Length=offset_40)
move_101 = Move(Geometry=geo_145, Motion=line_97)  # -> Geometry, Transform
geo_146 = Geometry(move_101.Geometry)

# ----
# Offset from Level
geo_147 = Geometry(risers_points_19)
pt_169 = ConstructPoint(XCoordinate=0, YCoordinate=0, ZCoordinate=0)
Z_54 = UnitZ(Factor=1)
line_98 = LineSDL(Start=pt_169, Direction=Z_54, Length=offset_40)
move_102 = Move(Geometry=geo_147, Motion=line_98)  # -> Geometry, Transform
geo_148 = Geometry(move_102.Geometry)

ln_27 = Line(StartPoint=geo_128, EndPoint=geo_126)
pt_170 = Point(geo_126)
ln_28 = Line(StartPoint=geo_132, EndPoint=geo_130)
pt_171 = Point(geo_130)
crv_76 = Curve(ln_27)

geo_149 = Geometry(pt_170)
crv_77 = Curve(<curve referenced from the Rhino model>)
pt_172 = ConstructPoint(XCoordinate=0, YCoordinate=0, ZCoordinate=0)
Y_21 = UnitY(Factor=1)
len_26 = Length(Curve=crv_77)
multiplication_21 = Multiplication(A=len_26, B=Slider(0, range=0..10))
neg_21 = Negative(Value=multiplication_21)
line_99 = LineSDL(Start=pt_172, Direction=Y_21, Length=neg_21)
move_103 = Move(Geometry=geo_149, Motion=line_99)  # -> Geometry, Transform
geo_150 = Geometry(move_103.Geometry)

geo_151 = Geometry(crv_76)
crv_78 = Curve(<curve referenced from the Rhino model>)
pt_173 = ConstructPoint(XCoordinate=0, YCoordinate=0, ZCoordinate=0)
Y_22 = UnitY(Factor=1)
len_27 = Length(Curve=crv_78)
multiplication_22 = Multiplication(A=len_27, B=Slider(0, range=0..10))
neg_22 = Negative(Value=multiplication_22)
line_100 = LineSDL(Start=pt_173, Direction=Y_22, Length=neg_22)
move_104 = Move(Geometry=geo_151, Motion=line_100)  # -> Geometry, Transform
geo_152 = Geometry(move_104.Geometry)

pt_174 = Point(geo_138)
ln_29 = Line(StartPoint=geo_138, EndPoint=geo_134)
ln_30 = Line(StartPoint=geo_140, EndPoint=geo_136)
pt_175 = Point(geo_140)
ln_31 = Line(StartPoint=geo_146, EndPoint=geo_142)
ln_32 = Line(StartPoint=geo_148, EndPoint=geo_144)
pt_176 = Point(geo_148)
pt_177 = Point(geo_146)
preview_3 = CustomPreview(Geometry=[pt_175, pt_176, pt_177, pt_174, pt_171], Shader=ColourSwatch(SwatchColor=RGB(42, 116, 255)))
crv_79 = Curve(ln_30)
crv_80 = Curve(ln_28)
crv_81 = Curve(ln_31)
crv_82 = Curve(ln_32)
crv_83 = Curve(ln_29)

geo_153 = Geometry(pt_171)
crv_84 = Curve(<curve referenced from the Rhino model>)
pt_178 = ConstructPoint(XCoordinate=0, YCoordinate=0, ZCoordinate=0)
Y_23 = UnitY(Factor=1)
len_28 = Length(Curve=crv_84)
multiplication_23 = Multiplication(A=len_28, B=Slider(0, range=0..10))
neg_23 = Negative(Value=multiplication_23)
line_101 = LineSDL(Start=pt_178, Direction=Y_23, Length=neg_23)
move_105 = Move(Geometry=geo_153, Motion=line_101)  # -> Geometry, Transform
geo_154 = Geometry(move_105.Geometry)

geo_155 = Geometry(crv_80)
crv_85 = Curve(<curve referenced from the Rhino model>)
pt_179 = ConstructPoint(XCoordinate=0, YCoordinate=0, ZCoordinate=0)
Y_24 = UnitY(Factor=1)
len_29 = Length(Curve=crv_85)
multiplication_24 = Multiplication(A=len_29, B=Slider(0, range=0..10))
neg_24 = Negative(Value=multiplication_24)
line_102 = LineSDL(Start=pt_179, Direction=Y_24, Length=neg_24)
move_106 = Move(Geometry=geo_155, Motion=line_102)  # -> Geometry, Transform
geo_156 = Geometry(move_106.Geometry)

geo_157 = Geometry(crv_79)
crv_86 = Curve(<curve referenced from the Rhino model>)
number_slider_17 = Slider(3, range=0..10)
pt_180 = ConstructPoint(XCoordinate=0, YCoordinate=0, ZCoordinate=0)
Y_25 = UnitY(Factor=1)
len_30 = Length(Curve=crv_86)
multiplication_25 = Multiplication(A=len_30, B=number_slider_17)
neg_25 = Negative(Value=multiplication_25)
line_103 = LineSDL(Start=pt_180, Direction=Y_25, Length=neg_25)
move_107 = Move(Geometry=geo_157, Motion=line_103)  # -> Geometry, Transform
geo_158 = Geometry(move_107.Geometry)

geo_159 = Geometry(pt_175)
crv_87 = Curve(<curve referenced from the Rhino model>)
number_slider_18 = Slider(4, range=0..10)
pt_181 = ConstructPoint(XCoordinate=0, YCoordinate=0, ZCoordinate=0)
Y_26 = UnitY(Factor=1)
len_31 = Length(Curve=crv_87)
multiplication_26 = Multiplication(A=len_31, B=number_slider_17)
neg_26 = Negative(Value=multiplication_26)
line_104 = LineSDL(Start=pt_181, Direction=Y_26, Length=neg_26)
move_108 = Move(Geometry=geo_159, Motion=line_104)  # -> Geometry, Transform
geo_160 = Geometry(move_108.Geometry)

geo_161 = Geometry(crv_81)
crv_88 = Curve(<curve referenced from the Rhino model>)
number_slider_19 = Slider(2, range=0..10)
pt_182 = ConstructPoint(XCoordinate=0, YCoordinate=0, ZCoordinate=0)
Y_27 = UnitY(Factor=1)
len_32 = Length(Curve=crv_88)
multiplication_27 = Multiplication(A=len_32, B=number_slider_19)
neg_27 = Negative(Value=multiplication_27)
line_105 = LineSDL(Start=pt_182, Direction=Y_27, Length=neg_27)
move_109 = Move(Geometry=geo_161, Motion=line_105)  # -> Geometry, Transform
geo_162 = Geometry(move_109.Geometry)

geo_163 = Geometry(pt_177)
crv_89 = Curve(<curve referenced from the Rhino model>)
pt_183 = ConstructPoint(XCoordinate=0, YCoordinate=0, ZCoordinate=0)
Y_28 = UnitY(Factor=1)
len_33 = Length(Curve=crv_89)
multiplication_28 = Multiplication(A=len_33, B=number_slider_19)
neg_28 = Negative(Value=multiplication_28)
line_106 = LineSDL(Start=pt_183, Direction=Y_28, Length=neg_28)
move_110 = Move(Geometry=geo_163, Motion=line_106)  # -> Geometry, Transform
geo_164 = Geometry(move_110.Geometry)

geo_165 = Geometry(crv_82)
crv_90 = Curve(<curve referenced from the Rhino model>)
number_slider_20 = Slider(3, range=0..10)
pt_184 = ConstructPoint(XCoordinate=0, YCoordinate=0, ZCoordinate=0)
Y_29 = UnitY(Factor=1)
len_34 = Length(Curve=crv_90)
multiplication_29 = Multiplication(A=len_34, B=number_slider_20)
neg_29 = Negative(Value=multiplication_29)
line_107 = LineSDL(Start=pt_184, Direction=Y_29, Length=neg_29)
move_111 = Move(Geometry=geo_165, Motion=line_107)  # -> Geometry, Transform
geo_166 = Geometry(move_111.Geometry)

geo_167 = Geometry(crv_83)
crv_91 = Curve(<curve referenced from the Rhino model>)
number_slider_21 = Slider(1, range=0..10)
pt_185 = ConstructPoint(XCoordinate=0, YCoordinate=0, ZCoordinate=0)
Y_30 = UnitY(Factor=1)
len_35 = Length(Curve=crv_91)
multiplication_30 = Multiplication(A=len_35, B=number_slider_21)
neg_30 = Negative(Value=multiplication_30)
line_108 = LineSDL(Start=pt_185, Direction=Y_30, Length=neg_30)
move_112 = Move(Geometry=geo_167, Motion=line_108)  # -> Geometry, Transform
geo_168 = Geometry(move_112.Geometry)

geo_169 = Geometry(pt_174)
crv_92 = Curve(<curve referenced from the Rhino model>)
number_slider_22 = Slider(2, range=0..10)
pt_186 = ConstructPoint(XCoordinate=0, YCoordinate=0, ZCoordinate=0)
Y_31 = UnitY(Factor=1)
len_36 = Length(Curve=crv_92)
multiplication_31 = Multiplication(A=len_36, B=number_slider_21)
neg_31 = Negative(Value=multiplication_31)
line_109 = LineSDL(Start=pt_186, Direction=Y_31, Length=neg_31)
move_113 = Move(Geometry=geo_169, Motion=line_109)  # -> Geometry, Transform
geo_170 = Geometry(move_113.Geometry)

geo_171 = Geometry(pt_176)
crv_93 = Curve(<curve referenced from the Rhino model>)
number_slider_23 = Slider(4, range=0..10)
pt_187 = ConstructPoint(XCoordinate=0, YCoordinate=0, ZCoordinate=0)
Y_32 = UnitY(Factor=1)
len_37 = Length(Curve=crv_93)
multiplication_32 = Multiplication(A=len_37, B=number_slider_20)
neg_32 = Negative(Value=multiplication_32)
line_110 = LineSDL(Start=pt_187, Direction=Y_32, Length=neg_32)
move_114 = Move(Geometry=geo_171, Motion=line_110)  # -> Geometry, Transform
geo_172 = Geometry(move_114.Geometry)

# ----
# SPRINKLER HEADS
# 
# RECESSED
panel_75 = Panel("Curve")
data_51 = Data(flatten(geo_152))
data_52 = Data(flatten(geo_150))
dpipeline_30 = DynamicGeometryPipeline(
    LayerFilter="F-SPRN-N",
    TypeFilter=panel_75,
    NameFilter="*",
    enableFullPath=False,
    GroupByLayer=False,
    GroupByType=False,
    IncludeHidden=True,
    IncludeLocked=True)  # -> flatten(GeometryOut)
dpipeline_31 = DynamicGeometryPipeline(
    LayerFilter="F-DRYP-N",
    TypeFilter="Curve",
    NameFilter="*",
    enableFullPath=False,
    GroupByLayer=False,
    GroupByType=False,
    IncludeHidden=True,
    IncludeLocked=True)  # -> flatten(GeometryOut)
null_24 = NullItem(Item=data_51)  # -> NullFlags, InvalidFlags, Description
null_25 = NullItem(Item=data_52)  # -> NullFlags, InvalidFlags, Description
cull_112 = CullPattern(List=data_51, CullPattern=invert(null_24.NullFlags))
crv_94 = Curve(simplify(dpipeline_30))
crv_95 = Curve(simplify(dpipeline_31))
cull_113 = CullPattern(List=data_52, CullPattern=invert(null_25.NullFlags))
dpipeline_32 = DynamicGeometryPipeline(
    LayerFilter="F-SPRK-HEAD-N",
    TypeFilter="block",
    NameFilter="*",
    enableFullPath=False,
    GroupByLayer=False,
    GroupByType=False,
    IncludeHidden=True,
    IncludeLocked=True)  # -> flatten(GeometryOut)
dpipeline_33 = DynamicGeometryPipeline(
    LayerFilter="F-DRYP-N",
    TypeFilter="block",
    NameFilter="*",
    enableFullPath=False,
    GroupByLayer=False,
    GroupByType=False,
    IncludeHidden=True,
    IncludeLocked=True)  # -> flatten(GeometryOut)

# ----
# SORTING_3
# Curve or Line (run vs symbol)
explode_17 = Explode(Curve=crv_94, Recursive=True)  # -> Segments, Vertices
cp_62 = ControlPoints(Curve=explode_17.Segments)  # -> Points, Weights, Knots
lng_22 = ListLength(List=cp_62.Points)  # -> flatten(Length)
equals_32 = Equality(FirstNumber=lng_22, SecondNumber=9)  # -> Equality, Inequality
cull_114 = CullPattern(List=flatten(explode_17.Segments), CullPattern=equals_32.Equality)
cull_115 = CullPattern(List=flatten(explode_17.Segments), CullPattern=invert(equals_32.Equality))
circle_symbols_16 = Data(cull_114)
line_symbols_13 = Data(cull_115)

# ----
# SORTING_3
# Curve or Line (run vs symbol)
# LEVEL 1
explode_18 = Explode(Curve=crv_95, Recursive=True)  # -> Segments, Vertices
cp_63 = ControlPoints(Curve=explode_18.Segments)  # -> Points, Weights, Knots
lng_23 = ListLength(List=cp_63.Points)  # -> flatten(Length)
equals_33 = Equality(FirstNumber=lng_23, SecondNumber=9)  # -> Equality, Inequality
cull_116 = CullPattern(List=flatten(explode_18.Segments), CullPattern=equals_33.Equality)
cull_117 = CullPattern(List=flatten(explode_18.Segments), CullPattern=invert(equals_33.Equality))
circle_symbols_17 = Data(cull_116)
line_symbols_14 = Data(cull_117)

# ----
# ENDPOINT EXPORT
end_17 = EndPoints(Curve=flatten(cull_112))  # -> Start, End
pdecon_19 = Deconstruct(Point=end_17.Start)  # -> XComponent, YComponent, ZComponent
pdecon_20 = Deconstruct(Point=end_17.End)  # -> XComponent, YComponent, ZComponent
panel_76 = Panel(pdecon_19.XComponent)
panel_77 = Panel(pdecon_19.ZComponent)
panel_78 = Panel(pdecon_19.YComponent)
panel_79 = Panel(pdecon_20.XComponent)
panel_80 = Panel(pdecon_20.YComponent)
panel_81 = Panel(pdecon_20.ZComponent)

blockexplode_5 = ExplodeBlocks(BlockObjects=dpipeline_32, explodeGeom=True)  # -> Geometry, Attributes, BlockName, BoundingBox, BlockTransform
blockexplode_6 = ExplodeBlocks(BlockObjects=dpipeline_33, explodeGeom=True)  # -> Geometry, Attributes, BlockName, BoundingBox, BlockTransform
# LEVEL 1
all_offset_6 = Slider(0, range=0..200)
all_offset_7 = Slider(8, range=0..20)
crv_96 = Curve()
crv_97 = Curve()

# ----
# SINGLE POINT EXPORT
pdecon_21 = Deconstruct(Point=data_52)  # -> XComponent, YComponent, ZComponent
panel_82 = Panel(pdecon_21.XComponent)
panel_83 = Panel(pdecon_21.YComponent)
panel_84 = Panel(pdecon_21.ZComponent)

item_25 = ListItem(List=simplify(blockexplode_5.Geometry), Index=all_offset_6, Wrap=True)
item_26 = ListItem(List=simplify(blockexplode_6.Geometry), Index=all_offset_7, Wrap=True)
crv_98 = Curve(flatten(item_25))
crv_99 = Curve(flatten(item_26))
darc_3 = DeconstructArc(Arc=crv_98)  # -> BasePlane, Radius, Angle
darc_4 = DeconstructArc(Arc=crv_99)  # -> BasePlane, Radius, Angle
data_53 = Data(flatten([geo_156, geo_168, geo_162, geo_158, geo_166]))
data_54 = Data(flatten([geo_154, geo_170, geo_164, geo_160, geo_172]))
null_26 = NullItem(Item=darc_3.BasePlane)  # -> NullFlags, InvalidFlags, Description
null_27 = NullItem(Item=darc_4.BasePlane)  # -> NullFlags, InvalidFlags, Description
offset_41 = Slider(134, range=0..200)
offset_42 = Slider(4, range=0..200)
offset_43 = Slider(-8, range=-20..200)
null_28 = NullItem(Item=data_53)  # -> NullFlags, InvalidFlags, Description

# ----
# SORTING_4
# (Riser VS Drop)
cls_20 = Closed(Curve=circle_symbols_16)  # -> Closed, Periodic
cull_118 = CullPattern(List=circle_symbols_16, CullPattern=invert(cls_20.Closed))
cull_119 = CullPattern(List=circle_symbols_16, CullPattern=cls_20.Closed)
cp_64 = ControlPoints(Curve=cull_118)  # -> Points, Weights, Knots
cp_65 = ControlPoints(Curve=cull_119)  # -> Points, Weights, Knots
pline_47 = PolyLine(Vertices=cp_64.Points, Closed=invert(False))
pline_48 = PolyLine(Vertices=cp_65.Points, Closed=invert(False))
pcen_47 = PolygonCenter(Polyline=pline_47)  # -> CenterV, CenterE
risers_curves_20 = Data(cull_119)
pcen_48 = PolygonCenter(Polyline=pline_48)  # -> CenterV, CenterE
drops_curves_20 = Data(cull_118)
pt_188 = Point(pcen_47.CenterE)
pt_189 = Point(pcen_48.CenterE)
drops_points_20 = Data(pt_188)
risers_points_20 = Data(pt_189)

# ----
# SORTING_4
# (Riser VS Drop)
cls_21 = Closed(Curve=circle_symbols_17)  # -> Closed, Periodic
cull_120 = CullPattern(List=circle_symbols_17, CullPattern=invert(cls_21.Closed))
cull_121 = CullPattern(List=circle_symbols_17, CullPattern=cls_21.Closed)
cp_66 = ControlPoints(Curve=cull_120)  # -> Points, Weights, Knots
cp_67 = ControlPoints(Curve=cull_121)  # -> Points, Weights, Knots
pline_49 = PolyLine(Vertices=cp_66.Points, Closed=invert(False))
pline_50 = PolyLine(Vertices=cp_67.Points, Closed=invert(False))
pcen_49 = PolygonCenter(Polyline=pline_49)  # -> CenterV, CenterE
risers_curves_21 = Data(cull_121)
pcen_50 = PolygonCenter(Polyline=pline_50)  # -> CenterV, CenterE
drops_curves_21 = Data(cull_120)
pt_190 = Point(pcen_49.CenterE)
pt_191 = Point(pcen_50.CenterE)
drops_points_21 = Data(pt_190)
risers_points_21 = Data(pt_191)

null_29 = NullItem(Item=data_54)  # -> NullFlags, InvalidFlags, Description
cull_122 = CullPattern(List=darc_3.BasePlane, CullPattern=invert(null_26.NullFlags))
cull_123 = CullPattern(List=darc_4.BasePlane, CullPattern=invert(null_27.NullFlags))
cull_124 = CullPattern(List=data_53, CullPattern=invert(null_28.NullFlags))
cull_125 = CullPattern(List=data_54, CullPattern=invert(null_29.NullFlags))
addition_5 = Addition(A=offset_41, B=offset_42)
addition_6 = Addition(A=offset_41, B=offset_43)
pt_192 = Point(cull_122)

# ----
# ENDPOINT EXPORT
end_18 = EndPoints(Curve=flatten(cull_124))  # -> Start, End
pdecon_22 = Deconstruct(Point=end_18.Start)  # -> XComponent, YComponent, ZComponent
pdecon_23 = Deconstruct(Point=end_18.End)  # -> XComponent, YComponent, ZComponent
panel_85 = Panel(pdecon_22.XComponent)
panel_86 = Panel(pdecon_22.ZComponent)
panel_87 = Panel(pdecon_22.YComponent)
panel_88 = Panel(pdecon_23.XComponent)
panel_89 = Panel(pdecon_23.YComponent)
panel_90 = Panel(pdecon_23.ZComponent)

pt_193 = Point(cull_123)

# ----
# SINGLE POINT EXPORT
pdecon_24 = Deconstruct(Point=data_54)  # -> XComponent, YComponent, ZComponent
panel_91 = Panel(pdecon_24.XComponent)
panel_92 = Panel(pdecon_24.YComponent)
panel_93 = Panel(pdecon_24.ZComponent)

geo_173 = Geometry(pt_192)
geo_174 = Geometry(pt_192)
geo_175 = Geometry(pt_193)
geo_176 = Geometry(pt_193)
pt_194 = ConstructPoint(XCoordinate=0, YCoordinate=0, ZCoordinate=0)
Z_55 = UnitZ(Factor=1)
pt_195 = ConstructPoint(XCoordinate=0, YCoordinate=0, ZCoordinate=0)
pt_196 = ConstructPoint(XCoordinate=0, YCoordinate=0, ZCoordinate=0)
Z_56 = UnitZ(Factor=1)
Z_57 = UnitZ(Factor=1)
pt_197 = ConstructPoint(XCoordinate=0, YCoordinate=0, ZCoordinate=0)
Z_58 = UnitZ(Factor=1)

# ----
# Offset from Level
offset_44 = Slider(168, range=0..200)
geo_177 = Geometry(risers_points_21)
pt_198 = ConstructPoint(XCoordinate=0, YCoordinate=0, ZCoordinate=0)
Z_59 = UnitZ(Factor=1)
line_111 = LineSDL(Start=pt_198, Direction=Z_59, Length=offset_41)
move_115 = Move(Geometry=geo_177, Motion=line_111)  # -> Geometry, Transform
geo_178 = Geometry(move_115.Geometry)

# ----
# Offset from Level
geo_179 = Geometry(risers_points_20)
pt_199 = ConstructPoint(XCoordinate=0, YCoordinate=0, ZCoordinate=0)
Z_60 = UnitZ(Factor=1)
line_112 = LineSDL(Start=pt_199, Direction=Z_60, Length=offset_41)
move_116 = Move(Geometry=geo_179, Motion=line_112)  # -> Geometry, Transform
geo_180 = Geometry(move_116.Geometry)

# ----
# Offset from Level
line_113 = LineSDL(Start=pt_194, Direction=Z_55, Length=offset_41)
addition_7 = Addition(A=offset_41)

# ----
# Offset from Level
geo_181 = Geometry(line_symbols_13)
pt_200 = ConstructPoint(XCoordinate=0, YCoordinate=0, ZCoordinate=0)
Z_61 = UnitZ(Factor=1)
line_114 = LineSDL(Start=pt_200, Direction=Z_61, Length=addition_7)
move_117 = Move(Geometry=geo_181, Motion=line_114)  # -> Geometry, Transform
geo_182 = Geometry(move_117.Geometry)

line_115 = LineSDL(Start=pt_195, Direction=Z_56, Length=addition_5)
addition_8 = Addition(A=offset_41)

# ----
# Offset from Level
geo_183 = Geometry(line_symbols_14)
pt_201 = ConstructPoint(XCoordinate=0, YCoordinate=0, ZCoordinate=0)
Z_62 = UnitZ(Factor=1)
line_116 = LineSDL(Start=pt_201, Direction=Z_62, Length=addition_8)
move_118 = Move(Geometry=geo_183, Motion=line_116)  # -> Geometry, Transform
geo_184 = Geometry(move_118.Geometry)

# ----
# Offset from Level
line_117 = LineSDL(Start=pt_196, Direction=Z_57, Length=offset_41)
line_118 = LineSDL(Start=pt_197, Direction=Z_58, Length=addition_6)
addition_9 = Addition(A=offset_41)

# ----
# Offset from Level
geo_185 = Geometry(drops_points_20)
pt_202 = ConstructPoint(XCoordinate=0, YCoordinate=0, ZCoordinate=0)
Z_63 = UnitZ(Factor=1)
line_119 = LineSDL(Start=pt_202, Direction=Z_63, Length=addition_9)
move_119 = Move(Geometry=geo_185, Motion=line_119)  # -> Geometry, Transform
geo_186 = Geometry(move_119.Geometry)

addition_10 = Addition(A=offset_41)

# ----
# Offset from Level
geo_187 = Geometry(drops_points_21)
pt_203 = ConstructPoint(XCoordinate=0, YCoordinate=0, ZCoordinate=0)
Z_64 = UnitZ(Factor=1)
line_120 = LineSDL(Start=pt_203, Direction=Z_64, Length=addition_10)
move_120 = Move(Geometry=geo_187, Motion=line_120)  # -> Geometry, Transform
geo_188 = Geometry(move_120.Geometry)

# ----
# Offset from Level
move_121 = Move(Geometry=geo_173, Motion=line_113)  # -> Geometry, Transform
move_122 = Move(Geometry=geo_174, Motion=line_115)  # -> Geometry, Transform
# Offset from Level
move_123 = Move(Geometry=geo_175, Motion=line_117)  # -> Geometry, Transform
move_124 = Move(Geometry=geo_176, Motion=line_118)  # -> Geometry, Transform
geo_189 = Geometry(move_121.Geometry)
geo_190 = Geometry(move_122.Geometry)
geo_191 = Geometry(move_123.Geometry)
geo_192 = Geometry(move_124.Geometry)
pt_204 = Point(geo_186)
pt_205 = Point(geo_188)
ln_33 = Line(StartPoint=geo_190, EndPoint=geo_189)
ln_34 = Line(StartPoint=geo_192, EndPoint=geo_191)
pt_206 = Point(geo_189)
crv_100 = Curve(ln_33)
crv_101 = Curve(ln_34)
ln_35 = Line(StartPoint=drops_points_20, EndPoint=pt_204)
ln_36 = Line(StartPoint=drops_points_21, EndPoint=pt_205)
ln_37 = Line(StartPoint=risers_points_20, EndPoint=geo_180)
ln_38 = Line(StartPoint=risers_points_21, EndPoint=geo_178)
geo_193 = Geometry(pt_206)
geo_194 = Geometry(crv_100)
geo_195 = Geometry(crv_101)
data_55 = Data(flatten(geo_193))
data_56 = Data(flatten(geo_194))
data_57 = Data(flatten(geo_195))
crv_102 = Curve(flatten([ln_35, ln_37, geo_182]))
null_30 = NullItem(Item=data_56)  # -> NullFlags, InvalidFlags, Description
crv_103 = Curve(flatten([ln_36, ln_38, geo_184]))
null_31 = NullItem(Item=data_55)  # -> NullFlags, InvalidFlags, Description
null_32 = NullItem(Item=data_57)  # -> NullFlags, InvalidFlags, Description
end_19 = EndPoints(Curve=crv_102)  # -> Start, End
end_20 = EndPoints(Curve=crv_103)  # -> Start, End
data_58 = Data(flatten(crv_102))
data_59 = Data(flatten(crv_103))
cull_126 = CullPattern(List=data_56, CullPattern=invert(null_30.NullFlags))
cull_127 = CullPattern(List=data_55, CullPattern=invert(null_31.NullFlags))
cull_128 = CullPattern(List=data_57, CullPattern=invert(null_32.NullFlags))
null_33 = NullItem(Item=data_58)  # -> NullFlags, InvalidFlags, Description
null_34 = NullItem(Item=data_59)  # -> NullFlags, InvalidFlags, Description
cull_129 = CullPattern(List=data_58, CullPattern=invert(null_33.NullFlags))
cull_130 = CullPattern(List=data_59, CullPattern=invert(null_34.NullFlags))

# ----
# ENDPOINT EXPORT
end_21 = EndPoints(Curve=flatten(cull_128))  # -> Start, End
pdecon_25 = Deconstruct(Point=end_21.Start)  # -> XComponent, YComponent, ZComponent
pdecon_26 = Deconstruct(Point=end_21.End)  # -> XComponent, YComponent, ZComponent
panel_94 = Panel(pdecon_25.XComponent)
panel_95 = Panel(pdecon_25.ZComponent)
panel_96 = Panel(pdecon_25.YComponent)
panel_97 = Panel(pdecon_26.XComponent)
panel_98 = Panel(pdecon_26.YComponent)
panel_99 = Panel(pdecon_26.ZComponent)

# ----
# ENDPOINT EXPORT
end_22 = EndPoints(Curve=flatten(cull_126))  # -> Start, End
pdecon_27 = Deconstruct(Point=end_22.Start)  # -> XComponent, YComponent, ZComponent
pdecon_28 = Deconstruct(Point=end_22.End)  # -> XComponent, YComponent, ZComponent
panel_100 = Panel(pdecon_27.ZComponent)
panel_101 = Panel(pdecon_27.XComponent)
panel_102 = Panel(pdecon_27.YComponent)
panel_103 = Panel(pdecon_28.XComponent)
panel_104 = Panel(pdecon_28.YComponent)
panel_105 = Panel(pdecon_28.ZComponent)

# ----
# ENDPOINT EXPORT
end_23 = EndPoints(Curve=flatten(cull_129))  # -> Start, End
pdecon_29 = Deconstruct(Point=end_23.Start)  # -> XComponent, YComponent, ZComponent
pdecon_30 = Deconstruct(Point=end_23.End)  # -> XComponent, YComponent, ZComponent
panel_106 = Panel(pdecon_29.XComponent)
panel_107 = Panel(pdecon_29.ZComponent)
panel_108 = Panel(pdecon_29.YComponent)
panel_109 = Panel(pdecon_30.XComponent)
panel_110 = Panel(pdecon_30.YComponent)
panel_111 = Panel(pdecon_30.ZComponent)

# ----
# ENDPOINT EXPORT
end_24 = EndPoints(Curve=flatten(cull_130))  # -> Start, End
pdecon_31 = Deconstruct(Point=end_24.Start)  # -> XComponent, YComponent, ZComponent
pdecon_32 = Deconstruct(Point=end_24.End)  # -> XComponent, YComponent, ZComponent
panel_112 = Panel(pdecon_32.XComponent)
panel_113 = Panel(pdecon_32.YComponent)
panel_114 = Panel(pdecon_32.ZComponent)
panel_115 = Panel(pdecon_31.ZComponent)
panel_116 = Panel(pdecon_31.XComponent)
panel_117 = Panel(pdecon_31.YComponent)

# ----
# SINGLE POINT EXPORT
pdecon_33 = Deconstruct(Point=data_55)  # -> XComponent, YComponent, ZComponent
panel_118 = Panel(pdecon_33.YComponent)
panel_119 = Panel(pdecon_33.ZComponent)
panel_120 = Panel(pdecon_33.XComponent)

# ----
# Mass Crv Intersect
risers_3 = Curve([<curve referenced from the Rhino model> x936])
crv_104 = Curve([<curve referenced from the Rhino model> x952])
graft_5 = GraftTree(Tree=risers_3, IncludeEmptyLists=True, IncludeNullItems=True)  # -> simplify(Tree)

graft_6 = GraftTree(Tree=crv_104, IncludeEmptyLists=True, IncludeNullItems=True)  # -> simplify(Tree)
ccx_6 = CurveCurve(CurveA=graft_5, CurveB=crv_104)  # -> Points, ParamsA, ParamsB

ccx_7 = CurveCurve(CurveA=graft_5, CurveB=graft_6)  # -> Points, ParamsA, ParamsB
pshift_6 = ShiftPaths(Data=ccx_7.Points, Offset=-1)
null_35 = NullItem(Item=pshift_6)  # -> NullFlags, InvalidFlags, Description
cull_131 = CullPattern(List=graft_5, CullPattern=invert(null_35.NullFlags))  # -> flatten(List)

pt_207 = Point(ccx_7.Points)

# ----
# Offset from Level
offset_45 = Slider(0, range=0..200)
geo_196 = Geometry(drops_points_12)
pt_208 = ConstructPoint(XCoordinate=0, YCoordinate=0, ZCoordinate=0)
Z_65 = UnitZ(Factor=1)

addition_11 = Addition(A=offset_45)

line_121 = LineSDL(Start=pt_208, Direction=Z_65, Length=addition_11)
move_125 = Move(Geometry=geo_196, Motion=line_121)  # -> Geometry, Transform
geo_197 = Geometry(move_125.Geometry)

pt_209 = Point(geo_197)
ln_39 = Line(StartPoint=geo_84, EndPoint=pt_209)
crv_105 = Curve([geo_76, ln_39, ln_22])
crv_106 = Curve(flatten(crv_105))

# ----
# ATTRIBUTE TEXT by LEADER
pt_210 = Point(simplify(data_15))
data_60 = Data(flatten(data_16))
crv_cp_2 = CurveClosestPoint(Point=pt_210, Curve=graft(crv_106))  # -> Point, Parameter, Distance
sort_7 = SortList(Keys=crv_cp_2.Distance, ValuesD=data_60)  # -> Keys, ValuesD
item_27 = ListItem(List=sort_7.ValuesD, Index=0, Wrap=True)  # -> simplify(flatten(Item))
crv_107 = Curve(simplify(flatten(crv_106)))

pipe = Pipe(Curve=crv_107, Radius=item_27, Caps=0)

geo_198 = Geometry(crv_107)
crv_108 = Curve(<curve referenced from the Rhino model>)
pt_211 = ConstructPoint(XCoordinate=0, YCoordinate=0, ZCoordinate=0)
Y_33 = UnitY(Factor=1)
len_38 = Length(Curve=crv_108)
multiplication_33 = Multiplication(A=len_38, B=Slider(0, range=0..10))
neg_33 = Negative(Value=multiplication_33)
line_122 = LineSDL(Start=pt_211, Direction=Y_33, Length=neg_33)
move_126 = Move(Geometry=geo_198, Motion=line_122)  # -> Geometry, Transform
geo_199 = Geometry(move_126.Geometry)

data_61 = Data(flatten(geo_199))
data_62 = Data(item_27)
null_36 = NullItem(Item=data_61)  # -> NullFlags, InvalidFlags, Description
cull_132 = CullPattern(List=data_61, CullPattern=invert(null_36.NullFlags))
cull_133 = CullPattern(List=data_62, CullPattern=invert(null_36.NullFlags))
crv_109 = Curve(data_61)
end_25 = EndPoints(Curve=crv_109)  # -> Start, End
end_26 = EndPoints(Curve=flatten(cull_132))  # -> Start, End
pdecon_34 = Deconstruct(Point=end_26.Start)  # -> XComponent, YComponent, ZComponent
pdecon_35 = Deconstruct(Point=end_26.End)  # -> XComponent, YComponent, ZComponent
panel_121 = Panel(pdecon_34.XComponent)
panel_122 = Panel(pdecon_34.YComponent)
panel_123 = Panel(pdecon_34.ZComponent)
panel_124 = Panel(pdecon_35.XComponent)
panel_125 = Panel(pdecon_35.YComponent)
panel_126 = Panel(pdecon_35.ZComponent)
panel_127 = Panel(cull_133)

# ----
# Offset from Level
offset_46 = Slider(0, range=0..200)
geo_200 = Geometry(drops_points_13)
pt_212 = ConstructPoint(XCoordinate=0, YCoordinate=0, ZCoordinate=0)
Z_66 = UnitZ(Factor=1)

addition_12 = Addition(A=offset_46)

line_123 = LineSDL(Start=pt_212, Direction=Z_66, Length=addition_12)
move_127 = Move(Geometry=geo_200, Motion=line_123)  # -> Geometry, Transform
geo_201 = Geometry(move_127.Geometry)

pt_213 = Point(geo_201)
ln_40 = Line(StartPoint=geo_86, EndPoint=pt_213)
crv_110 = Curve([geo_82, ln_40, ln_23])
crv_111 = Curve(flatten(crv_110))

# ----
# ATTRIBUTE TEXT by LEADER
pt_214 = Point(simplify(data_13))
data_63 = Data(flatten(data_14))
crv_cp_3 = CurveClosestPoint(Point=pt_214, Curve=graft(crv_111))  # -> Point, Parameter, Distance
sort_8 = SortList(Keys=crv_cp_3.Distance, ValuesD=data_63)  # -> Keys, ValuesD
item_28 = ListItem(List=sort_8.ValuesD, Index=0, Wrap=True)  # -> simplify(flatten(Item))
crv_112 = Curve(simplify(flatten(crv_111)))

pipe_2 = Pipe(Curve=crv_112, Radius=item_28, Caps=0)

geo_202 = Geometry(crv_112)
crv_113 = Curve(<curve referenced from the Rhino model>)
pt_215 = ConstructPoint(XCoordinate=0, YCoordinate=0, ZCoordinate=0)
Y_34 = UnitY(Factor=1)
len_39 = Length(Curve=crv_113)
multiplication_34 = Multiplication(A=len_39, B=Slider(0, range=0..10))
neg_34 = Negative(Value=multiplication_34)
line_124 = LineSDL(Start=pt_215, Direction=Y_34, Length=neg_34)
move_128 = Move(Geometry=geo_202, Motion=line_124)  # -> Geometry, Transform
geo_203 = Geometry(move_128.Geometry)

data_64 = Data(flatten(geo_203))
data_65 = Data(item_28)
null_37 = NullItem(Item=data_64)  # -> NullFlags, InvalidFlags, Description
cull_134 = CullPattern(List=data_64, CullPattern=invert(null_37.NullFlags))
cull_135 = CullPattern(List=data_65, CullPattern=invert(null_37.NullFlags))
crv_114 = Curve(data_64)
end_27 = EndPoints(Curve=crv_114)  # -> Start, End

# ----
# ENDPOINT EXPORT
end_28 = EndPoints(Curve=flatten(cull_134))  # -> Start, End
pdecon_36 = Deconstruct(Point=end_28.Start)  # -> XComponent, YComponent, ZComponent
pdecon_37 = Deconstruct(Point=end_28.End)  # -> XComponent, YComponent, ZComponent
panel_128 = Panel(pdecon_36.XComponent)
panel_129 = Panel(pdecon_36.YComponent)
panel_130 = Panel(pdecon_36.ZComponent)
panel_131 = Panel(pdecon_37.XComponent)
panel_132 = Panel(pdecon_37.YComponent)
panel_133 = Panel(pdecon_37.ZComponent)

panel_134 = Panel(cull_135)

crv_115 = Curve()
curvepoint_11 = PointOnCurve(crv_115, parameter=0.5)
data_66 = Data(flatten(pt_96))
data_67 = Data(pt_96)
crv_116 = Curve(flatten(crv_115))
pt_216 = Point(simplify(flatten(curvepoint_11)))
dist_6 = Distance(PointA=pt_216, PointB=data_67)
sort_9 = SortList(Keys=dist_6, ValuesB=crv_116)  # -> Keys, ValuesB
item_29 = ListItem(List=sort_9.ValuesB, Index=1, Wrap=True)  # -> flatten(Item)
crv_117 = Curve(flatten(item_29))
crv_cp_4 = CurveClosestPoint(Point=data_66, Curve=crv_117)  # -> Point, Parameter, Distance
larger = LargerThan(FirstNumber=crv_cp_4.Parameter, SecondNumber=0.5)  # -> LargerThan, OrEqualTo
xy_10 = XYPlane(Origin=crv_cp_4.Point)
line_125 = LineSDL(Start=crv_cp_4.Point, Direction=Vector(0, 0, 1), Length=1)
pi = Pi(Factor=1)
cull_136 = CullPattern(List=crv_117, CullPattern=invert(larger.LargerThan))
cull_137 = CullPattern(List=crv_cp_4.Point, CullPattern=invert(larger.LargerThan))
cull_138 = CullPattern(List=crv_117, CullPattern=larger.LargerThan)
cull_139 = CullPattern(List=crv_cp_4.Point, CullPattern=larger.LargerThan)
rotax = RotateAxis(Geometry=xy_10, Angle=pi, Axis=line_125)  # -> Geometry, Transform
end_29 = EndPoints(Curve=cull_136)  # -> Start, End
end_30 = EndPoints(Curve=cull_138)  # -> Start, End
ln_41 = Line(StartPoint=end_29.End, EndPoint=cull_137)
cull_140 = CullPattern(List=rotax.Geometry, CullPattern=larger.LargerThan)
ln_42 = Line(StartPoint=end_30.Start, EndPoint=cull_139)
cull_141 = CullPattern(List=rotax.Geometry, CullPattern=invert(larger.LargerThan))
pl = ConstructPlane(Origin=end_30.Start, XAxis=ln_42, YAxis=Vector(0, 1, 0))
pl_2 = ConstructPlane(Origin=end_29.End, XAxis=ln_41, YAxis=Vector(0, 1, 0))
deplane = DeconstructPlane(Plane=cull_140)  # -> Origin, XAxis, YAxis, ZAxis
deplane_2 = DeconstructPlane(Plane=cull_141)  # -> Origin, XAxis, YAxis, ZAxis
align = AlignPlane(Plane=cull_140, Direction=pl)  # -> Plane, Angle
align_2 = AlignPlane(Plane=cull_141, Direction=pl_2)  # -> Plane, Angle
line_126 = LineSDL(Start=deplane.Origin, Direction=deplane.YAxis, Length=1)
line_127 = LineSDL(Start=deplane_2.Origin, Direction=deplane_2.YAxis, Length=1)
line_128 = LineSDL(Start=deplane.Origin, Direction=Vector(0, 0, 1), Length=1)
line_129 = LineSDL(Start=deplane_2.Origin, Direction=Vector(0, 0, 1), Length=1)
rotax_2 = RotateAxis(Geometry=line_126, Angle=align.Angle, Axis=line_128)  # -> Geometry, Transform
rotax_3 = RotateAxis(Geometry=line_127, Angle=align_2.Angle, Axis=line_129)  # -> Geometry, Transform
end_31 = EndPoints(Curve=rotax_2.Geometry)  # -> Start, End
pt_217 = Point(end_31.Start)
transform = Transform(rotax_2.Transform)

rotax_4 = RotateAxis(Geometry=rotax_3.Geometry, Angle=3.141592654, Axis=line_129)  # -> Geometry, Transform

end_32 = EndPoints(Curve=rotax_4.Geometry)  # -> Start, End
transform_2 = Transform(rotax_4.Transform)
pt_218 = Point(end_32.Start)
data_68 = Data([pt_217, pt_218])
data_69 = Data([transform, transform_2])

geo_204 = Geometry(data_68)
crv_118 = Curve(<curve referenced from the Rhino model>)
number_slider_24 = Slider(4, range=0..10)
pt_219 = ConstructPoint(XCoordinate=0, YCoordinate=0, ZCoordinate=0)
Y_35 = UnitY(Factor=1)
len_40 = Length(Curve=crv_118)
multiplication_35 = Multiplication(A=len_40, B=Slider(3, range=0..10))
neg_35 = Negative(Value=multiplication_35)
line_130 = LineSDL(Start=pt_219, Direction=Y_35, Length=neg_35)
move_129 = Move(Geometry=geo_204, Motion=line_130)  # -> Geometry, Transform
geo_205 = Geometry(move_129.Geometry)

crv_119 = Curve()
curvepoint_12 = PointOnCurve(crv_119, parameter=0.5)
data_70 = Data(flatten(pt_97))
data_71 = Data(pt_97)
crv_120 = Curve(flatten(crv_119))
pt_220 = Point(simplify(flatten(curvepoint_12)))
dist_7 = Distance(PointA=pt_220, PointB=data_71)
sort_10 = SortList(Keys=dist_7, ValuesB=crv_120)  # -> Keys, ValuesB
item_30 = ListItem(List=sort_10.ValuesB, Index=1, Wrap=True)  # -> flatten(Item)
crv_121 = Curve(flatten(item_30))
crv_cp_5 = CurveClosestPoint(Point=data_70, Curve=crv_121)  # -> Point, Parameter, Distance
larger_2 = LargerThan(FirstNumber=crv_cp_5.Parameter, SecondNumber=0.5)  # -> LargerThan, OrEqualTo
xy_11 = XYPlane(Origin=crv_cp_5.Point)
line_131 = LineSDL(Start=crv_cp_5.Point, Direction=Vector(0, 0, 1), Length=1)
pi_2 = Pi(Factor=1)
cull_142 = CullPattern(List=crv_121, CullPattern=invert(larger_2.LargerThan))
cull_143 = CullPattern(List=crv_cp_5.Point, CullPattern=invert(larger_2.LargerThan))
cull_144 = CullPattern(List=crv_121, CullPattern=larger_2.LargerThan)
cull_145 = CullPattern(List=crv_cp_5.Point, CullPattern=larger_2.LargerThan)
rotax_5 = RotateAxis(Geometry=xy_11, Angle=pi_2, Axis=line_131)  # -> Geometry, Transform
end_33 = EndPoints(Curve=cull_142)  # -> Start, End
end_34 = EndPoints(Curve=cull_144)  # -> Start, End
ln_43 = Line(StartPoint=end_33.End, EndPoint=cull_143)
cull_146 = CullPattern(List=rotax_5.Geometry, CullPattern=larger_2.LargerThan)
ln_44 = Line(StartPoint=end_34.Start, EndPoint=cull_145)
cull_147 = CullPattern(List=rotax_5.Geometry, CullPattern=invert(larger_2.LargerThan))
pl_3 = ConstructPlane(Origin=end_34.Start, XAxis=ln_44, YAxis=Vector(0, 1, 0))
pl_4 = ConstructPlane(Origin=end_33.End, XAxis=ln_43, YAxis=Vector(0, 1, 0))
deplane_3 = DeconstructPlane(Plane=cull_146)  # -> Origin, XAxis, YAxis, ZAxis
deplane_4 = DeconstructPlane(Plane=cull_147)  # -> Origin, XAxis, YAxis, ZAxis
align_3 = AlignPlane(Plane=cull_146, Direction=pl_3)  # -> Plane, Angle
align_4 = AlignPlane(Plane=cull_147, Direction=pl_4)  # -> Plane, Angle
line_132 = LineSDL(Start=deplane_3.Origin, Direction=deplane_3.YAxis, Length=1)
line_133 = LineSDL(Start=deplane_4.Origin, Direction=deplane_4.YAxis, Length=1)
line_134 = LineSDL(Start=deplane_3.Origin, Direction=Vector(0, 0, 1), Length=1)
line_135 = LineSDL(Start=deplane_4.Origin, Direction=Vector(0, 0, 1), Length=1)
rotax_6 = RotateAxis(Geometry=line_132, Angle=align_3.Angle, Axis=line_134)  # -> Geometry, Transform
rotax_7 = RotateAxis(Geometry=line_133, Angle=align_4.Angle, Axis=line_135)  # -> Geometry, Transform
end_35 = EndPoints(Curve=rotax_6.Geometry)  # -> Start, End
pt_221 = Point(end_35.Start)
transform_3 = Transform(rotax_6.Transform)

rotax_8 = RotateAxis(Geometry=rotax_7.Geometry, Angle=3.141592654, Axis=line_135)  # -> Geometry, Transform

end_36 = EndPoints(Curve=rotax_8.Geometry)  # -> Start, End
transform_4 = Transform(rotax_8.Transform)
pt_222 = Point(end_36.Start)
data_72 = Data([pt_221, pt_222])
data_73 = Data([transform_3, transform_4])

geo_206 = Geometry(data_72)
crv_122 = Curve(<curve referenced from the Rhino model>)
pt_223 = ConstructPoint(XCoordinate=0, YCoordinate=0, ZCoordinate=0)
Y_36 = UnitY(Factor=1)
len_41 = Length(Curve=crv_122)
multiplication_36 = Multiplication(A=len_41, B=Slider(2, range=0..10))
neg_36 = Negative(Value=multiplication_36)
line_136 = LineSDL(Start=pt_223, Direction=Y_36, Length=neg_36)
move_130 = Move(Geometry=geo_206, Motion=line_136)  # -> Geometry, Transform
geo_207 = Geometry(move_130.Geometry)

crv_123 = Curve()
curvepoint_13 = PointOnCurve(crv_123, parameter=0.5)
data_74 = Data(pt_98)
data_75 = Data(flatten(pt_98))
crv_124 = Curve(flatten(crv_123))
pt_224 = Point(simplify(flatten(curvepoint_13)))
dist_8 = Distance(PointA=pt_224, PointB=data_74)
sort_11 = SortList(Keys=dist_8, ValuesB=crv_124)  # -> Keys, ValuesB
item_31 = ListItem(List=sort_11.ValuesB, Index=1, Wrap=True)  # -> flatten(Item)
crv_125 = Curve(flatten(item_31))
crv_cp_6 = CurveClosestPoint(Point=data_75, Curve=crv_125)  # -> Point, Parameter, Distance
larger_3 = LargerThan(FirstNumber=crv_cp_6.Parameter, SecondNumber=0.5)  # -> LargerThan, OrEqualTo
xy_12 = XYPlane(Origin=crv_cp_6.Point)
line_137 = LineSDL(Start=crv_cp_6.Point, Direction=Vector(0, 0, 1), Length=1)
pi_3 = Pi(Factor=1)
cull_148 = CullPattern(List=crv_125, CullPattern=invert(larger_3.LargerThan))
cull_149 = CullPattern(List=crv_cp_6.Point, CullPattern=invert(larger_3.LargerThan))
cull_150 = CullPattern(List=crv_125, CullPattern=larger_3.LargerThan)
cull_151 = CullPattern(List=crv_cp_6.Point, CullPattern=larger_3.LargerThan)
rotax_9 = RotateAxis(Geometry=xy_12, Angle=pi_3, Axis=line_137)  # -> Geometry, Transform
end_37 = EndPoints(Curve=cull_148)  # -> Start, End
end_38 = EndPoints(Curve=cull_150)  # -> Start, End
ln_45 = Line(StartPoint=end_37.End, EndPoint=cull_149)
cull_152 = CullPattern(List=rotax_9.Geometry, CullPattern=larger_3.LargerThan)
ln_46 = Line(StartPoint=end_38.Start, EndPoint=cull_151)
cull_153 = CullPattern(List=rotax_9.Geometry, CullPattern=invert(larger_3.LargerThan))
pl_5 = ConstructPlane(Origin=end_38.Start, XAxis=ln_46, YAxis=Vector(0, 1, 0))
pl_6 = ConstructPlane(Origin=end_37.End, XAxis=ln_45, YAxis=Vector(0, 1, 0))
deplane_5 = DeconstructPlane(Plane=cull_152)  # -> Origin, XAxis, YAxis, ZAxis
deplane_6 = DeconstructPlane(Plane=cull_153)  # -> Origin, XAxis, YAxis, ZAxis
align_5 = AlignPlane(Plane=cull_152, Direction=pl_5)  # -> Plane, Angle
align_6 = AlignPlane(Plane=cull_153, Direction=pl_6)  # -> Plane, Angle
line_138 = LineSDL(Start=deplane_5.Origin, Direction=deplane_5.YAxis, Length=1)
line_139 = LineSDL(Start=deplane_6.Origin, Direction=deplane_6.YAxis, Length=1)
line_140 = LineSDL(Start=deplane_5.Origin, Direction=Vector(0, 0, 1), Length=1)
line_141 = LineSDL(Start=deplane_6.Origin, Direction=Vector(0, 0, 1), Length=1)
rotax_10 = RotateAxis(Geometry=line_138, Angle=align_5.Angle, Axis=line_140)  # -> Geometry, Transform
rotax_11 = RotateAxis(Geometry=line_139, Angle=align_6.Angle, Axis=line_141)  # -> Geometry, Transform
end_39 = EndPoints(Curve=rotax_10.Geometry)  # -> Start, End
pt_225 = Point(end_39.Start)
transform_5 = Transform(rotax_10.Transform)

rotax_12 = RotateAxis(Geometry=rotax_11.Geometry, Angle=3.141592654, Axis=line_141)  # -> Geometry, Transform

end_40 = EndPoints(Curve=rotax_12.Geometry)  # -> Start, End
transform_6 = Transform(rotax_12.Transform)
pt_226 = Point(end_40.Start)
data_76 = Data([pt_225, pt_226])
data_77 = Data([transform_5, transform_6])

geo_208 = Geometry(data_76)
crv_126 = Curve(<curve referenced from the Rhino model>)
pt_227 = ConstructPoint(XCoordinate=0, YCoordinate=0, ZCoordinate=0)
Y_37 = UnitY(Factor=1)
len_42 = Length(Curve=crv_126)
multiplication_37 = Multiplication(A=len_42, B=Slider(1, range=0..10))
neg_37 = Negative(Value=multiplication_37)
line_142 = LineSDL(Start=pt_227, Direction=Y_37, Length=neg_37)
move_131 = Move(Geometry=geo_208, Motion=line_142)  # -> Geometry, Transform
geo_209 = Geometry(move_131.Geometry)

crv_127 = Curve(reparameterize(graft(crv_107)))
curvepoint_14 = PointOnCurve(crv_127, parameter=0.5)
data_78 = Data(flatten(pt_109))
data_79 = Data(pt_109)
crv_128 = Curve(flatten(crv_127))
pt_228 = Point(simplify(flatten(curvepoint_14)))
dist_9 = Distance(PointA=pt_228, PointB=data_79)
sort_12 = SortList(Keys=dist_9, ValuesB=crv_128)  # -> Keys, ValuesB
item_32 = ListItem(List=sort_12.ValuesB, Index=1, Wrap=True)  # -> flatten(Item)
crv_129 = Curve(flatten(item_32))
crv_cp_7 = CurveClosestPoint(Point=data_78, Curve=crv_129)  # -> Point, Parameter, Distance
larger_4 = LargerThan(FirstNumber=crv_cp_7.Parameter, SecondNumber=0.5)  # -> LargerThan, OrEqualTo
xy_13 = XYPlane(Origin=crv_cp_7.Point)
line_143 = LineSDL(Start=crv_cp_7.Point, Direction=Vector(0, 0, 1), Length=1)
pi_4 = Pi(Factor=1)
cull_154 = CullPattern(List=crv_129, CullPattern=invert(larger_4.LargerThan))
cull_155 = CullPattern(List=crv_cp_7.Point, CullPattern=invert(larger_4.LargerThan))
cull_156 = CullPattern(List=crv_129, CullPattern=larger_4.LargerThan)
cull_157 = CullPattern(List=crv_cp_7.Point, CullPattern=larger_4.LargerThan)
rotax_13 = RotateAxis(Geometry=xy_13, Angle=pi_4, Axis=line_143)  # -> Geometry, Transform
end_41 = EndPoints(Curve=cull_154)  # -> Start, End
end_42 = EndPoints(Curve=cull_156)  # -> Start, End
ln_47 = Line(StartPoint=end_41.End, EndPoint=cull_155)
cull_158 = CullPattern(List=rotax_13.Geometry, CullPattern=larger_4.LargerThan)
ln_48 = Line(StartPoint=end_42.Start, EndPoint=cull_157)
cull_159 = CullPattern(List=rotax_13.Geometry, CullPattern=invert(larger_4.LargerThan))
pl_7 = ConstructPlane(Origin=end_42.Start, XAxis=ln_48, YAxis=Vector(0, 1, 0))
pl_8 = ConstructPlane(Origin=end_41.End, XAxis=ln_47, YAxis=Vector(0, 1, 0))
deplane_7 = DeconstructPlane(Plane=cull_158)  # -> Origin, XAxis, YAxis, ZAxis
deplane_8 = DeconstructPlane(Plane=cull_159)  # -> Origin, XAxis, YAxis, ZAxis
align_7 = AlignPlane(Plane=cull_158, Direction=pl_7)  # -> Plane, Angle
align_8 = AlignPlane(Plane=cull_159, Direction=pl_8)  # -> Plane, Angle
line_144 = LineSDL(Start=deplane_7.Origin, Direction=deplane_7.YAxis, Length=1)
line_145 = LineSDL(Start=deplane_8.Origin, Direction=deplane_8.YAxis, Length=1)
line_146 = LineSDL(Start=deplane_7.Origin, Direction=Vector(0, 0, 1), Length=1)
line_147 = LineSDL(Start=deplane_8.Origin, Direction=Vector(0, 0, 1), Length=1)
rotax_14 = RotateAxis(Geometry=line_145, Angle=align_8.Angle, Axis=line_147)  # -> Geometry, Transform
rotax_15 = RotateAxis(Geometry=line_144, Angle=align_7.Angle, Axis=line_146)  # -> Geometry, Transform
end_43 = EndPoints(Curve=rotax_15.Geometry)  # -> Start, End
pt_229 = Point(end_43.Start)
transform_7 = Transform(rotax_15.Transform)

rotax_16 = RotateAxis(Geometry=rotax_14.Geometry, Angle=3.141592654, Axis=line_147)  # -> Geometry, Transform

end_44 = EndPoints(Curve=rotax_16.Geometry)  # -> Start, End
transform_8 = Transform(rotax_16.Transform)
pt_230 = Point(end_44.Start)
data_80 = Data([pt_229, pt_230])
data_81 = Data([transform_7, transform_8])

geo_210 = Geometry(data_80)
crv_130 = Curve(<curve referenced from the Rhino model>)
pt_231 = ConstructPoint(XCoordinate=0, YCoordinate=0, ZCoordinate=0)
Y_38 = UnitY(Factor=1)
len_43 = Length(Curve=crv_130)
multiplication_38 = Multiplication(A=len_43, B=Slider(0, range=0..10))
neg_38 = Negative(Value=multiplication_38)
line_148 = LineSDL(Start=pt_231, Direction=Y_38, Length=neg_38)
move_132 = Move(Geometry=geo_210, Motion=line_148)  # -> Geometry, Transform

data_82 = Data([data_81, data_77, data_73, data_69])
data_83 = Data(flatten([move_132.Geometry, geo_209, geo_207, geo_205]))
null_38 = NullItem(Item=data_83)  # -> NullFlags, InvalidFlags, Description
cull_160 = CullPattern(List=data_83, CullPattern=invert(null_38.NullFlags))

# ----
# SINGLE POINT EXPORT
pdecon_38 = Deconstruct(Point=data_83)  # -> XComponent, YComponent, ZComponent
panel_135 = Panel(pdecon_38.XComponent)
panel_136 = Panel(pdecon_38.YComponent)
panel_137 = Panel(pdecon_38.ZComponent)

panel_138 = Panel(data_82)

# ----
# Offset from Level
offset_47 = Slider(115, range=0..200)
geo_211 = Geometry(line_symbols_7)
pt_232 = ConstructPoint(XCoordinate=0, YCoordinate=0, ZCoordinate=0)
Z_67 = UnitZ(Factor=1)

addition_13 = Addition(A=offset_47)

line_149 = LineSDL(Start=pt_232, Direction=Z_67, Length=addition_13)
move_133 = Move(Geometry=geo_211, Motion=line_149)  # -> Geometry, Transform
geo_212 = Geometry(move_133.Geometry)

# ----
# Offset from Level
offset_48 = Slider(115, range=0..200)
geo_213 = Geometry(drops_points_14)
pt_233 = ConstructPoint(XCoordinate=0, YCoordinate=0, ZCoordinate=0)
Z_68 = UnitZ(Factor=1)

addition_14 = Addition(A=offset_48)

# ----
# Offset from Level
geo_214 = Geometry(risers_points_14)
pt_234 = ConstructPoint(XCoordinate=0, YCoordinate=0, ZCoordinate=0)
Z_69 = UnitZ(Factor=1)
line_150 = LineSDL(Start=pt_234, Direction=Z_69, Length=addition_14)
move_134 = Move(Geometry=geo_214, Motion=line_150)  # -> Geometry, Transform
geo_215 = Geometry(move_134.Geometry)

line_151 = LineSDL(Start=pt_233, Direction=Z_68, Length=addition_14)
move_135 = Move(Geometry=geo_213, Motion=line_151)  # -> Geometry, Transform
geo_216 = Geometry(move_135.Geometry)

pt_235 = Point(geo_216)
ln_49 = Line(StartPoint=drops_points_14, EndPoint=pt_235)
ln_50 = Line(StartPoint=geo_215, EndPoint=geo_120)
crv_131 = Curve(flatten([ln_49, ln_50, geo_212]))

crv_cp_8 = CurveClosestPoint(Point=item_19, Curve=graft(crv_131))  # -> Point, Parameter, Distance
sort_13 = SortList(Keys=crv_cp_8.Distance, ValuesD=data_40)  # -> Keys, ValuesD
item_33 = ListItem(List=sort_13.ValuesD, Index=0, Wrap=True)  # -> simplify(flatten(Item))

crv_cp_9 = CurveClosestPoint(Point=item_20, Curve=graft(crv_131))  # -> Point, Parameter, Distance
sort_14 = SortList(Keys=crv_cp_9.Distance, ValuesD=data_44)  # -> Keys, ValuesD
item_34 = ListItem(List=sort_14.ValuesD, Index=0, Wrap=True)  # -> simplify(flatten(Item))

geo_217 = Geometry(crv_131)
crv_132 = Curve(<curve referenced from the Rhino model>)
pt_236 = ConstructPoint(XCoordinate=0, YCoordinate=0, ZCoordinate=0)
Y_39 = UnitY(Factor=1)
len_44 = Length(Curve=crv_132)
multiplication_39 = Multiplication(A=len_44, B=Slider(3, range=0..10))
neg_39 = Negative(Value=multiplication_39)
line_152 = LineSDL(Start=pt_236, Direction=Y_39, Length=neg_39)
move_136 = Move(Geometry=geo_217, Motion=line_152)  # -> Geometry, Transform
geo_218 = Geometry(move_136.Geometry)

# ----
# Offset from Level
offset_49 = Slider(146, range=0..200)
geo_219 = Geometry(line_symbols_9)
pt_237 = ConstructPoint(XCoordinate=0, YCoordinate=0, ZCoordinate=0)
Z_70 = UnitZ(Factor=1)

addition_15 = Addition(A=offset_49)
addition_16 = Addition(A=offset_49)

# ----
# Offset from Level
geo_220 = Geometry(drops_points_16)
pt_238 = ConstructPoint(XCoordinate=0, YCoordinate=0, ZCoordinate=0)
Z_71 = UnitZ(Factor=1)
line_153 = LineSDL(Start=pt_238, Direction=Z_71, Length=addition_16)
move_137 = Move(Geometry=geo_220, Motion=line_153)  # -> Geometry, Transform
geo_221 = Geometry(move_137.Geometry)

line_154 = LineSDL(Start=pt_237, Direction=Z_70, Length=addition_15)
move_138 = Move(Geometry=geo_219, Motion=line_154)  # -> Geometry, Transform
geo_222 = Geometry(move_138.Geometry)

pt_239 = Point(geo_221)
ln_51 = Line(StartPoint=drops_points_16, EndPoint=pt_239)
crv_133 = Curve(flatten([ln_51, ln_25, geo_222]))
end_45 = EndPoints(Curve=crv_133)  # -> Start, End

geo_223 = Geometry(crv_133)
crv_134 = Curve(<curve referenced from the Rhino model>)
pt_240 = ConstructPoint(XCoordinate=0, YCoordinate=0, ZCoordinate=0)
Y_40 = UnitY(Factor=1)
len_45 = Length(Curve=crv_134)
multiplication_40 = Multiplication(A=len_45, B=Slider(1, range=0..10))
neg_40 = Negative(Value=multiplication_40)
line_155 = LineSDL(Start=pt_240, Direction=Y_40, Length=neg_40)
move_139 = Move(Geometry=geo_223, Motion=line_155)  # -> Geometry, Transform
geo_224 = Geometry(move_139.Geometry)

crv_cp_10 = CurveClosestPoint(Point=item_22, Curve=graft(crv_133))  # -> Point, Parameter, Distance
sort_15 = SortList(Keys=crv_cp_10.Distance, ValuesD=data_46)  # -> Keys, ValuesD
item_35 = ListItem(List=sort_15.ValuesD, Index=0, Wrap=True)  # -> simplify(flatten(Item))

# ----
# Offset from Level
offset_50 = Slider(115, range=0..200)
geo_225 = Geometry(line_symbols_8)
pt_241 = ConstructPoint(XCoordinate=0, YCoordinate=0, ZCoordinate=0)
Z_72 = UnitZ(Factor=1)

addition_17 = Addition(A=offset_50)

line_156 = LineSDL(Start=pt_241, Direction=Z_72, Length=addition_17)
move_140 = Move(Geometry=geo_225, Motion=line_156)  # -> Geometry, Transform
geo_226 = Geometry(move_140.Geometry)

crv_135 = Curve(flatten([ln_24, geo_226]))

geo_227 = Geometry(crv_135)
crv_136 = Curve(<curve referenced from the Rhino model>)
pt_242 = ConstructPoint(XCoordinate=0, YCoordinate=0, ZCoordinate=0)
Y_41 = UnitY(Factor=1)
len_46 = Length(Curve=crv_136)
multiplication_41 = Multiplication(A=len_46, B=Slider(2, range=0..10))
neg_41 = Negative(Value=multiplication_41)
line_157 = LineSDL(Start=pt_242, Direction=Y_41, Length=neg_41)
move_141 = Move(Geometry=geo_227, Motion=line_157)  # -> Geometry, Transform
geo_228 = Geometry(move_141.Geometry)

crv_cp_11 = CurveClosestPoint(Point=item_21, Curve=graft(crv_135))  # -> Point, Parameter, Distance
sort_16 = SortList(Keys=crv_cp_11.Distance, ValuesD=data_45)  # -> Keys, ValuesD
item_36 = ListItem(List=sort_16.ValuesD, Index=0, Wrap=True)  # -> simplify(flatten(Item))

data_84 = Data(flatten([geo_218, geo_228, geo_224]))
null_39 = NullItem(Item=data_84)  # -> NullFlags, InvalidFlags, Description
data_85 = Data([item_34, item_36, item_35])
cull_161 = CullPattern(List=data_84, CullPattern=invert(null_39.NullFlags))
cull_162 = CullPattern(List=data_85, CullPattern=invert(null_39.NullFlags))

# ----
# ENDPOINT EXPORT
end_46 = EndPoints(Curve=flatten(cull_161))  # -> Start, End
pdecon_39 = Deconstruct(Point=end_46.Start)  # -> XComponent, YComponent, ZComponent
pdecon_40 = Deconstruct(Point=end_46.End)  # -> XComponent, YComponent, ZComponent
panel_139 = Panel(pdecon_39.XComponent)
panel_140 = Panel(pdecon_39.ZComponent)
panel_141 = Panel(pdecon_40.XComponent)
panel_142 = Panel(pdecon_39.YComponent)
panel_143 = Panel(pdecon_40.YComponent)
panel_144 = Panel(pdecon_40.ZComponent)

panel_145 = Panel(cull_162)
