# Grasshopper definition 02 Level 2.gh (Grasshopper 0.9.70)
# plug-ins: HDTReference

# PIPES FP_DRY
level_4 = Slider(530, range=0..1000)
# SPRINKLER HEADS
# 
# RECESSED
data = Data()
level_4_2 = Slider(530, range=0..1000)

dpipeline = DynamicGeometryPipeline(
    LayerFilter="PIPESPC",
    TypeFilter="text",
    NameFilter="*",
    enableFullPath=False,
    GroupByLayer=False,
    GroupByType=False,
    IncludeHidden=True,
    IncludeLocked=True)
data_text = Data(dpipeline)
txtobjinfo = TextObjectInfo(TextObjects=data_text)  # -> Plane, Text, Size, Alignment, VerticalAlignment
null = NullItem(Item=txtobjinfo.Plane)  # -> NullFlags, InvalidFlags, Description
cull = CullPattern(List=txtobjinfo.Plane, CullPattern=invert(null.NullFlags))
cull_2 = CullPattern(List=txtobjinfo.Text, CullPattern=invert(null.NullFlags))

dpipeline_2 = DynamicGeometryPipeline(
    LayerFilter="PIPEBL",
    TypeFilter="Curve",
    NameFilter="*",
    enableFullPath=False,
    GroupByLayer=False,
    GroupByType=False,
    IncludeHidden=True,
    IncludeLocked=True)  # -> flatten(GeometryOut)
dpipeline_3 = DynamicGeometryPipeline(
    LayerFilter="pipemn",
    TypeFilter="Curve",
    NameFilter="*",
    enableFullPath=False,
    GroupByLayer=False,
    GroupByType=False,
    IncludeHidden=True,
    IncludeLocked=True)  # -> flatten(GeometryOut)

dpipeline_4 = DynamicGeometryPipeline(
    LayerFilter="PIPESPC",
    TypeFilter="text",
    NameFilter="*",
    enableFullPath=False,
    GroupByLayer=False,
    GroupByType=False,
    IncludeHidden=True,
    IncludeLocked=True)
data_text_2 = Data(dpipeline_4)
txtobjinfo_2 = TextObjectInfo(TextObjects=data_text_2)  # -> Plane, Text, Size, Alignment, VerticalAlignment
null_2 = NullItem(Item=txtobjinfo_2.Plane)  # -> NullFlags, InvalidFlags, Description
cull_3 = CullPattern(List=txtobjinfo_2.Plane, CullPattern=invert(null_2.NullFlags))
cull_4 = CullPattern(List=txtobjinfo_2.Text, CullPattern=invert(null_2.NullFlags))

crv = Curve(simplify(dpipeline_3))

# ----
# SORTING_3
# Curve or Line (run vs symbol)
explode = Explode(Curve=crv, Recursive=True)  # -> Segments, Vertices
cp = ControlPoints(Curve=explode.Segments)  # -> Points, Weights, Knots
lng = ListLength(List=cp.Points)  # -> flatten(Length)
equals = Equality(FirstNumber=lng, SecondNumber=9)  # -> Equality, Inequality
cull_5 = CullPattern(List=flatten(explode.Segments), CullPattern=equals.Equality)
cull_6 = CullPattern(List=flatten(explode.Segments), CullPattern=invert(equals.Equality))
circle_symbols = Data(cull_5)
line_symbols = Data(cull_6)

crv_2 = Curve(simplify(dpipeline_2))
explode_2 = Explode(Curve=crv_2, Recursive=True)  # -> Segments, Vertices
all_offset = Slider(0, range=0..200)
all_offset_2 = Slider(23, range=0..200)
all_offset_3 = Slider(13, range=0..200)
dpipeline_5 = DynamicGeometryPipeline(
    LayerFilter="headdn",
    TypeFilter="block",
    NameFilter="*",
    enableFullPath=False,
    GroupByLayer=False,
    GroupByType=False,
    IncludeHidden=True,
    IncludeLocked=True)  # -> flatten(GeometryOut)
dpipeline_6 = DynamicGeometryPipeline(
    LayerFilter="headdn",
    TypeFilter="block",
    NameFilter="*",
    enableFullPath=False,
    GroupByLayer=False,
    GroupByType=False,
    IncludeHidden=True,
    IncludeLocked=True)  # -> flatten(GeometryOut)
cp_2 = ControlPoints(Curve=explode_2.Segments)  # -> Points, Weights, Knots
all_offset_4 = Slider(0, range=0..200)
offset = Slider(98, range=0..200)
offset_2 = Slider(93, range=0..200)
lng_2 = ListLength(List=cp_2.Points)  # -> flatten(Length)

pt = Point(cull)

blockexplode = ExplodeBlocks(BlockObjects=dpipeline_5, explodeGeom=True)  # -> Geometry, Attributes, BlockName, BoundingBox, BlockTransform
blockexplode_2 = ExplodeBlocks(BlockObjects=dpipeline_6, explodeGeom=True)  # -> simplify(Geometry), Attributes, flatten(BlockName), BoundingBox, BlockTransform
data_2 = Data(flatten(blockexplode.BlockName))
equals_2 = Equality(FirstNumber=lng_2, SecondNumber=9)  # -> Equality, Inequality
sort = SortList(Keys=data_2)  # -> Keys, ValuesA
cull_7 = CullPattern(List=flatten(explode_2.Segments), CullPattern=equals_2.Equality)
tmatch = MatchText(Text=flatten(blockexplode.BlockName), Pattern="dpend2", Case=True)
tmatch_2 = MatchText(Text=flatten(blockexplode.BlockName), Pattern="dpend1", Case=True)
cull_8 = CullPattern(List=flatten(explode_2.Segments), CullPattern=invert(equals_2.Equality))
item = ListItem(List=simplify(blockexplode.Geometry), Index=all_offset, Wrap=True)  # -> flatten(Item)
item_2 = ListItem(List=simplify(blockexplode.Geometry), Index=all_offset_2, Wrap=True)  # -> flatten(Item)
tmatch_3 = MatchText(Text=blockexplode_2.BlockName, Pattern="side2", Case=True)
panel = Panel(data_2)
item_3 = ListItem(List=simplify(blockexplode_2.Geometry), Index=all_offset_3, Wrap=True)  # -> flatten(Item)

pt_2 = Point(cull_3)

item_4 = ListItem(List=simplify(blockexplode_2.Geometry), Index=all_offset_4, Wrap=True)  # -> flatten(Item)
panel_2 = Panel(tmatch_3)
circle_symbols_2 = Data(cull_7)
ps__convert_number = CSharpScript(x=cull_2)  # -> out, A; inputs x: list of String
# ---------- ps__convert_number: C# ----------
    List<double> dists = new List<double>();

    foreach(string s in x)
    {
      string n = "";
      for(int i = 0; i <= s.Length - 1; i++)
      {
        if(Char.IsDigit(s, i))
        {
          n += s[i];
        }
      }

      char [] split = n.ToCharArray();

      if(split.Length == 0)
      {
        Print("fail");
        double d = 2.0;
        dists.Add(d);
      }
      else
      {

        double d = (double) Char.GetNumericValue(split[0]);

        if(split.Length == 3)
        {
          d = d + (double) Char.GetNumericValue(split[1])
            / (double) Char.GetNumericValue(split[2]);
        }

        dists.Add(d);
      }


      //   Print(d.ToString());
    }

    A = dists;
# ---------- end ps__convert_number ----------
line_symbols_2 = Data(cull_8)
cull_9 = CullPattern(List=item_3, CullPattern=tmatch_3)  # -> flatten(List)
cull_10 = CullPattern(List=item_4, CullPattern=tmatch_3)  # -> flatten(List)
cull_11 = CullPattern(List=item_2, CullPattern=tmatch_2)
cull_12 = CullPattern(List=item, CullPattern=tmatch)
ps__convert_number_2 = CSharpScript(x=cull_4)  # -> out, A; inputs x: list of String; same code as ps__convert_number
crv_3 = Curve(flatten(cull_12))
curvepoint = PointOnCurve(cull_9, parameter=0.5)
crv_4 = Curve(flatten(cull_11))
curvepoint_2 = PointOnCurve(cull_10, parameter=0.5)
preview = CustomPreview(
    Geometry=item,
    Shader={ambient=RGB(0, 0, 0), diffuse=RGB(255, 105, 180), emission=RGB(76, 32, 54), shine=0.5, specular=RGB(255, 255, 255), transparency=0})
darc = DeconstructArc(Arc=crv_3)  # -> BasePlane, Radius, Angle
darc_2 = DeconstructArc(Arc=crv_4)  # -> BasePlane, Radius, Angle

# ----
# SORTING_4
# (Riser VS Drop)
cls = Closed(Curve=circle_symbols_2)  # -> Closed, Periodic
cull_13 = CullPattern(List=circle_symbols_2, CullPattern=invert(cls.Closed))
cull_14 = CullPattern(List=circle_symbols_2, CullPattern=cls.Closed)
cp_3 = ControlPoints(Curve=cull_13)  # -> Points, Weights, Knots
cp_4 = ControlPoints(Curve=cull_14)  # -> Points, Weights, Knots
pline = PolyLine(Vertices=cp_3.Points, Closed=invert(False))
pline_2 = PolyLine(Vertices=cp_4.Points, Closed=invert(False))
pcen = PolygonCenter(Polyline=pline)  # -> CenterV, CenterE
risers_curves = Data(cull_14)
pcen_2 = PolygonCenter(Polyline=pline_2)  # -> CenterV, CenterE
drops_curves = Data(cull_13)
pt_3 = Point(pcen.CenterE)
pt_4 = Point(pcen_2.CenterE)
drops_points = Data(pt_3)
risers_points = Data(pt_4)

end = EndPoints(Curve=cull_9)  # -> Start, End
ln = Line(StartPoint=curvepoint_2, EndPoint=curvepoint)

# ----
# SORTING_4
# (Riser VS Drop)
cls_2 = Closed(Curve=circle_symbols)  # -> Closed, Periodic
cull_15 = CullPattern(List=circle_symbols, CullPattern=invert(cls_2.Closed))
cull_16 = CullPattern(List=circle_symbols, CullPattern=cls_2.Closed)
cp_5 = ControlPoints(Curve=cull_15)  # -> Points, Weights, Knots
cp_6 = ControlPoints(Curve=cull_16)  # -> Points, Weights, Knots
pline_3 = PolyLine(Vertices=cp_5.Points, Closed=invert(False))
pline_4 = PolyLine(Vertices=cp_6.Points, Closed=invert(False))
pcen_3 = PolygonCenter(Polyline=pline_3)  # -> CenterV, CenterE
pcen_4 = PolygonCenter(Polyline=pline_4)  # -> CenterV, CenterE
risers_curves_2 = Data(cull_16)
drops_curves_2 = Data(cull_15)
pt_5 = Point(pcen_3.CenterE)
pt_6 = Point(pcen_4.CenterE)
drops_points_2 = Data(pt_5)
risers_points_2 = Data(pt_6)

null_3 = NullItem(Item=darc.BasePlane)  # -> NullFlags, InvalidFlags, Description
panel_3 = Panel(ps__convert_number.A)
null_4 = NullItem(Item=darc_2.BasePlane)  # -> NullFlags, InvalidFlags, Description
curvepoint_3 = PointOnCurve(ln, parameter=0.5)
panel_4 = Panel(ps__convert_number_2.A)
pt_7 = Point(end.Start)
cull_17 = CullPattern(List=darc_2.BasePlane, CullPattern=invert(null_4.NullFlags))
cull_18 = CullPattern(List=darc.BasePlane, CullPattern=invert(null_3.NullFlags))
pt_8 = Point(cull_17)
null_5 = NullItem(Item=pt_7)  # -> NullFlags, InvalidFlags, Description
cull_19 = CullPattern(List=pt_7, CullPattern=invert(null_5.NullFlags))
pt_9 = Point([cull_18, pt_8])
geo = Geometry(pt_9)

# ----
# Offset from Level
geo_2 = Geometry(pt_9)
pt_10 = ConstructPoint(XCoordinate=0, YCoordinate=0, ZCoordinate=0)
Z = UnitZ(Factor=1)
line = LineSDL(Start=pt_10, Direction=Z, Length=offset)
move = Move(Geometry=geo_2, Motion=line)  # -> Geometry, Transform
geo_3 = Geometry(move.Geometry)

pt_11 = ConstructPoint(XCoordinate=0, YCoordinate=0, ZCoordinate=0)
Z_2 = UnitZ(Factor=1)
Z_3 = UnitZ(Factor=1)
addition = Addition(A=offset, B=2)

# ----
# Offset from Level
offset_3 = Slider(106, range=0..200)
geo_4 = Geometry(line_symbols)
pt_12 = ConstructPoint(XCoordinate=0, YCoordinate=0, ZCoordinate=0)
Z_4 = UnitZ(Factor=1)
addition_2 = Addition(A=offset)
line_2 = LineSDL(Start=pt_12, Direction=Z_4, Length=addition_2)
move_2 = Move(Geometry=geo_4, Motion=line_2)  # -> Geometry, Transform
geo_5 = Geometry(move_2.Geometry)

# ----
# Offset from Level
line_3 = LineSDL(Start=pt_11, Direction=Z_2, Length=offset_2)

# ----
# Offset from Level
offset_4 = Slider(170, range=0..200)
geo_6 = Geometry(risers_points)
pt_13 = ConstructPoint(XCoordinate=0, YCoordinate=0, ZCoordinate=0)
Z_5 = UnitZ(Factor=1)
line_4 = LineSDL(Start=pt_13, Direction=Z_5, Length=offset)
move_3 = Move(Geometry=geo_6, Motion=line_4)  # -> Geometry, Transform
geo_7 = Geometry(move_3.Geometry)

geo_8 = Geometry(line_symbols_2)

# ----
# Offset from Level
offset_5 = Slider(140, range=0..200)
geo_9 = Geometry(risers_points)
pt_14 = ConstructPoint(XCoordinate=0, YCoordinate=0, ZCoordinate=0)
Z_6 = UnitZ(Factor=1)
line_5 = LineSDL(Start=pt_14, Direction=Z_6, Length=offset)
move_4 = Move(Geometry=geo_9, Motion=line_5)  # -> Geometry, Transform
geo_10 = Geometry(move_4.Geometry)

# ----
# Offset from Level
offset_6 = Slider(170, range=0..200)
geo_11 = Geometry(risers_points_2)
pt_15 = ConstructPoint(XCoordinate=0, YCoordinate=0, ZCoordinate=0)
Z_7 = UnitZ(Factor=1)
line_6 = LineSDL(Start=pt_15, Direction=Z_7, Length=offset)
move_5 = Move(Geometry=geo_11, Motion=line_6)  # -> Geometry, Transform
geo_12 = Geometry(move_5.Geometry)

line_7 = LineSDL(Start=pt_7, Direction=Z_3, Length=addition)

# ----
# Offset from Level
offset_7 = Slider(140, range=0..200)
geo_13 = Geometry(risers_points_2)
pt_16 = ConstructPoint(XCoordinate=0, YCoordinate=0, ZCoordinate=0)
Z_8 = UnitZ(Factor=1)
line_8 = LineSDL(Start=pt_16, Direction=Z_8, Length=offset)
move_6 = Move(Geometry=geo_13, Motion=line_8)  # -> Geometry, Transform
geo_14 = Geometry(move_6.Geometry)

ln_2 = Line(StartPoint=pt_7, EndPoint=curvepoint_3)
move_7 = Move(Geometry=geo, Motion=line_3)  # -> Geometry, Transform
pt_17 = ConstructPoint(XCoordinate=0, YCoordinate=0, ZCoordinate=0)
Z_9 = UnitZ(Factor=1)
addition_3 = Addition(A=offset)
addition_4 = Addition(A=offset_5)

# ----
# Offset from Level
geo_15 = Geometry(drops_points)
pt_18 = ConstructPoint(XCoordinate=0, YCoordinate=0, ZCoordinate=0)
Z_10 = UnitZ(Factor=1)
line_9 = LineSDL(Start=pt_18, Direction=Z_10, Length=addition_4)
move_8 = Move(Geometry=geo_15, Motion=line_9)  # -> Geometry, Transform
geo_16 = Geometry(move_8.Geometry)

geo_17 = Geometry(move_7.Geometry)
addition_5 = Addition(A=offset)

# ----
# Offset from Level
geo_18 = Geometry(drops_points_2)
pt_19 = ConstructPoint(XCoordinate=0, YCoordinate=0, ZCoordinate=0)
Z_11 = UnitZ(Factor=1)
line_10 = LineSDL(Start=pt_19, Direction=Z_11, Length=addition_5)
move_9 = Move(Geometry=geo_18, Motion=line_10)  # -> Geometry, Transform
geo_19 = Geometry(move_9.Geometry)

# ----
# Offset from Level
line_11 = LineSDL(Start=pt_17, Direction=Z_9, Length=addition_3)
move_10 = Move(Geometry=geo_8, Motion=line_11)  # -> Geometry, Transform
ln_3 = Line(StartPoint=geo_3, EndPoint=geo_17)
pt_20 = Point(geo_17)
geo_20 = Geometry(move_10.Geometry)
crv_5 = Curve(ln_3)
ln_4 = Line(StartPoint=geo_7, EndPoint=geo_10)
ln_5 = Line(StartPoint=geo_12, EndPoint=geo_14)
move_11 = Move(Geometry=ln_2, Motion=line_7)  # -> Geometry, Transform
data_3 = Data(pt_2)
data_4 = Data(ps__convert_number_2.A)
data_5 = Data(flatten(pt_20))
end_2 = EndPoints(Curve=move_11.Geometry)  # -> Start, End
data_6 = Data(flatten(crv_5))
data_7 = Data(pt)
data_8 = Data(ps__convert_number.A)
null_6 = NullItem(Item=data_6)  # -> NullFlags, InvalidFlags, Description
null_7 = NullItem(Item=data_5)  # -> NullFlags, InvalidFlags, Description
data_9 = Data(flatten(move_11.Geometry))
data_10 = Data(flatten(end_2.Start))
cull_20 = CullPattern(List=data_6, CullPattern=invert(null_6.NullFlags))
cull_21 = CullPattern(List=data_5, CullPattern=invert(null_7.NullFlags))
null_8 = NullItem(Item=data_9)  # -> NullFlags, InvalidFlags, Description
null_9 = NullItem(Item=data_10)  # -> NullFlags, InvalidFlags, Description
cull_22 = CullPattern(List=data_9, CullPattern=invert(null_8.NullFlags))
cull_23 = CullPattern(List=data_10, CullPattern=invert(null_9.NullFlags))

# ----
# ENDPOINT EXPORT
end_3 = EndPoints(Curve=flatten(cull_20))  # -> Start, End
pdecon = Deconstruct(Point=end_3.Start)  # -> XComponent, YComponent, ZComponent
pdecon_2 = Deconstruct(Point=end_3.End)  # -> XComponent, YComponent, ZComponent
panel_5 = Panel(pdecon.ZComponent)
panel_6 = Panel(pdecon.XComponent)
panel_7 = Panel(pdecon.YComponent)
panel_8 = Panel(pdecon_2.XComponent)
panel_9 = Panel(pdecon_2.YComponent)
panel_10 = Panel(pdecon_2.ZComponent)

pt_21 = Point(pt_9)

# ----
# ENDPOINT EXPORT
end_4 = EndPoints(Curve=flatten(cull_22))  # -> Start, End
pdecon_3 = Deconstruct(Point=end_4.Start)  # -> XComponent, YComponent, ZComponent
pdecon_4 = Deconstruct(Point=end_4.End)  # -> XComponent, YComponent, ZComponent
panel_11 = Panel(pdecon_3.XComponent)
panel_12 = Panel(pdecon_3.ZComponent)
panel_13 = Panel(pdecon_3.YComponent)
panel_14 = Panel(pdecon_4.XComponent)
panel_15 = Panel(pdecon_4.YComponent)
panel_16 = Panel(pdecon_4.ZComponent)

# ----
# SINGLE POINT EXPORT
pdecon_5 = Deconstruct(Point=data_5)  # -> XComponent, YComponent, ZComponent
panel_17 = Panel(pdecon_5.YComponent)
panel_18 = Panel(pdecon_5.ZComponent)
panel_19 = Panel(pdecon_5.XComponent)

# ----
# SINGLE POINT EXPORT
pdecon_6 = Deconstruct(Point=data_10)  # -> XComponent, YComponent, ZComponent
panel_20 = Panel(pdecon_6.YComponent)
panel_21 = Panel(pdecon_6.ZComponent)
panel_22 = Panel(pdecon_6.XComponent)

data_11 = Data(curvepoint_3)
data_12 = Data(data_6)
lng_3 = ListLength(List=data_12)
series = Series(Start=1, Step=0, Count=lng_3)

# ----
# Offset from Level
offset_8 = Slider(0, range=0..200)
geo_21 = Geometry(drops_points)
pt_22 = ConstructPoint(XCoordinate=0, YCoordinate=0, ZCoordinate=0)
Z_12 = UnitZ(Factor=1)

addition_6 = Addition(A=offset_8)

line_12 = LineSDL(Start=pt_22, Direction=Z_12, Length=addition_6)
move_12 = Move(Geometry=geo_21, Motion=line_12)  # -> Geometry, Transform
geo_22 = Geometry(move_12.Geometry)

pt_23 = Point(geo_22)
ln_6 = Line(StartPoint=geo_16, EndPoint=pt_23)
crv_6 = Curve(flatten([geo_20, ln_6, ln_4]))
null_10 = NullItem(Item=crv_6)  # -> NullFlags, InvalidFlags, Description
cull_24 = CullPattern(List=crv_6, CullPattern=invert(null_10.InvalidFlags))
panel_23 = Panel(crv_6)
crv_7 = Curve(flatten(cull_24))

lng_4 = ListLength(List=crv_7)
series_2 = Series(Start=0, Step=1, Count=lng_4)
crv_cp = CurveClosestPoint(Point=graft(pt_21), Curve=crv_7)  # -> Point, Parameter, Distance
sort_2 = SortList(Keys=crv_cp.Distance, ValuesA=crv_7, ValuesB=series_2)  # -> Keys, ValuesA, ValuesB
offset_9 = Slider(2, range=0..200)
item_5 = ListItem(List=sort_2.ValuesB, Index=0, Wrap=True)  # -> simplify(flatten(Item))
item_6 = ListItem(List=sort_2.ValuesA, Index=0, Wrap=True)  # -> simplify(flatten(Item))
panel_24 = Panel(item_5)
Z_13 = UnitZ(Factor=offset_9)
end_5 = EndPoints(Curve=item_6)  # -> Start, End
move_13 = Move(Geometry=end_5.Start, Motion=Z_13)  # -> Geometry, Transform
move_14 = Move(Geometry=item_6, Motion=Z_13)  # -> Geometry, Transform
move_15 = Move(Geometry=end_5.End, Motion=Z_13)  # -> Geometry, Transform
ln_7 = Line(StartPoint=end_5.Start, EndPoint=move_13.Geometry)
ln_8 = Line(StartPoint=end_5.End, EndPoint=move_15.Geometry)
crv_8 = Curve([ln_7, ln_8, move_14.Geometry])

cull_i = CullIndex(List=crv_7, Indices=item_5, Wrap=True)
lng_5 = ListLength(List=cull_i)
series_3 = Series(Start=0, Step=1, Count=lng_5)

crv_cp_2 = CurveClosestPoint(Point=graft(data_11), Curve=cull_i)  # -> Point, Parameter, Distance
sort_3 = SortList(Keys=crv_cp_2.Distance, ValuesA=cull_i, ValuesB=series_3)  # -> Keys, ValuesA, ValuesB
offset_10 = Slider(2, range=0..200)
item_7 = ListItem(List=sort_3.ValuesA, Index=0, Wrap=True)  # -> simplify(flatten(Item))
Z_14 = UnitZ(Factor=offset_10)
end_6 = EndPoints(Curve=item_7)  # -> Start, End
move_16 = Move(Geometry=end_6.End, Motion=Z_14)  # -> Geometry, Transform
move_17 = Move(Geometry=item_7, Motion=Z_14)  # -> Geometry, Transform
move_18 = Move(Geometry=end_6.Start, Motion=Z_14)  # -> Geometry, Transform
offset_11 = Slider(0.5, range=0..200)
ln_9 = Line(StartPoint=end_6.End, EndPoint=move_16.Geometry)
offset_12 = Slider(0.5, range=0..200)
crv_9 = Curve([ln_9, move_17.Geometry])
pipe = Pipe(Curve=[crv_8, crv_9], Radius=offset_11, Caps=0)

item_8 = ListItem(List=sort_3.ValuesB, Index=0, Wrap=True)  # -> simplify(flatten(Item))
cull_i_2 = CullIndex(List=cull_i, Indices=item_8, Wrap=True)

# ----
# ATTRIBUTE TEXT by LEADER
pt_24 = Point(simplify(data_7))
data_13 = Data(flatten(data_8))
crv_cp_3 = CurveClosestPoint(Point=pt_24, Curve=graft(cull_i_2))  # -> Point, Parameter, Distance
sort_4 = SortList(Keys=crv_cp_3.Distance, ValuesD=data_13)  # -> Keys, ValuesD
item_9 = ListItem(List=sort_4.ValuesD, Index=0, Wrap=True)  # -> simplify(flatten(Item))
crv_10 = Curve(simplify(flatten(cull_i_2)))

panel_25 = Panel(item_8)
division = Division(A=item_9, B=2)
pipe_2 = Pipe(Curve=crv_10, Radius=division, Caps=0)

data_14 = Data(item_9)
data_15 = Data(flatten(crv_10))
null_11 = NullItem(Item=data_15)  # -> NullFlags, InvalidFlags, Description
cull_25 = CullPattern(List=data_15, CullPattern=invert(null_11.NullFlags))
cull_26 = CullPattern(List=data_14, CullPattern=invert(null_11.NullFlags))
end_7 = EndPoints(Curve=flatten(cull_25))  # -> Start, End
pdecon_7 = Deconstruct(Point=end_7.Start)  # -> XComponent, YComponent, ZComponent
pdecon_8 = Deconstruct(Point=end_7.End)  # -> XComponent, YComponent, ZComponent
panel_26 = Panel(pdecon_7.XComponent)
panel_27 = Panel(pdecon_7.YComponent)
panel_28 = Panel(pdecon_7.ZComponent)
panel_29 = Panel(pdecon_8.XComponent)
panel_30 = Panel(pdecon_8.YComponent)
panel_31 = Panel(pdecon_8.ZComponent)
panel_32 = Panel(cull_26)

data_16 = Data(flatten([crv_8, crv_9]))
lng_6 = ListLength(List=data_16)
series_4 = Series(Start=1, Step=0, Count=lng_6)
null_12 = NullItem(Item=data_16)  # -> NullFlags, InvalidFlags, Description
cull_27 = CullPattern(List=data_16, CullPattern=invert(null_12.NullFlags))
end_8 = EndPoints(Curve=flatten(cull_27))  # -> Start, End

pdecon_9 = Deconstruct(Point=end_8.Start)  # -> XComponent, YComponent, ZComponent
pdecon_10 = Deconstruct(Point=end_8.End)  # -> XComponent, YComponent, ZComponent
panel_33 = Panel(pdecon_9.XComponent)
panel_34 = Panel(pdecon_9.YComponent)
panel_35 = Panel(pdecon_9.ZComponent)
panel_36 = Panel(pdecon_10.XComponent)
panel_37 = Panel(pdecon_10.YComponent)
panel_38 = Panel(pdecon_10.ZComponent)

# ----
# Offset from Level
offset_13 = Slider(0, range=0..200)
geo_23 = Geometry(drops_points_2)
pt_25 = ConstructPoint(XCoordinate=0, YCoordinate=0, ZCoordinate=0)
Z_15 = UnitZ(Factor=1)

addition_7 = Addition(A=offset_13)

line_13 = LineSDL(Start=pt_25, Direction=Z_15, Length=addition_7)
move_19 = Move(Geometry=geo_23, Motion=line_13)  # -> Geometry, Transform
geo_24 = Geometry(move_19.Geometry)

pt_26 = Point(geo_24)
ln_10 = Line(StartPoint=geo_19, EndPoint=pt_26)
crv_11 = Curve([geo_5, ln_10, ln_5])
crv_12 = Curve(flatten(crv_11))

# ----
# ATTRIBUTE TEXT by LEADER
pt_27 = Point(simplify(data_3))
data_17 = Data(flatten(data_4))
crv_cp_4 = CurveClosestPoint(Point=pt_27, Curve=graft(crv_12))  # -> Point, Parameter, Distance
sort_5 = SortList(Keys=crv_cp_4.Distance, ValuesD=data_17)  # -> Keys, ValuesD
item_10 = ListItem(List=sort_5.ValuesD, Index=0, Wrap=True)  # -> simplify(flatten(Item))
crv_13 = Curve(simplify(flatten(crv_12)))

pipe_3 = Pipe(Curve=crv_13, Radius=item_10, Caps=0)
data_18 = Data(flatten(crv_13))
data_19 = Data(item_10)
null_13 = NullItem(Item=data_18)  # -> NullFlags, InvalidFlags, Description
cull_28 = CullPattern(List=data_18, CullPattern=invert(null_13.NullFlags))
cull_29 = CullPattern(List=data_19, CullPattern=invert(null_13.NullFlags))
crv_14 = Curve(data_18)
end_9 = EndPoints(Curve=crv_14)  # -> Start, End
# ENDPOINT EXPORT
end_10 = EndPoints(Curve=flatten(cull_28))  # -> Start, End
pdecon_11 = Deconstruct(Point=end_10.Start)  # -> XComponent, YComponent, ZComponent
pdecon_12 = Deconstruct(Point=end_10.End)  # -> XComponent, YComponent, ZComponent
panel_39 = Panel(pdecon_11.XComponent)
panel_40 = Panel(pdecon_11.YComponent)
panel_41 = Panel(pdecon_11.ZComponent)
panel_42 = Panel(pdecon_12.XComponent)
panel_43 = Panel(pdecon_12.YComponent)
panel_44 = Panel(pdecon_12.ZComponent)
panel_45 = Panel(cull_29)

data_20 = Data(flatten([item_9, series_4, cull_29, series]))
data_21 = Data(flatten([crv_10, data_16, cull_28, data_12]))
null_14 = NullItem(Item=data_21)  # -> NullFlags, InvalidFlags, Description
cull_30 = CullPattern(List=data_21, CullPattern=invert(null_14.NullFlags))
cull_31 = CullPattern(List=data_20, CullPattern=invert(null_14.NullFlags))
end_11 = EndPoints(Curve=flatten(cull_30))  # -> Start, End
pdecon_13 = Deconstruct(Point=end_11.Start)  # -> XComponent, YComponent, ZComponent
pdecon_14 = Deconstruct(Point=end_11.End)  # -> XComponent, YComponent, ZComponent
panel_46 = Panel(pdecon_13.XComponent)
panel_47 = Panel(pdecon_13.YComponent)
panel_48 = Panel(pdecon_13.ZComponent)
panel_49 = Panel(pdecon_14.XComponent)
panel_50 = Panel(pdecon_14.YComponent)
panel_51 = Panel(pdecon_14.ZComponent)
panel_52 = Panel(cull_31)
