# Grasshopper definition ground.gh (Grasshopper 0.9.70)
# plug-ins: HDTReference

# PIPES FP_DRY
level_4 = Slider(530, range=0..1000)
# SPRINKLER HEADS
# 
# RECESSED
data = Data()
level_4_2 = Slider(530, range=0..1000)

dpipeline = DynamicGeometryPipeline(
    LayerFilter="PIPESPC",
    TypeFilter="text",
    NameFilter="*",
    enableFullPath=False,
    GroupByLayer=False,
    GroupByType=False,
    IncludeHidden=True,
    IncludeLocked=True)
data_text = Data(dpipeline)
txtobjinfo = TextObjectInfo(TextObjects=data_text)  # -> Plane, Text, Size, Alignment, VerticalAlignment
null = NullItem(Item=txtobjinfo.Plane)  # -> NullFlags, InvalidFlags, Description
cull = CullPattern(List=txtobjinfo.Plane, CullPattern=invert(null.NullFlags))
cull_2 = CullPattern(List=txtobjinfo.Text, CullPattern=invert(null.NullFlags))

dpipeline_2 = DynamicGeometryPipeline(
    LayerFilter="PIPEBL",
    TypeFilter="Curve",
    NameFilter="*",
    enableFullPath=False,
    GroupByLayer=False,
    GroupByType=False,
    IncludeHidden=True,
    IncludeLocked=True)  # -> flatten(GeometryOut)
dpipeline_3 = DynamicGeometryPipeline(
    LayerFilter="pipemn",
    TypeFilter="Curve",
    NameFilter="*",
    enableFullPath=False,
    GroupByLayer=False,
    GroupByType=False,
    IncludeHidden=True,
    IncludeLocked=True)  # -> flatten(GeometryOut)

dpipeline_4 = DynamicGeometryPipeline(
    LayerFilter="PIPESPC",
    TypeFilter="text",
    NameFilter="*",
    enableFullPath=False,
    GroupByLayer=False,
    GroupByType=False,
    IncludeHidden=True,
    IncludeLocked=True)
data_text_2 = Data(dpipeline_4)
txtobjinfo_2 = TextObjectInfo(TextObjects=data_text_2)  # -> Plane, Text, Size, Alignment, VerticalAlignment
null_2 = NullItem(Item=txtobjinfo_2.Plane)  # -> NullFlags, InvalidFlags, Description
cull_3 = CullPattern(List=txtobjinfo_2.Plane, CullPattern=invert(null_2.NullFlags))
cull_4 = CullPattern(List=txtobjinfo_2.Text, CullPattern=invert(null_2.NullFlags))

dpipeline_5 = DynamicGeometryPipeline(
    LayerFilter="headdn",
    TypeFilter="block",
    NameFilter="*",
    enableFullPath=False,
    GroupByLayer=False,
    GroupByType=False,
    IncludeHidden=True,
    IncludeLocked=True)  # -> flatten(GeometryOut)
all_offset = Slider(0, range=0..200)
crv = Curve(simplify(dpipeline_3))
all_offset_2 = Slider(4, range=0..200)
blockexplode = ExplodeBlocks(BlockObjects=dpipeline_5, explodeGeom=True)  # -> Geometry, Attributes, BlockName, BoundingBox, BlockTransform

# ----
# SORTING_3
# Curve or Line (run vs symbol)
explode = Explode(Curve=crv, Recursive=True)  # -> Segments, Vertices
cp = ControlPoints(Curve=explode.Segments)  # -> Points, Weights, Knots
lng = ListLength(List=cp.Points)  # -> flatten(Length)
equals = Equality(FirstNumber=lng, SecondNumber=9)  # -> Equality, Inequality
cull_5 = CullPattern(List=flatten(explode.Segments), CullPattern=equals.Equality)
cull_6 = CullPattern(List=flatten(explode.Segments), CullPattern=invert(equals.Equality))
circle_symbols = Data(cull_5)
line_symbols = Data(cull_6)

crv_2 = Curve(simplify(dpipeline_2))
explode_2 = Explode(Curve=crv_2, Recursive=True)  # -> Segments, Vertices
item = ListItem(List=simplify(blockexplode.Geometry), Index=all_offset_2, Wrap=True)  # -> flatten(Item)
item_2 = ListItem(List=simplify(blockexplode.Geometry), Index=all_offset, Wrap=True)  # -> flatten(Item)
dpipeline_6 = DynamicGeometryPipeline(
    LayerFilter="headdn",
    TypeFilter="block",
    NameFilter="*",
    enableFullPath=False,
    GroupByLayer=False,
    GroupByType=False,
    IncludeHidden=True,
    IncludeLocked=True)  # -> flatten(GeometryOut)
cp_2 = ControlPoints(Curve=explode_2.Segments)  # -> Points, Weights, Knots
all_offset_3 = Slider(4, range=0..200)
all_offset_4 = Slider(13, range=0..200)
all_offset_5 = Slider(0, range=0..200)
all_offset_6 = Slider(2, range=0..200)
offset = Slider(98, range=0..200)
offset_2 = Slider(93, range=0..200)
lng_2 = ListLength(List=cp_2.Points)  # -> flatten(Length)

pt = Point(cull)

data_2 = Data(flatten(blockexplode.BlockName))
blockexplode_2 = ExplodeBlocks(BlockObjects=dpipeline_6, explodeGeom=True)  # -> simplify(Geometry), Attributes, flatten(BlockName), BoundingBox, BlockTransform
equals_2 = Equality(FirstNumber=lng_2, SecondNumber=9)  # -> Equality, Inequality
panel = Panel(data_2)
cull_7 = CullPattern(List=flatten(explode_2.Segments), CullPattern=equals_2.Equality)
cull_8 = CullPattern(List=flatten(explode_2.Segments), CullPattern=invert(equals_2.Equality))
item_3 = ListItem(List=simplify(blockexplode_2.Geometry), Index=all_offset_4, Wrap=True)  # -> flatten(Item)
item_4 = ListItem(List=simplify(blockexplode_2.Geometry), Index=all_offset_5, Wrap=True)  # -> flatten(Item)
tmatch = MatchText(Text=flatten(blockexplode.BlockName), Pattern="dpend2", Case=True)
tmatch_2 = MatchText(Text=flatten(blockexplode.BlockName), Pattern="dpend1", Case=True)
tmatch_3 = MatchText(Text=blockexplode_2.BlockName, Pattern="side2", Case=True)
tmatch_4 = MatchText(Text=flatten(blockexplode.BlockName), Pattern="DPEND3", Case=True)
item_5 = ListItem(List=simplify(blockexplode_2.Geometry), Index=all_offset_3, Wrap=True)  # -> flatten(Item)
item_6 = ListItem(List=simplify(blockexplode_2.Geometry), Index=all_offset_6, Wrap=True)  # -> flatten(Item)
tmatch_5 = MatchText(Text=blockexplode_2.BlockName, Pattern="SIDE4", Case=True)

pt_2 = Point(cull_3)

circle_symbols_2 = Data(cull_7)
ps__convert_number = CSharpScript(x=cull_2)  # -> out, A; inputs x: list of String
# ---------- ps__convert_number: C# ----------
    List<double> dists = new List<double>();

    foreach(string s in x)
    {
      string n = "";
      for(int i = 0; i <= s.Length - 1; i++)
      {
        if(Char.IsDigit(s, i))
        {
          n += s[i];
        }
      }

      char [] split = n.ToCharArray();

      if(split.Length == 0)
      {
        Print("fail");
        double d = 2.0;
        dists.Add(d);
      }
      else
      {

        double d = (double) Char.GetNumericValue(split[0]);

        if(split.Length == 3)
        {
          d = d + (double) Char.GetNumericValue(split[1])
            / (double) Char.GetNumericValue(split[2]);
        }

        dists.Add(d);
      }


      //   Print(d.ToString());
    }

    A = dists;
# ---------- end ps__convert_number ----------
line_symbols_2 = Data(cull_8)
cull_9 = CullPattern(List=item_3, CullPattern=tmatch_3)  # -> flatten(List)
cull_10 = CullPattern(List=item, CullPattern=tmatch_2)
cull_11 = CullPattern(List=item_4, CullPattern=tmatch_3)  # -> flatten(List)
cull_12 = CullPattern(List=item_2, CullPattern=tmatch)
cull_13 = CullPattern(List=item_2, CullPattern=tmatch_4)
ps__convert_number_2 = CSharpScript(x=cull_4)  # -> out, A; inputs x: list of String; same code as ps__convert_number
cull_14 = CullPattern(List=item_5, CullPattern=tmatch_5)  # -> flatten(List)
cull_15 = CullPattern(List=item_6, CullPattern=tmatch_5)  # -> flatten(List)
panel_2 = Panel(tmatch_3)
end = EndPoints(Curve=cull_9)  # -> Start, End
curvepoint = PointOnCurve(cull_9, parameter=0.5)
curvepoint_2 = PointOnCurve(cull_11, parameter=0.5)
end_2 = EndPoints(Curve=cull_14)  # -> Start, End
merge = Merge(Data1=cull_10, Data2=cull_12, Data3=cull_13)
curvepoint_3 = PointOnCurve(cull_14, parameter=0.5)
curvepoint_4 = PointOnCurve(cull_15, parameter=0.5)

# ----
# SORTING_4
# (Riser VS Drop)
cls = Closed(Curve=circle_symbols_2)  # -> Closed, Periodic
cull_16 = CullPattern(List=circle_symbols_2, CullPattern=invert(cls.Closed))
cull_17 = CullPattern(List=circle_symbols_2, CullPattern=cls.Closed)
cp_3 = ControlPoints(Curve=cull_16)  # -> Points, Weights, Knots
cp_4 = ControlPoints(Curve=cull_17)  # -> Points, Weights, Knots
pline = PolyLine(Vertices=cp_3.Points, Closed=invert(False))
pline_2 = PolyLine(Vertices=cp_4.Points, Closed=invert(False))
pcen = PolygonCenter(Polyline=pline)  # -> CenterV, CenterE
risers_curves = Data(cull_17)
pcen_2 = PolygonCenter(Polyline=pline_2)  # -> CenterV, CenterE
drops_curves = Data(cull_16)
pt_3 = Point(pcen.CenterE)
pt_4 = Point(pcen_2.CenterE)
drops_points = Data(pt_3)
risers_points = Data(pt_4)

ln = Line(StartPoint=curvepoint_2, EndPoint=curvepoint)

# ----
# SORTING_4
# (Riser VS Drop)
cls_2 = Closed(Curve=circle_symbols)  # -> Closed, Periodic
cull_18 = CullPattern(List=circle_symbols, CullPattern=invert(cls_2.Closed))
cull_19 = CullPattern(List=circle_symbols, CullPattern=cls_2.Closed)
cp_5 = ControlPoints(Curve=cull_18)  # -> Points, Weights, Knots
cp_6 = ControlPoints(Curve=cull_19)  # -> Points, Weights, Knots
pline_3 = PolyLine(Vertices=cp_5.Points, Closed=invert(False))
pline_4 = PolyLine(Vertices=cp_6.Points, Closed=invert(False))
pcen_3 = PolygonCenter(Polyline=pline_3)  # -> CenterV, CenterE
pcen_4 = PolygonCenter(Polyline=pline_4)  # -> CenterV, CenterE
risers_curves_2 = Data(cull_19)
drops_curves_2 = Data(cull_18)
pt_5 = Point(pcen_3.CenterE)
pt_6 = Point(pcen_4.CenterE)
drops_points_2 = Data(pt_5)
risers_points_2 = Data(pt_6)

panel_3 = Panel(ps__convert_number.A)
crv_3 = Curve(flatten(merge))
curvepoint_5 = PointOnCurve(ln, parameter=0.5)
ln_2 = Line(StartPoint=curvepoint_4, EndPoint=curvepoint_3)
panel_4 = Panel(ps__convert_number_2.A)
pt_7 = Point(end.Start)
preview = CustomPreview(
    Geometry=item_2,
    Shader={ambient=RGB(0, 0, 0), diffuse=RGB(255, 105, 180), emission=RGB(76, 32, 54), shine=0.5, specular=RGB(255, 255, 255), transparency=0})
darc = DeconstructArc(Arc=crv_3)  # -> BasePlane, Radius, Angle
null_3 = NullItem(Item=darc.BasePlane)  # -> NullFlags, InvalidFlags, Description
curvepoint_6 = PointOnCurve(ln_2, parameter=0.5)
pt_8 = Point(pt_7)
pt_9 = Point(end_2.Start)
cull_20 = CullPattern(List=darc.BasePlane, CullPattern=invert(null_3.NullFlags))
ln_3 = Line(StartPoint=pt_9, EndPoint=curvepoint_6)
pt_10 = Point(cull_20)
offset_3 = Slider(134, range=0..200)
preview_2 = CustomPreview(
    Geometry=pt_10,
    Shader={ambient=RGB(0, 0, 0), diffuse=RGB(255, 105, 180), emission=RGB(76, 32, 54), shine=0.5, specular=RGB(255, 255, 255), transparency=0})
geo = Geometry(pt_10)
geo_2 = Geometry(pt_8)

# ----
# Offset from Level
geo_3 = Geometry(pt_10)
pt_11 = ConstructPoint(XCoordinate=0, YCoordinate=0, ZCoordinate=0)
Z = UnitZ(Factor=1)
line = LineSDL(Start=pt_11, Direction=Z, Length=offset)
move = Move(Geometry=geo_3, Motion=line)  # -> Geometry, Transform
geo_4 = Geometry(move.Geometry)

pt_12 = ConstructPoint(XCoordinate=0, YCoordinate=0, ZCoordinate=0)
Z_2 = UnitZ(Factor=1)
Z_3 = UnitZ(Factor=1)

# ----
# Offset from Level
offset_4 = Slider(106, range=0..200)
geo_5 = Geometry(line_symbols)
pt_13 = ConstructPoint(XCoordinate=0, YCoordinate=0, ZCoordinate=0)
Z_4 = UnitZ(Factor=1)
addition = Addition(A=offset)
line_2 = LineSDL(Start=pt_13, Direction=Z_4, Length=addition)
move_2 = Move(Geometry=geo_5, Motion=line_2)  # -> Geometry, Transform
geo_6 = Geometry(move_2.Geometry)

# ----
# Offset from Level
line_3 = LineSDL(Start=pt_12, Direction=Z_2, Length=offset_2)

# ----
# Offset from Level
offset_5 = Slider(170, range=0..200)
geo_7 = Geometry(risers_points)
pt_14 = ConstructPoint(XCoordinate=0, YCoordinate=0, ZCoordinate=0)
Z_5 = UnitZ(Factor=1)
line_4 = LineSDL(Start=pt_14, Direction=Z_5, Length=offset)
move_3 = Move(Geometry=geo_7, Motion=line_4)  # -> Geometry, Transform
geo_8 = Geometry(move_3.Geometry)

geo_9 = Geometry(line_symbols_2)

# ----
# Offset from Level
offset_6 = Slider(140, range=0..200)
geo_10 = Geometry(risers_points)
pt_15 = ConstructPoint(XCoordinate=0, YCoordinate=0, ZCoordinate=0)
Z_6 = UnitZ(Factor=1)
line_5 = LineSDL(Start=pt_15, Direction=Z_6, Length=offset)
move_4 = Move(Geometry=geo_10, Motion=line_5)  # -> Geometry, Transform
geo_11 = Geometry(move_4.Geometry)

ln_4 = Line(StartPoint=pt_7, EndPoint=curvepoint_5)

# ----
# Offset from Level
offset_7 = Slider(170, range=0..200)
geo_12 = Geometry(risers_points_2)
pt_16 = ConstructPoint(XCoordinate=0, YCoordinate=0, ZCoordinate=0)
Z_7 = UnitZ(Factor=1)
line_6 = LineSDL(Start=pt_16, Direction=Z_7, Length=offset)
move_5 = Move(Geometry=geo_12, Motion=line_6)  # -> Geometry, Transform
geo_13 = Geometry(move_5.Geometry)

line_7 = LineSDL(Start=pt_7, Direction=Z_3, Length=offset)

# ----
# Offset from Level
offset_8 = Slider(140, range=0..200)
geo_14 = Geometry(risers_points_2)
pt_17 = ConstructPoint(XCoordinate=0, YCoordinate=0, ZCoordinate=0)
Z_8 = UnitZ(Factor=1)
line_8 = LineSDL(Start=pt_17, Direction=Z_8, Length=offset)
move_6 = Move(Geometry=geo_14, Motion=line_8)  # -> Geometry, Transform
geo_15 = Geometry(move_6.Geometry)

move_7 = Move(Geometry=geo, Motion=line_3)  # -> Geometry, Transform
pt_18 = ConstructPoint(XCoordinate=0, YCoordinate=0, ZCoordinate=0)
Z_9 = UnitZ(Factor=1)
addition_2 = Addition(A=offset)
addition_3 = Addition(A=offset_6)

# ----
# Offset from Level
geo_16 = Geometry(drops_points)
pt_19 = ConstructPoint(XCoordinate=0, YCoordinate=0, ZCoordinate=0)
Z_10 = UnitZ(Factor=1)
line_9 = LineSDL(Start=pt_19, Direction=Z_10, Length=addition_3)
move_8 = Move(Geometry=geo_16, Motion=line_9)  # -> Geometry, Transform
geo_17 = Geometry(move_8.Geometry)

geo_18 = Geometry(move_7.Geometry)
addition_4 = Addition(A=offset)

# ----
# Offset from Level
geo_19 = Geometry(drops_points_2)
pt_20 = ConstructPoint(XCoordinate=0, YCoordinate=0, ZCoordinate=0)
Z_11 = UnitZ(Factor=1)
line_10 = LineSDL(Start=pt_20, Direction=Z_11, Length=addition_4)
move_9 = Move(Geometry=geo_19, Motion=line_10)  # -> Geometry, Transform
geo_20 = Geometry(move_9.Geometry)

# ----
# Offset from Level
line_11 = LineSDL(Start=pt_18, Direction=Z_9, Length=addition_2)
move_10 = Move(Geometry=geo_9, Motion=line_11)  # -> Geometry, Transform
ln_5 = Line(StartPoint=geo_4, EndPoint=geo_18)
pt_21 = Point(geo_18)
geo_21 = Geometry(move_10.Geometry)
crv_4 = Curve(ln_5)
ln_6 = Line(StartPoint=geo_8, EndPoint=geo_11)
ln_7 = Line(StartPoint=geo_13, EndPoint=geo_15)
move_11 = Move(Geometry=[ln_4, ln_3], Motion=line_7)  # -> Geometry, Transform
data_3 = Data(pt_2)
data_4 = Data(ps__convert_number_2.A)
data_5 = Data(pt)
data_6 = Data(ps__convert_number.A)
end_3 = EndPoints(Curve=move_11.Geometry)  # -> Start, End
data_7 = Data(flatten(pt_21))
data_8 = Data(flatten(crv_4))
data_9 = Data(flatten(end_3.Start))
data_10 = Data(flatten(move_11.Geometry))
null_4 = NullItem(Item=data_8)  # -> NullFlags, InvalidFlags, Description
null_5 = NullItem(Item=data_10)  # -> NullFlags, InvalidFlags, Description
null_6 = NullItem(Item=data_7)  # -> NullFlags, InvalidFlags, Description
null_7 = NullItem(Item=data_9)  # -> NullFlags, InvalidFlags, Description
cull_21 = CullPattern(List=data_8, CullPattern=invert(null_4.NullFlags))
cull_22 = CullPattern(List=data_10, CullPattern=invert(null_5.NullFlags))
cull_23 = CullPattern(List=data_7, CullPattern=invert(null_6.NullFlags))
cull_24 = CullPattern(List=data_9, CullPattern=invert(null_7.NullFlags))

# ----
# ENDPOINT EXPORT
end_4 = EndPoints(Curve=flatten(cull_21))  # -> Start, End
pdecon = Deconstruct(Point=end_4.Start)  # -> XComponent, YComponent, ZComponent
pdecon_2 = Deconstruct(Point=end_4.End)  # -> XComponent, YComponent, ZComponent
panel_5 = Panel(pdecon.XComponent)
panel_6 = Panel(pdecon.ZComponent)
panel_7 = Panel(pdecon.YComponent)
panel_8 = Panel(pdecon_2.XComponent)
panel_9 = Panel(pdecon_2.YComponent)
panel_10 = Panel(pdecon_2.ZComponent)

# ----
# ENDPOINT EXPORT
end_5 = EndPoints(Curve=flatten(cull_22))  # -> Start, End
pdecon_3 = Deconstruct(Point=end_5.Start)  # -> XComponent, YComponent, ZComponent
pdecon_4 = Deconstruct(Point=end_5.End)  # -> XComponent, YComponent, ZComponent
panel_11 = Panel(pdecon_3.XComponent)
panel_12 = Panel(pdecon_3.ZComponent)
panel_13 = Panel(pdecon_3.YComponent)
panel_14 = Panel(pdecon_4.XComponent)
panel_15 = Panel(pdecon_4.YComponent)
panel_16 = Panel(pdecon_4.ZComponent)

# ----
# SINGLE POINT EXPORT
pdecon_5 = Deconstruct(Point=data_7)  # -> XComponent, YComponent, ZComponent
panel_17 = Panel(pdecon_5.YComponent)
panel_18 = Panel(pdecon_5.ZComponent)
panel_19 = Panel(pdecon_5.XComponent)

# ----
# SINGLE POINT EXPORT
pdecon_6 = Deconstruct(Point=data_9)  # -> XComponent, YComponent, ZComponent
panel_20 = Panel(pdecon_6.YComponent)
panel_21 = Panel(pdecon_6.ZComponent)
panel_22 = Panel(pdecon_6.XComponent)

# ----
# Offset from Level
offset_9 = Slider(0, range=0..200)
geo_22 = Geometry(drops_points)
pt_22 = ConstructPoint(XCoordinate=0, YCoordinate=0, ZCoordinate=0)
Z_12 = UnitZ(Factor=1)

addition_5 = Addition(A=offset_9)

line_12 = LineSDL(Start=pt_22, Direction=Z_12, Length=addition_5)
move_12 = Move(Geometry=geo_22, Motion=line_12)  # -> Geometry, Transform
geo_23 = Geometry(move_12.Geometry)

pt_23 = Point(geo_23)
ln_8 = Line(StartPoint=geo_17, EndPoint=pt_23)
crv_5 = Curve([geo_21, ln_8, ln_6])
crv_6 = Curve(flatten(crv_5))

# ----
# ATTRIBUTE TEXT by LEADER
pt_24 = Point(simplify(data_5))
data_11 = Data(flatten(data_6))
crv_cp = CurveClosestPoint(Point=pt_24, Curve=graft(crv_6))  # -> Point, Parameter, Distance
sort = SortList(Keys=crv_cp.Distance, ValuesD=data_11)  # -> Keys, ValuesD
item_7 = ListItem(List=sort.ValuesD, Index=0, Wrap=True)  # -> simplify(flatten(Item))
crv_7 = Curve(simplify(flatten(crv_6)))

pipe = Pipe(Curve=crv_7, Radius=item_7, Caps=0)
data_12 = Data(flatten(crv_7))
data_13 = Data(item_7)
null_8 = NullItem(Item=data_12)  # -> NullFlags, InvalidFlags, Description
cull_25 = CullPattern(List=data_12, CullPattern=invert(null_8.NullFlags))
cull_26 = CullPattern(List=data_13, CullPattern=invert(null_8.NullFlags))
crv_8 = Curve(data_12)
end_6 = EndPoints(Curve=crv_8)  # -> Start, End
end_7 = EndPoints(Curve=flatten(cull_25))  # -> Start, End
pdecon_7 = Deconstruct(Point=end_7.Start)  # -> XComponent, YComponent, ZComponent
pdecon_8 = Deconstruct(Point=end_7.End)  # -> XComponent, YComponent, ZComponent
panel_23 = Panel(pdecon_7.XComponent)
panel_24 = Panel(pdecon_7.YComponent)
panel_25 = Panel(pdecon_7.ZComponent)
panel_26 = Panel(pdecon_8.XComponent)
panel_27 = Panel(pdecon_8.YComponent)
panel_28 = Panel(pdecon_8.ZComponent)
panel_29 = Panel(cull_26)

# ----
# Offset from Level
offset_10 = Slider(0, range=0..200)
geo_24 = Geometry(drops_points_2)
pt_25 = ConstructPoint(XCoordinate=0, YCoordinate=0, ZCoordinate=0)
Z_13 = UnitZ(Factor=1)

addition_6 = Addition(A=offset_10)

line_13 = LineSDL(Start=pt_25, Direction=Z_13, Length=addition_6)
move_13 = Move(Geometry=geo_24, Motion=line_13)  # -> Geometry, Transform
geo_25 = Geometry(move_13.Geometry)

pt_26 = Point(geo_25)
ln_9 = Line(StartPoint=geo_20, EndPoint=pt_26)
crv_9 = Curve([geo_6, ln_9, ln_7])
crv_10 = Curve(flatten(crv_9))

# ----
# ATTRIBUTE TEXT by LEADER
pt_27 = Point(simplify(data_3))
data_14 = Data(flatten(data_4))
crv_cp_2 = CurveClosestPoint(Point=pt_27, Curve=graft(crv_10))  # -> Point, Parameter, Distance
sort_2 = SortList(Keys=crv_cp_2.Distance, ValuesD=data_14)  # -> Keys, ValuesD
item_8 = ListItem(List=sort_2.ValuesD, Index=0, Wrap=True)  # -> simplify(flatten(Item))
crv_11 = Curve(simplify(flatten(crv_10)))

pipe_2 = Pipe(Curve=crv_11, Radius=item_8, Caps=0)
data_15 = Data(flatten(crv_11))
data_16 = Data(item_8)
null_9 = NullItem(Item=data_15)  # -> NullFlags, InvalidFlags, Description
cull_27 = CullPattern(List=data_15, CullPattern=invert(null_9.NullFlags))
cull_28 = CullPattern(List=data_16, CullPattern=invert(null_9.NullFlags))
crv_12 = Curve(data_15)
end_8 = EndPoints(Curve=crv_12)  # -> Start, End

# ----
# ENDPOINT EXPORT
end_9 = EndPoints(Curve=flatten(cull_27))  # -> Start, End
pdecon_9 = Deconstruct(Point=end_9.Start)  # -> XComponent, YComponent, ZComponent
pdecon_10 = Deconstruct(Point=end_9.End)  # -> XComponent, YComponent, ZComponent
panel_30 = Panel(pdecon_9.XComponent)
panel_31 = Panel(pdecon_9.YComponent)
panel_32 = Panel(pdecon_9.ZComponent)
panel_33 = Panel(pdecon_10.XComponent)
panel_34 = Panel(pdecon_10.YComponent)
panel_35 = Panel(pdecon_10.ZComponent)

panel_36 = Panel(cull_28)
